# Grasshopper definition 19_10_EnergyConsumption_building settings 2.0.gh (Grasshopper 1.0.7)
# plug-ins: Human, EleFront, LadybugGrasshopper

# ----
# 4 MODEL NAME
# 5 FOLDER PATH
name = Panel("Building_creator_test")
folder = Panel("C:\Users\sarat\OneDrive\Desktop\miao")
concat = Concatenate(FragmentA=folder, FragmentB=name, JoinSeparator="\")
txt = Text(concat)

# ----
# LAYER SETTING:
# before using this tool create these layers and sublayers
# 
# - Analysis Buildings
#    - Residential
#    - Offices
#    - .....(name according to building program)
# 
# - Context
#    - Buildings
#    - Trees
#    - Shadings
# :
# 1 EPW
path = FilePath("C:\Users\sarat\OneDrive\Desktop\BORSA ICARIA\TOOLS GH\CONFIGURAZIONI\ESP_BARCELONA_HadCM3_A2_2020.epw")
panel = Panel(path)

# ----
# Run The Simulation
lb_falsestarttoggle = LBFalseStartToggle(False)

# ---- group: base settings
bldgvintages = HBBuildingVintages({"ASHRAE 90.1 2019  |  IECC 2021": "2019", "ASHRAE 90.1 2016  |  IECC 2018": "2016", "ASHRAE 90.1 2013  |  IECC 2015": "2013", "ASHRAE 90.1 2010  |  IECC 2012": "2010", "ASHRAE 90.1 2007  |  IECC 2009": "2007", "ASHRAE 90.1 2004  |  IECC 2006": "2004", "1980-2004 (CBECS)": "1980_2004", "Pre-1980 (CBECS)": "pre_1980"}, selected="ASHRAE 90.1 2010  |  IECC 2012")
constructiontypes = HBConstructionTypes({"SteelFramed", "WoodFramed", "Mass", "Metal Building"}, selected="Mass")
climatezones = HBClimateZones({"1 - Very Hot": "1", "2 - Hot": "2", "3 - Warm": "3", "4 - Mixed": "4", "5 - Cool": "5", "6 - Cold": "6", "7 - Very Cold": "7", "8 - Subarctic": "8"}, selected="4 - Mixed")

# ----
wall = ValueList({"Muratura_laterizio_non_isolato": 0, "Muratura_laterizio_isolato": 1, "Muratura_lateerizio_altamente_isolato": 2, "Muratura_blocco_termico_isolato": 3, "Muratura_blocco_termico_altamente_isolato": 4, "Muratura_calcestruzzo_non_isolato": 5, "Muratura_calcestruzzo_medio_isolato_esterno": 6, "Muratura_calcestruzzo_medio_isolato_interno": 7, "Muratura_calcestruzzo_altamente_isolato": 8, "Muratura_pietra_non_isolato": 9, "Muratura_pietra_medio_isolato": 10, "Muratura_pietra_altamente_isolato": 11, "Muratura_mattoni_non_isolato": 12, "Muratura_mattoni_medio_isolato": 13, "Muratura_mattoni_altamente_isolato": 14, "PACCHETTO CALCESTRUZZO": 15, "PACCHETTO CALCESTRUZZO PARETE VENTILATA": 16, "PACCHETTO LEGNO A UMIDO": 17, "PACCHETTO ACCIAIO": 18, "PACCHETTO LEGNO A SECCO": 19}, selected="Muratura_laterizio_non_isolato")
roof = ValueList({"Solaio_legno_non_isolato": 0, "Solaio_legno_scarso_isolato": 1, "Solaio_legno_altamente_isolato": 2, "Solaio_laterocemento_non_isolato": 3, "Solaio_laterocemento_scarso_isolato": 4, "Solaio_laterocemento_altamente_isolato": 5, "Solaio_allegerito_eps_medio_isolato": 6, "Solaio_allegerito_eps_isolato": 7, "Solaio_allegerito_eps_altamente_isolato": 8, "Solaio_calcestruzzo_igloo_non_isolato": 9, "Solaio_calcestruzzo_igloo_scarso_isolato": 10, "Solaio_calcestruzzo_igloo_isolato": 11, "Copertura_calcestruzzo": 12, "Copertura_acciaio": 13, "Copertura_legno": 14, "Copertura_Verde_estensivo": 15}, selected="Solaio_legno_non_isolato")
floor = ValueList({"Solaio_legno_non_isolato": 0, "Solaio_legno_scarso_isolato": 1, "Solaio_legno_altamente_isolato": 2, "Solaio_laterocemento_non_isolato": 3, "Solaio_laterocemento_scarso_isolato": 4, "Solaio_laterocemento_altamente_isolato": 5, "Solaio_allegerito_eps_medio_isolato": 6, "Solaio_allegerito_eps_isolato": 7, "Solaio_allegerito_eps_altamente_isolato": 8, "Solaio_calcestruzzo_igloo_non_isolato": 9, "Solaio_calcestruzzo_igloo_scarso_isolato": 10, "Solaio_calcestruzzo_igloo_isolato": 11, "Copertura_calcestruzzo": 12, "Copertura_acciaio": 13, "Copertura_legno": 14, "Copertura_Verde_estensivo": 15}, selected="Solaio_legno_non_isolato")

# ---- group: ENVELOPE FEATURES
glazing_u = Slider(0.3, range=0.1..0.9)
wwr = Slider(0.2, range=0.1..1.1)

# ----
# 3 ANALYSIS BUILDINGS MODELING
# Buildings editor (copy this group for each building that has different settings)
building_program = ValueList({"Residential": 0, "Non Residential": 1, "School": 2}, selected="Residential")
hvac_efficiency = ValueList({"High": 0, "Medium": 1, "Low": 2}, selected="Low")
floortofloor_height_m = Slider(3, range=0..10)
building_typology_name = Panel("Office")
update = Button()
layer_name = Panel("Office")
dispatch = Dispatch(List=building_typology_name, DispatchPattern=update)  # -> ListA, ListB
building_creator = BuildingCreator(
    layer_name=layer_name,
    buildingtypology_name=dispatch.ListB,
    D=floortofloor_height_m,
    hb_climatezone=climatezones,
    hb_building_vintages=bldgvintages,
    hb_constructiontype=constructiontypes,
    envelope_selector=wall,
    roof_selector=roof,
    groundfloor_selector=floor,
    glazing_u_factor=glazing_u,
    program=building_program,
    wwr=wwr,
    hvac_efficiency=hvac_efficiency)  # -> envelope_name, envelope_u_fac, roof_name, roof_u_fac, groundfloor_name, groundfloorf_u_fac, buildings_2

# ---- group: from chat gpt e buonsenso
# Weights in Percentage
construction = Panel("25")
hvac = Panel("30")
panel_2 = Panel("15")
wwr_2 = Panel("20")
program = Panel("10")

# ----
panel_3 = Panel(building_creator.envelope_name)

# ----
# Simulation Parameters
toggle = BooleanToggle(True)
list = ItemSelector({"Monthly", "Daily", "Hourly"}, selected="Monthly")
panel_4 = Panel("Monthly")
shadowcalc = HBShadowCalculation(solar_dist="FullExterior")  # -> shadow_calc; plug-in component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
simoutput = HBSimulationOutput(zone_energy_use=toggle, hvac_energy_use=toggle, report_frequency=list)  # -> report, sim_output; plug-in component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
simpar = HBSimulationParameter(output=simoutput.sim_output, timestep=6, shadow_calc=shadowcalc)  # -> sim_par; plug-in component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

number_slider = Slider(733488, range=80000..1000000)
wall_2 = ValueList({"Muratura_laterizio_non_isolato": 0, "Muratura_laterizio_isolato": 1, "Muratura_lateerizio_altamente_isolato": 2, "Muratura_blocco_termico_isolato": 3, "Muratura_blocco_termico_altamente_isolato": 4, "Muratura_calcestruzzo_non_isolato": 5, "Muratura_calcestruzzo_medio_isolato_esterno": 6, "Muratura_calcestruzzo_medio_isolato_interno": 7, "Muratura_calcestruzzo_altamente_isolato": 8, "Muratura_pietra_non_isolato": 9, "Muratura_pietra_medio_isolato": 10, "Muratura_pietra_altamente_isolato": 11, "Muratura_mattoni_non_isolato": 12, "Muratura_mattoni_medio_isolato": 13, "Muratura_mattoni_altamente_isolato": 14, "PACCHETTO CALCESTRUZZO": 15, "PACCHETTO CALCESTRUZZO PARETE VENTILATA": 16, "PACCHETTO LEGNO A UMIDO": 17, "PACCHETTO ACCIAIO": 18, "PACCHETTO LEGNO A SECCO": 19}, selected="PACCHETTO CALCESTRUZZO")
wall_3 = ValueList({"Muratura_laterizio_non_isolato": 0, "Muratura_laterizio_isolato": 1, "Muratura_lateerizio_altamente_isolato": 2, "Muratura_blocco_termico_isolato": 3, "Muratura_blocco_termico_altamente_isolato": 4, "Muratura_calcestruzzo_non_isolato": 5, "Muratura_calcestruzzo_medio_isolato_esterno": 6, "Muratura_calcestruzzo_medio_isolato_interno": 7, "Muratura_calcestruzzo_altamente_isolato": 8, "Muratura_pietra_non_isolato": 9, "Muratura_pietra_medio_isolato": 10, "Muratura_pietra_altamente_isolato": 11, "Muratura_mattoni_non_isolato": 12, "Muratura_mattoni_medio_isolato": 13, "Muratura_mattoni_altamente_isolato": 14, "PACCHETTO CALCESTRUZZO": 15, "PACCHETTO CALCESTRUZZO PARETE VENTILATA": 16, "PACCHETTO LEGNO A UMIDO": 17, "PACCHETTO ACCIAIO": 18, "PACCHETTO LEGNO A SECCO": 19}, selected="PACCHETTO CALCESTRUZZO")
floor_2 = ValueList({"Solaio_legno_non_isolato": 0, "Solaio_legno_scarso_isolato": 1, "Solaio_legno_altamente_isolato": 2, "Solaio_laterocemento_non_isolato": 3, "Solaio_laterocemento_scarso_isolato": 4, "Solaio_laterocemento_altamente_isolato": 5, "Solaio_allegerito_eps_medio_isolato": 6, "Solaio_allegerito_eps_isolato": 7, "Solaio_allegerito_eps_altamente_isolato": 8, "Solaio_calcestruzzo_igloo_non_isolato": 9, "Solaio_calcestruzzo_igloo_scarso_isolato": 10, "Solaio_calcestruzzo_igloo_isolato": 11, "Copertura_calcestruzzo": 12, "Copertura_acciaio": 13, "Copertura_legno": 14, "Copertura_Verde_estensivo": 15}, selected="Copertura_calcestruzzo")
roof_2 = ValueList({"Solaio_legno_non_isolato": 0, "Solaio_legno_scarso_isolato": 1, "Solaio_legno_altamente_isolato": 2, "Solaio_laterocemento_non_isolato": 3, "Solaio_laterocemento_scarso_isolato": 4, "Solaio_laterocemento_altamente_isolato": 5, "Solaio_allegerito_eps_medio_isolato": 6, "Solaio_allegerito_eps_isolato": 7, "Solaio_allegerito_eps_altamente_isolato": 8, "Solaio_calcestruzzo_igloo_non_isolato": 9, "Solaio_calcestruzzo_igloo_scarso_isolato": 10, "Solaio_calcestruzzo_igloo_isolato": 11, "Copertura_calcestruzzo": 12, "Copertura_acciaio": 13, "Copertura_legno": 14, "Copertura_Verde_estensivo": 15}, selected="Copertura_Verde_estensivo")
wall_4 = ValueList({"Muratura_laterizio_non_isolato": 0, "Muratura_laterizio_isolato": 1, "Muratura_lateerizio_altamente_isolato": 2, "Muratura_blocco_termico_isolato": 3, "Muratura_blocco_termico_altamente_isolato": 4, "Muratura_calcestruzzo_non_isolato": 5, "Muratura_calcestruzzo_medio_isolato_esterno": 6, "Muratura_calcestruzzo_medio_isolato_interno": 7, "Muratura_calcestruzzo_altamente_isolato": 8, "Muratura_pietra_non_isolato": 9, "Muratura_pietra_medio_isolato": 10, "Muratura_pietra_altamente_isolato": 11, "Muratura_mattoni_non_isolato": 12, "Muratura_mattoni_medio_isolato": 13, "Muratura_mattoni_altamente_isolato": 14, "PACCHETTO CALCESTRUZZO": 15, "PACCHETTO CALCESTRUZZO PARETE VENTILATA": 16, "PACCHETTO LEGNO A UMIDO": 17, "PACCHETTO ACCIAIO": 18, "PACCHETTO LEGNO A SECCO": 19}, selected="PACCHETTO CALCESTRUZZO")
floor_3 = ValueList({"Solaio_legno_non_isolato": 0, "Solaio_legno_scarso_isolato": 1, "Solaio_legno_altamente_isolato": 2, "Solaio_laterocemento_non_isolato": 3, "Solaio_laterocemento_scarso_isolato": 4, "Solaio_laterocemento_altamente_isolato": 5, "Solaio_allegerito_eps_medio_isolato": 6, "Solaio_allegerito_eps_isolato": 7, "Solaio_allegerito_eps_altamente_isolato": 8, "Solaio_calcestruzzo_igloo_non_isolato": 9, "Solaio_calcestruzzo_igloo_scarso_isolato": 10, "Solaio_calcestruzzo_igloo_isolato": 11, "Copertura_calcestruzzo": 12, "Copertura_acciaio": 13, "Copertura_legno": 14, "Copertura_Verde_estensivo": 15}, selected="Copertura_calcestruzzo")
roof_3 = ValueList({"Solaio_legno_non_isolato": 0, "Solaio_legno_scarso_isolato": 1, "Solaio_legno_altamente_isolato": 2, "Solaio_laterocemento_non_isolato": 3, "Solaio_laterocemento_scarso_isolato": 4, "Solaio_laterocemento_altamente_isolato": 5, "Solaio_allegerito_eps_medio_isolato": 6, "Solaio_allegerito_eps_isolato": 7, "Solaio_allegerito_eps_altamente_isolato": 8, "Solaio_calcestruzzo_igloo_non_isolato": 9, "Solaio_calcestruzzo_igloo_scarso_isolato": 10, "Solaio_calcestruzzo_igloo_isolato": 11, "Copertura_calcestruzzo": 12, "Copertura_acciaio": 13, "Copertura_legno": 14, "Copertura_Verde_estensivo": 15}, selected="Copertura_Verde_estensivo")
wall_5 = ValueList({"Muratura_laterizio_non_isolato": 0, "Muratura_laterizio_isolato": 1, "Muratura_lateerizio_altamente_isolato": 2, "Muratura_blocco_termico_isolato": 3, "Muratura_blocco_termico_altamente_isolato": 4, "Muratura_calcestruzzo_non_isolato": 5, "Muratura_calcestruzzo_medio_isolato_esterno": 6, "Muratura_calcestruzzo_medio_isolato_interno": 7, "Muratura_calcestruzzo_altamente_isolato": 8, "Muratura_pietra_non_isolato": 9, "Muratura_pietra_medio_isolato": 10, "Muratura_pietra_altamente_isolato": 11, "Muratura_mattoni_non_isolato": 12, "Muratura_mattoni_medio_isolato": 13, "Muratura_mattoni_altamente_isolato": 14, "PACCHETTO CALCESTRUZZO": 15, "PACCHETTO CALCESTRUZZO PARETE VENTILATA": 16, "PACCHETTO LEGNO A UMIDO": 17, "PACCHETTO ACCIAIO": 18, "PACCHETTO LEGNO A SECCO": 19}, selected="PACCHETTO CALCESTRUZZO")
floor_4 = ValueList({"Solaio_legno_non_isolato": 0, "Solaio_legno_scarso_isolato": 1, "Solaio_legno_altamente_isolato": 2, "Solaio_laterocemento_non_isolato": 3, "Solaio_laterocemento_scarso_isolato": 4, "Solaio_laterocemento_altamente_isolato": 5, "Solaio_allegerito_eps_medio_isolato": 6, "Solaio_allegerito_eps_isolato": 7, "Solaio_allegerito_eps_altamente_isolato": 8, "Solaio_calcestruzzo_igloo_non_isolato": 9, "Solaio_calcestruzzo_igloo_scarso_isolato": 10, "Solaio_calcestruzzo_igloo_isolato": 11, "Copertura_calcestruzzo": 12, "Copertura_acciaio": 13, "Copertura_legno": 14, "Copertura_Verde_estensivo": 15}, selected="Copertura_calcestruzzo")
roof_4 = ValueList({"Solaio_legno_non_isolato": 0, "Solaio_legno_scarso_isolato": 1, "Solaio_legno_altamente_isolato": 2, "Solaio_laterocemento_non_isolato": 3, "Solaio_laterocemento_scarso_isolato": 4, "Solaio_laterocemento_altamente_isolato": 5, "Solaio_allegerito_eps_medio_isolato": 6, "Solaio_allegerito_eps_isolato": 7, "Solaio_allegerito_eps_altamente_isolato": 8, "Solaio_calcestruzzo_igloo_non_isolato": 9, "Solaio_calcestruzzo_igloo_scarso_isolato": 10, "Solaio_calcestruzzo_igloo_isolato": 11, "Copertura_calcestruzzo": 12, "Copertura_acciaio": 13, "Copertura_legno": 14, "Copertura_Verde_estensivo": 15}, selected="Copertura_Verde_estensivo")

# ----
# 2 CONTEXT
panel_5 = Panel("context::")
concat_2 = Concatenate(FragmentA=panel_5, FragmentB="trees")
concat_3 = Concatenate(FragmentA=panel_5, FragmentB="Buildings")

# ---- group: Buildings and canopies
reflay = ReferenceByLayer(LayerName=concat_3)

# ---- group: trees
reflay_2 = ReferenceByLayer(LayerName=concat_2)

# ----
merge = Merge(Data1=reflay, Data2=reflay_2)  # -> flatten(Result)

# ---- group: CONTESTO
geo = Geometry(merge)

# ----
# Model Assembly
geo_2 = Geometry(geo)
# connect if there are context geometries
context = DFContextShade(geo=geo_2)  # -> report, context; plug-in component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
model = DFModel(buildings=flatten(building_creator.buildings_2), name=name)  # -> report, model; plug-in component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

# ----
# CHECK 1
vizall = DFVisualizeAll(df_objs=flatten(model.model))  # -> geo; plug-in component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

# ----
# HONEYBEE WORKFLOW
panel_6 = Panel("""District
Building
Story""")
list_2 = ItemSelector(panel_6, {"District", "Building", "Story"}, selected="Building")
bool = Boolean(lb_falsestarttoggle)
tohoneybee = DFModelToHoneybee(
    model=model.model,
    obj_per_model=list_2,
    use_multiplier=Toggle(True),
    add_plenum=Toggle(True),
    shade_dist="30",
    run=Toggle(True))  # -> report, hb_models; plug-in component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
txt_2 = Text(txt)
panel_7 = Panel(txt_2)
path_2 = FilePath(path)
modeltoosm = HBModelToOSM(model=tohoneybee.hb_models, epw_file=path_2, sim_par=simpar, folder=panel_7, write=bool, run=bool)  # -> report, jsons, osw, osm, idf, sql, zsz, rdd, html; plug-in component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

# ----
# Visualize Model Properties
room2dattr = DFRoom2DAttributes({"Display Name": "display_name", "Simulation Name (Identifier)": "identifier", "Floor-To-Ceiling Height": "floor_to_ceiling_height", "Floor Elevation": "floor_height", "Ceiling Elevation": "ceiling_height", "Is Ground Contact": "is_ground_contact"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}, selected="Program": "properties.energy.program_type.display_name")
data = Data(flatten(model.model))
colorroom2dattr = DFColorRoom2DAttributes(df_obj=flatten(data), attribute=room2dattr)  # -> mesh, legend, wire_frame, values, colors; plug-in component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

# ----
# CHECK 2
vizall_2 = HBVisualizeAll(hb_objs=flatten(tohoneybee.hb_models))  # -> geo; plug-in component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

# ----
# SQL PATH
panel_8 = Panel(": ")
split = TextSplit(Text=tohoneybee.hb_models, Separators=panel_8)
item = ListItem(List=split, Index=0, Wrap=True)  # -> Item1, Item
concat_4 = Concatenate(FragmentA=panel_7, FragmentB=item.Item1, FragmentC="openstudio\run\eplusout.sql", JoinSeparator="\")
txt_3 = Text(concat_4)
se_non_funziona_disabilitare_sola_lettur = Panel(txt_3)  # "SE NON FUNZIONA DISABILITARE \"SOLA LETTURA\" NELLA CARTELLA"

# ---- group: sql
file_path = FilePath(txt_3)

# ----
# Visualize Energy Use (check the end uses first then connect)
roomenergyresult = HBReadRoomEnergyResult(sql=file_path)  # -> cooling, heating, lighting, electric_equip, gas_equip, process, hot_water, fan_electric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; plug-in component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
massarithop = LBMassArithmeticOperation(data=flatten(roomenergyresult.cooling), type="Cooling")  # -> data; plug-in component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
massarithop_2 = LBMassArithmeticOperation(data=flatten(roomenergyresult.heating), type="Heating")  # -> data; plug-in component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
massarithop_3 = LBMassArithmeticOperation(data=flatten(roomenergyresult.lighting), type="Lighting")  # -> data; plug-in component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
massarithop_4 = LBMassArithmeticOperation(data=flatten(roomenergyresult.hot_water), type="Hot Water")  # -> data; plug-in component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
massarithop_5 = LBMassArithmeticOperation(data=flatten(roomenergyresult.electric_equip), type="Elecric equip")  # -> data; plug-in component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
merge_2 = Merge(Data1=massarithop, Data2=massarithop_2, Data3=massarithop_3, Data4=massarithop_5, Data5=massarithop_4)
merge_3 = Merge(
    Data1=ColourSwatch(SwatchColor=RGB(36, 55, 145)),
    Data2=ColourSwatch(SwatchColor=RGB(212, 32, 32)),
    Data3=ColourSwatch(SwatchColor=RGB(217, 212, 67)),
    Data4=ColourSwatch(SwatchColor=RGB(205, 232, 176)),
    Data5=ColourSwatch(SwatchColor=RGB(204, 117, 35)))
legendpar = LBLegendParameters(max=number_slider, seg_count="5", colors=merge_3, num_decimals="0")  # -> leg_par; plug-in component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
monthlychart = LBMonthlyChart(data=merge_2, stack=Toggle(True), legend_par=legendpar)  # -> report, data_mesh, data_lines, col_lines, legend, borders, labels, y_title, title, vis_set; plug-in component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

# ----
# Compute EUI
eui = HBEndUseIntensity(sql=file_path)  # -> eui, eui_end_use, end_uses, gross_floor; plug-in component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
eui_kwh_m2 = Panel(eui.eui)
panel_9 = Panel(eui.eui_end_use)
panel_10 = Panel(eui.end_uses)

lb_falsestarttoggle_2 = LBFalseStartToggle(False)
module_type = ValueList({"Mono-Si": 0, "Poly-Si": 1, "SR-Si": 2, "EFG-Si": 3, "HIT": 4, "qc-Si / a-Si": 5, "a-Si": 6, "CdS / CdTe": 7, "CIS / CIGS": 8}, selected="Mono-Si")
parapet_wall = Slider(0.8, range=0.8..1.2)
context_2 = Geometry(geo_2)
epw = FilePath(path)
cluster = Cluster_7(geometry=context_2, number=parapet_wall, epw=epw, boolean=lb_falsestarttoggle_2, number_2=module_type)  # -> info_2, production, sun_radiation_visualization_2, number_6
mesh = Mesh(cluster.sun_radiation_visualization_2)
area_of_roof_s_in_m2 = Panel(cluster.info_2)

gross_floor_area = Number(eui.gross_floor)

# ----
# risparmio percentuale
massarithop_6 = LBMassArithmeticOperation(data=flatten(merge_2))  # -> data; plug-in component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
produzione_pv_kwh = Panel(cluster.production)
xdata = LBDeconstructData(data=massarithop_6)  # -> header, values; plug-in component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
mass_addition = MassAddition(Input=xdata.values)  # -> Result, PartialResults
multiplication = Multiplication(A=produzione_pv_kwh, B=Slider(100, range=0..100))
division = Division(A=multiplication, B=mass_addition.Result)
risparmio_percentuale_consumi_totali_kwh = Panel(division)

division_2 = Division(A=cluster.production, B=gross_floor_area)
risparmio_pv_kwh_m2 = Panel(division_2)
eui_totale = Number(eui_kwh_m2)
subtraction = Subtraction(A=eui_totale, B=risparmio_pv_kwh_m2)
eui_pv = Panel(subtraction)
lng = ListLength(List=panel_10)
division_3 = Division(A=risparmio_percentuale_consumi_totali_kwh, B=lng)

# ----
# Visualize Energy Use + pv
roomenergyresult_2 = HBReadRoomEnergyResult(sql=file_path)  # -> cooling, heating, lighting, electric_equip, gas_equip, process, hot_water, fan_electric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; plug-in component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
massarithop_7 = LBMassArithmeticOperation(data=flatten(roomenergyresult_2.cooling), type="Cooling")  # -> data; plug-in component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
massarithop_8 = LBMassArithmeticOperation(data=flatten(roomenergyresult_2.heating), type="Heating")  # -> data; plug-in component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
massarithop_9 = LBMassArithmeticOperation(data=flatten(roomenergyresult_2.electric_equip), type="Elecric equip")  # -> data; plug-in component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
massarithop_10 = LBMassArithmeticOperation(data=flatten(roomenergyresult_2.lighting), type="Lighting")  # -> data; plug-in component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
massarithop_11 = LBMassArithmeticOperation(data=flatten(roomenergyresult_2.hot_water), type="Hot Water")  # -> data; plug-in component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
cluster_2 = Cluster(data=massarithop_9, risparmio_percentuale=division_3)
cluster_3 = Cluster(data=massarithop_10, risparmio_percentuale=division_3)
cluster_4 = Cluster(data=massarithop_11, risparmio_percentuale=division_3)
cluster_5 = Cluster(data=massarithop_8, risparmio_percentuale=division_3)
cluster_6 = Cluster(data=massarithop_7, risparmio_percentuale=division_3)
merge_4 = Merge(Data1=cluster_6, Data2=cluster_5, Data3=cluster_3, Data4=cluster_2, Data5=cluster_4)
merge_5 = Merge(
    Data1=ColourSwatch(SwatchColor=RGB(36, 55, 145)),
    Data2=ColourSwatch(SwatchColor=RGB(212, 32, 32)),
    Data3=ColourSwatch(SwatchColor=RGB(217, 212, 67)),
    Data4=ColourSwatch(SwatchColor=RGB(205, 232, 176)),
    Data5=ColourSwatch(SwatchColor=RGB(204, 117, 35)))
legendpar_2 = LBLegendParameters(max=number_slider, seg_count="5", colors=merge_5, num_decimals="0")  # -> leg_par; plug-in component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

risparmio_per_end_use = Panel(division_3)
monthlychart_2 = LBMonthlyChart(data=merge_4, stack=Toggle(True), legend_par=legendpar_2)  # -> report, data_mesh, data_lines, col_lines, legend, borders, labels, y_title, title, vis_set; plug-in component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

# ==== cluster Cluster
risparmio_percentuale = ClusterInput()
data = ClusterInput()
risparmio_percentuale_2 = Number(risparmio_percentuale)
xdata = LBDeconstructData(data=data)  # -> header, values; plug-in component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
percentage = Percentage(Number=xdata.values, Percent=risparmio_percentuale_2)
subtraction = Subtraction(A=xdata.values, B=percentage)
data_2 = LBConstructData(header=xdata.header, values=subtraction, interval="monthly")  # -> simplify(data); plug-in component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
data_3 = ClusterOutput(data_2)

# ==== cluster Cluster_7
geometry = ClusterInput()
number = ClusterInput()
epw = ClusterInput()
boolean = ClusterInput()
number_2 = ClusterInput()
geometry_2 = Geometry(geometry)
number_3 = Number(number)
epw_2 = FilePath(epw)
boolean_2 = Boolean(boolean)
number_4 = Number(number_2)
cluster = Cluster_2(epw=epw_2, height_of_parapet_wall=number_3)
cluster_2 = Cluster_4(distance=cluster, geometry=geometry_2)
cluster_3 = Cluster_5(roof=cluster_2, context=geometry_2, epw=epw_2, run=boolean_2)  # -> direct_sun_radiation_2, total_sun_radiation_2, mesh_2
area = Area(Geometry=cluster_2)  # -> flatten(Area), Centroid
panel = Panel(area.Area)
cluster_4 = Cluster_6(panels=cluster_2, direct_sun=cluster_3.direct_sun_radiation_2, epw=epw_2, module_type=number_4)  # -> production_2, data_3
mass_addition = MassAddition(Input=panel)  # -> Result, PartialResults
info = Data(cluster_4.data_3)
sun_radiation_visualization = Mesh(cluster_3.mesh_2)
number_5 = Number(mass_addition.Result)
production = ClusterOutput(cluster_4.production_2)
info_2 = ClusterOutput(info)
sun_radiation_visualization_2 = ClusterOutput(sun_radiation_visualization)
number_6 = ClusterOutput(number_5)

# ==== cluster BuildingCreator
layer_name = ClusterInput()
buildingtypology_name = ClusterInput()
D = ClusterInput()
hb_climatezone = ClusterInput()
hb_building_vintages = ClusterInput()
hb_constructiontype = ClusterInput()
envelope_selector = ClusterInput()
roof_selector = ClusterInput()
groundfloor_selector = ClusterInput()
glazing_u_factor = ClusterInput()
program = ClusterInput()

building_definition = BuildingDefinition(
    layer_name=layer_name,
    buildingtypology_name=buildingtypology_name,
    floortofloor_height=D,
    hb_climatezone=hb_climatezone,
    hb_building_vintages=hb_building_vintages,
    hb_constructiontype=hb_constructiontype,
    envelope_selector=envelope_selector,
    roof_selector=roof_selector,
    groundfloor_selector=groundfloor_selector,
    glazing_u_factor=glazing_u_factor,
    program_boolean=program)  # -> number_of_stories_2, building_footprint_2, envelope_name_2, envelope_u_fac_2, constr_set_2, roof_name_2, roof_u_fac_2, groundfloor_name_2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
program_2 = Data(building_definition.program_2)
stories_num = Number(building_definition.number_of_stories_2)
footprint = Surface(building_definition.building_footprint_2)
constr_set = Data(building_definition.constr_set_2)

groundfloorf_u_fac = ClusterOutput(building_definition.groundfloorf_u_fac_2)
wwr = ClusterInput()
envelope_u_fac = ClusterOutput(building_definition.envelope_u_fac_2)
envelope_name = ClusterOutput(building_definition.envelope_name_2)
roof_name = ClusterOutput(building_definition.roof_name_2)
groundfloor_name = ClusterOutput(building_definition.groundfloor_name_2)
flatten = FlattenTree(Tree=program_2, Path="{0}")
roof_u_fac = ClusterOutput(building_definition.roof_u_fac_2)
item = ListItem(List=flatten, Index=0, Wrap=True)
data = Data(constr_set)
srf = Surface(footprint)
repeat = RepeatData(Data=D, Length=stories_num)
wwr_2 = Number(wwr)
_0_residential_1_non_residential_generic = Panel(building_definition.program_boolean_3)  # "0: Residential 1: Non Residential(generic) 2:school"

# ----
# Create Buildings
buildingfootprint = DFBuildingFromFootprint(
    footprint_geo=srf,
    floor_to_floor=repeat,
    program=item,
    constr_set=constr_set,
    conditioned=Toggle(True),
    run=Toggle(True))  # -> report, buildings; plug-in component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

# ----
# Assign Windows
window_ratio = Panel(wwr_2)
simpleratiopar = DFSimpleWindowRatioParameters(ratio=window_ratio)  # -> win_par; plug-in component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

topbottom = DFSeparateTopBottom(buildings=flatten(buildingfootprint.buildings))  # -> buildings; plug-in component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
hvac_efficiency = ClusterInput()
all_air = HBAllAirHVACTemplates({"VAV chiller with gas boiler reheat": "VAV_Chiller_Boiler", "VAV chiller with central air source heat pump reheat": "VAV_Chiller_ASHP", "VAV chiller with district hot water reheat": "VAV_Chiller_DHW", "VAV chiller with PFP boxes": "VAV_Chiller_PFP", "VAV chiller with gas coil reheat": "VAV_Chiller_GasCoil", "VAV air-cooled chiller with gas boiler reheat": "VAV_ACChiller_Boiler", "VAV air-cooled chiller with central air source heat pump reheat": "VAV_ACChiller_ASHP", "VAV air-cooled chiller with district hot water reheat": "VAV_ACChiller_DHW", "VAV air-cooled chiller with PFP boxes": "VAV_ACChiller_PFP", "VAV air-cooled chiller with gas coil reheat": "VAV_ACChiller_GasCoil"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}, selected="VAV chiller with gas boiler reheat")
all_air_2 = HBAllAirHVACTemplates({"VAV chiller with gas boiler reheat": "VAV_Chiller_Boiler", "VAV chiller with central air source heat pump reheat": "VAV_Chiller_ASHP", "VAV chiller with district hot water reheat": "VAV_Chiller_DHW", "VAV chiller with PFP boxes": "VAV_Chiller_PFP", "VAV chiller with gas coil reheat": "VAV_Chiller_GasCoil", "VAV air-cooled chiller with gas boiler reheat": "VAV_ACChiller_Boiler", "VAV air-cooled chiller with central air source heat pump reheat": "VAV_ACChiller_ASHP", "VAV air-cooled chiller with district hot water reheat": "VAV_ACChiller_DHW", "VAV air-cooled chiller with PFP boxes": "VAV_ACChiller_PFP", "VAV air-cooled chiller with gas coil reheat": "VAV_ACChiller_GasCoil"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}, selected="PTAC with gas boiler": "PTAC_Boiler")
all_air_3 = HBAllAirHVACTemplates({"VAV chiller with gas boiler reheat": "VAV_Chiller_Boiler", "VAV chiller with central air source heat pump reheat": "VAV_Chiller_ASHP", "VAV chiller with district hot water reheat": "VAV_Chiller_DHW", "VAV chiller with PFP boxes": "VAV_Chiller_PFP", "VAV chiller with gas coil reheat": "VAV_Chiller_GasCoil", "VAV air-cooled chiller with gas boiler reheat": "VAV_ACChiller_Boiler", "VAV air-cooled chiller with central air source heat pump reheat": "VAV_ACChiller_ASHP", "VAV air-cooled chiller with district hot water reheat": "VAV_ACChiller_DHW", "VAV air-cooled chiller with PFP boxes": "VAV_ACChiller_PFP", "VAV air-cooled chiller with gas coil reheat": "VAV_ACChiller_GasCoil"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}, selected="PSZ-AC with baseboard gas boiler": "PSZAC_BoilerBaseboard")
applyfacadepar = DFApplyFacadeParameters(df_obj=topbottom, win_par=simpleratiopar)  # -> report, df_obj; plug-in component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

# ---- group: medium
bldgvintages = HBBuildingVintages({"ASHRAE 90.1 2019  |  IECC 2021": "2019", "ASHRAE 90.1 2016  |  IECC 2018": "2016", "ASHRAE 90.1 2013  |  IECC 2015": "2013", "ASHRAE 90.1 2010  |  IECC 2012": "2010", "ASHRAE 90.1 2007  |  IECC 2009": "2007", "ASHRAE 90.1 2004  |  IECC 2006": "2004", "1980-2004 (CBECS)": "1980_2004", "Pre-1980 (CBECS)": "pre_1980"}, selected="ASHRAE 90.1 2019  |  IECC 2021")

# ---- group: good
bldgvintages_2 = HBBuildingVintages({"ASHRAE 90.1 2019  |  IECC 2021": "2019", "ASHRAE 90.1 2016  |  IECC 2018": "2016", "ASHRAE 90.1 2013  |  IECC 2015": "2013", "ASHRAE 90.1 2010  |  IECC 2012": "2010", "ASHRAE 90.1 2007  |  IECC 2009": "2007", "ASHRAE 90.1 2004  |  IECC 2006": "2004", "1980-2004 (CBECS)": "1980_2004", "Pre-1980 (CBECS)": "pre_1980"}, selected="ASHRAE 90.1 2019  |  IECC 2021")

# ---- group: low
bldgvintages_3 = HBBuildingVintages({"ASHRAE 90.1 2019  |  IECC 2021": "2019", "ASHRAE 90.1 2016  |  IECC 2018": "2016", "ASHRAE 90.1 2013  |  IECC 2015": "2013", "ASHRAE 90.1 2010  |  IECC 2012": "2010", "ASHRAE 90.1 2007  |  IECC 2009": "2007", "ASHRAE 90.1 2004  |  IECC 2006": "2004", "1980-2004 (CBECS)": "1980_2004", "Pre-1980 (CBECS)": "pre_1980"}, selected="1980-2004 (CBECS)")

# ----
hvac_efficiency_2 = Number(hvac_efficiency)
filter = StreamFilter(Gate=_0_residential_1_non_residential_generic, Stream0=all_air_2, Stream1=all_air_3, Stream2=all_air)
filter_2 = StreamFilter(Gate=hvac_efficiency_2, Stream0=bldgvintages_2, Stream1=bldgvintages, Stream2=bldgvintages_3)
dfallairhvac = DFAllAirHVAC(df_objs=flatten(applyfacadepar.df_obj), system_type=filter, vintage=filter_2)  # -> report, df_objs; plug-in component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
buildings = Data(dfallairhvac.df_objs)
buildings_2 = ClusterOutput(buildings)

# ==== cluster Cluster_2
height_of_parapet_wall = ClusterInput()
epw = ClusterInput()
epw_2 = Data(epw)
height_of_parapet_wall_2 = Number(height_of_parapet_wall)
importepw = LBImportEPW(epw_file=epw_2)  # -> location, dry_bulb_temperature, dew_point_temperature, relative_humidity, wind_speed, wind_direction, direct_normal_rad, diffuse_horizontal_rad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; plug-in component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
analysisperiod = LBAnalysisPeriod(
    start_month=Slider(1, range=1..12),
    start_day=1,
    start_hour=Slider(9, range=1..12),
    end_month=Slider(12, range=1..12),
    end_hour=Slider(15, range=0..24))  # -> period, hoys, dates; plug-in component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
sunpath = LBSunPath(location=importepw.location, hoys=analysisperiod.hoys, scale=1)  # -> report, vectors, altitudes, azimuths, hoys, sun_pts, analemma, daily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; plug-in component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
panel = Panel(sunpath.altitudes)
sort_list = SortList(Keys=panel)  # -> Keys, ValuesValuesA
list_item = ListItem(List=sort_list.Keys, Index=0, Wrap=True)
min_altitude = Panel(list_item)
member_index = MemberIndex(Set=panel, Member=min_altitude)  # -> Index, Count
list_item_2 = ListItem(List=sunpath.azimuths, Index=member_index.Index, Wrap=True)
min_azimuths = Panel(list_item_2)
subtraction = Subtraction(A="180", B=min_azimuths)
panel_2 = Panel(subtraction)
absolute = Absolute(Value=subtraction)

# ----
# Calculation of the offset from wall to avoid shadow on panles
expression = Expression(x=absolute, Expression="cos(x°)")
expression_2 = Expression(x=min_altitude, Expression="tan(x°)")
absolute_2 = Absolute(Value=expression)
division = Division(A=height_of_parapet_wall_2, B=expression_2)
multiplication = Multiplication(A=division, B=absolute_2)
distance_from_wall = Data(multiplication)

offset_from_wall = Data(distance_from_wall)
offset_from_wall_2 = ClusterOutput(offset_from_wall)

# ==== cluster Cluster_4
distance = ClusterInput()
geometry = ClusterInput()
distance_2 = Number(distance)
geometry_2 = Geometry(geometry)
edges_from_directions = EdgesFromDirections(Brep=geometry_2, Directions=Vector(0, 0, 1), Reflex=False, Angle=0)  # -> Edges, Indices, Map
deconstruct_brep = DeconstructBrep(Brep=geometry_2)  # -> Faces, Edges, Vertices
area = Area(Geometry=geometry_2)  # -> Area, Centroid
length = Length(Curve=edges_from_directions.Edges)  # -> simplify(Length)
unit_z = UnitZ(Factor=1)
cluster = Cluster_3(data=length)
line_sdl = LineSDL(Start=area.Centroid, Direction=unit_z, Length=expr("x+5", cluster))
collision_one_many = CollisionOneMany(Collider=deconstruct_brep.Faces, Obstacles=line_sdl)  # -> Collision, Index
cull_pattern = CullPattern(List=deconstruct_brep.Faces, CullPattern=collision_one_many.Collision)
surface = Surface(cull_pattern)
surface_2 = ClusterOutput(surface)

# ==== cluster Cluster_5
roof = ClusterInput()
context = ClusterInput()
epw = ClusterInput()
run = ClusterInput()
roof_2 = Geometry(roof)
context_2 = Geometry(context)
epw_2 = Data(epw)
run_2 = Boolean(run)
importepw = LBImportEPW(epw_file=epw_2)  # -> location, dry_bulb_temperature, dew_point_temperature, relative_humidity, wind_speed, wind_direction, direct_normal_rad, diffuse_horizontal_rad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; plug-in component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
skymatrix = LBCumulativeSkyMatrix(location=importepw.location, direct_rad=importepw.direct_normal_rad, diffuse_rad=importepw.diffuse_horizontal_rad)  # -> report, sky_mtx; plug-in component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
colrange = LBColorRange(index=0)  # -> colors; plug-in component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
legendpar = LBLegendParameters(colors=colrange)  # -> leg_par; plug-in component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
incidentradiation = LBIncidentRadiation(
    sky_mtx=skymatrix.sky_mtx,
    geometry=flatten(roof_2),
    context=flatten(context_2),
    grid_size="5",
    offset_dist="0.5",
    legend_par=legendpar,
    cpu_count=run_2,
    run=run_2)  # -> report, points, results, total, mesh, legend, title, int_mtx; plug-in component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
total_sun_radiation = Data(incidentradiation.total)
average = Average(Input=incidentradiation.results)
mesh = Mesh(incidentradiation.mesh)
mesh_2 = ClusterOutput(mesh)
total_sun_radiation_2 = ClusterOutput(total_sun_radiation)
direct_sun_radiation = Data(average)
direct_sun_radiation_2 = ClusterOutput(direct_sun_radiation)

# ==== cluster Cluster_6
panels = ClusterInput()
epw = ClusterInput()
module_type = ClusterInput()
direct_sun = ClusterInput()
panels_2 = Geometry(panels)
epw_2 = Data(epw)
module_type_2 = Data(module_type)
direct_sun_2 = Data(direct_sun)
panel = Panel("""Mono-Si
Poly-Si
SR-Si 
EFG-Si
HIT 
qc-Si / a-Si
a-Si
CdS / CdTe
CIS / CIGS""")
importloc = LBImportLocation(epw_file=epw_2)  # -> location; plug-in component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
area = Area(Geometry=panels_2)  # -> Area, Centroid
moudle_efficency = Panel("""0.22
0.16
0.14
0.128
0.19
0.10
0.07
0.11
0.14""")
pr_or_coefficency = Panel("0.75")
decnstrloc = LBDeconstructLocation(location=importloc)  # -> name, latitude, longitude, time_zone, elevation; plug-in component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
mass_addition = MassAddition(Input=flatten(area.Area))  # -> Result, PartialResults
list_item = ListItem(List=moudle_efficency, Index=module_type_2, Wrap=True)
list_item_2 = ListItem(List=panel, Index=module_type_2, Wrap=True)
integer = Integer(mass_addition.Result)
data = Data(pr_or_coefficency)
multiplication = Multiplication(Area=integer, AvergaeOfSunRadiationPerM2=direct_sun_2, ModuleEfficency=list_item, PerformanceRatio=data)
production = Integer(multiplication)
panel_2 = Panel(production)
concatenate = Concatenate(
    FragmentE="location information",
    FragmentA=decnstrloc.name,
    LangitudeIn="longitude:",
    FragmentB=decnstrloc.longitude,
    LatitudeIn="latitude :",
    FragmentA_2=decnstrloc.latitude,
    SoalrPanelIn="solar panel",
    ToatalAreaIn="Total area of panels is ",
    FragmentD=mass_addition.Result,
    FragmentA_4=" m2",
    FragmentA_5="Module type is ",
    FragmentB_2=list_item_2,
    FragmentC=" by ",
    FragmentA_6=list_item,
    EfficiencyIn=" efficiency",
    DirectSunRadiationIn="Direct sun radiation ",
    FragmentB_3=direct_sun_2,
    KwhM2In=" kwh/m2",
    CoefficencyIn="coefficency is defined as ",
    Coefficency=pr_or_coefficency,
    EstimateIn="**Estimated energy production is ",
    FragmentA_8=panel_2,
    KWhYearIn=" kWh/Year")
panel_3 = Panel("production")
null_item = NullItem(Item=direct_sun_2)  # -> NullFlags, InvalidFlags, Description
panel_4 = Panel(concatenate)
cull_pattern = CullPattern(List=panel_4, CullPattern=invert(null_item.NullFlags))
cull_pattern_2 = CullPattern(List="RUN SIMULATOR TO ESTIMATE !!!!!!", CullPattern=null_item.NullFlags)
merge = Merge(Data1=cull_pattern, Data2=cull_pattern_2)
data_2 = Data(merge)
production_2 = ClusterOutput(production)
data_3 = ClusterOutput(data_2)

# ==== cluster BuildingDefinition
layer_name = ClusterInput()
buildingtypology_name = ClusterInput()
floortofloor_height = ClusterInput()
layer_name_2 = Text(layer_name)

# ---- group: MIXED USE
hb_building_programs = HBBuildingPrograms({"LargeOffice", "MediumOffice", "SmallOffice", "MidriseApartment", "HighriseApartment", "Retail", "StripMall", "PrimarySchool", "SecondarySchool", "SmallHotel", "LargeHotel", "Hospital", "Outpatient", "Laboratory", "Warehouse", "SuperMarket", "FullServiceRestaurant", "QuickServiceRestaurant", "Courthouse", "LargeDataCenterHighITE", "LargeDataCenterLowITE", "SmallDataCenterHighITE", "SmallDataCenterLowITE"}, selected="SmallOffice")
hb_building_programs_2 = HBBuildingPrograms({"LargeOffice", "MediumOffice", "SmallOffice", "MidriseApartment", "HighriseApartment", "Retail", "StripMall", "PrimarySchool", "SecondarySchool", "SmallHotel", "LargeHotel", "Hospital", "Outpatient", "Laboratory", "Warehouse", "SuperMarket", "FullServiceRestaurant", "QuickServiceRestaurant", "Courthouse", "LargeDataCenterHighITE", "LargeDataCenterLowITE", "SmallDataCenterHighITE", "SmallDataCenterLowITE"}, selected="Retail")
hb_building_programs_3 = HBBuildingPrograms({"LargeOffice", "MediumOffice", "SmallOffice", "MidriseApartment", "HighriseApartment", "Retail", "StripMall", "PrimarySchool", "SecondarySchool", "SmallHotel", "LargeHotel", "Hospital", "Outpatient", "Laboratory", "Warehouse", "SuperMarket", "FullServiceRestaurant", "QuickServiceRestaurant", "Courthouse", "LargeDataCenterHighITE", "LargeDataCenterLowITE", "SmallDataCenterHighITE", "SmallDataCenterLowITE"}, selected="HighriseApartment")
panel = Panel("""0.70
0.15
0.15""")
blendprograms = HBBlendProgramTypes(name="Mixed use", programs=[hb_building_programs_3, hb_building_programs, hb_building_programs_2], ratios=panel)  # -> program; plug-in component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
merge = Merge(Data1=blendprograms)

# ----
buildingtypology_name_2 = Text(buildingtypology_name)
concat = Concatenate(FragmentA="Analysis Buildings", FragmentB=layer_name_2, JoinSeparator="::")
reflay = ReferenceByLayer(LayerName=concat, lightweight=False)
reference_by_layer_r6 = ReferenceByLayerR6(LayerName=concat)
hb_climatezone = ClusterInput()
hb_building_vintages = ClusterInput()
hb_constructiontype = ClusterInput()
glazing_u_factor = ClusterInput()
program_boolean = ClusterInput()
filter_by_name_r6 = FilterByNameR6(Geometry=reference_by_layer_r6, Name=buildingtypology_name_2)
filtername = FilterByName(Name=buildingtypology_name_2, Geometry=reflay, invertFilter=False, returnNulls=False)  # -> ExcludedGeometry, IncludedGeometry
glazing_u_factor_2 = Number(glazing_u_factor)

# ----
# 8 INFISSI
panel_2 = Panel("infisso")
glazing_ufactor = Panel("0.3")
windowmat = HBWindowMaterial(name=panel_2, u_factor=glazing_u_factor_2, shgc="0.4", t_vis="0.4")  # -> mat; plug-in component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
windowconstr = HBWindowConstruction(materials=windowmat)  # -> constr; plug-in component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
subfacesubset = HBSubfaceSubset(window=windowconstr)  # -> subface_set; plug-in component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

custom_program_school = CustomProgram_school()
custom_program_non_residential = CustomProgramNonResidential()
custom_program_residential = CustomProgramResidential()
hb_climatezone_2 = Text(hb_climatezone)
hb_constructiontype_2 = Text(hb_constructiontype)
hb_building_vintages_2 = Text(hb_building_vintages)

# ----
# 1 INPUT
brep = Brep(filter_by_name_r6)
list_item = ListItem(List=brep, Index=0, Wrap=True)
debrep = DeconstructBrep(Brep=brep)  # -> Faces, Edges, Vertices
floortofloor_height_2 = Number(floortofloor_height)
area = Area(Geometry=debrep.Faces)  # -> Area, Centroid
pdecon = Deconstruct(Point=area.Centroid)  # -> XComponent, YComponent, ZComponent
sort = SortList(Keys=pdecon.ZComponent, ValuesA=debrep.Faces, ValuesB=area.Centroid)  # -> Keys, ValuesA, ValuesB
item = ListItem(List=sort.Keys, Index=0, Wrap=True)
item_2 = ListItem(List=sort.ValuesB, Index=0, Wrap=True)  # -> Item1, Item
dist = Distance(PointA=item_2.Item1, PointB=item_2.Item)
panel_3 = Panel(item)
division = Division(A=dist, B=floortofloor_height_2)  # -> simplify(Result)
item_3 = ListItem(List=sort.ValuesA, Index=0, Wrap=True)  # -> Item1, Item

# ----
# 6 SELEZIONE
constrsetclimate = HBConstructionSetByClimate(climate_zone=hb_climatezone_2, vintage=hb_building_vintages_2, constr_type=hb_constructiontype_2)  # -> constr_set; plug-in component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

program_boolean_2 = Number(program_boolean)
filter = StreamFilter(
    Gate=program_boolean_2,
    Stream0=custom_program_residential,
    Stream1=custom_program_non_residential,
    Stream2=custom_program_school)
program_boolean_3 = ClusterOutput(program_boolean_2)
program = Data(filter)
program_2 = ClusterOutput(program)
lng = ListLength()
dup = DuplicateData(Data=filter, Number=lng, Order=True)
trim = TrimTree(Tree=dup, Depth=Slider(3, range=0..10))  # -> graft(Tree)
panel_4 = Panel(trim)

# ---- group: impronta dell'edificio
building_footprint = Surface(simplify(item_3.Item))

# ---- group: num piani
number_of_stories = Integer(division)

# ----
number_of_stories_2 = ClusterOutput(number_of_stories)
building_footprint_2 = ClusterOutput(building_footprint)

# ----
# 7 SELEZIONE STRATIGRAFIE
roof_selector = ClusterInput()
groundfloor_selector = ClusterInput()
envelope_selector = ClusterInput()
exteriorsubset = HBExteriorConstructionSubset()  # -> exterior_set; plug-in component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
groundsubset = HBGroundConstructionSubset()  # -> ground_set; plug-in component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

roof_selector_2 = Number(roof_selector)
envelope_selector_2 = Number(envelope_selector)
groundfloor_selector_2 = Number(groundfloor_selector)

cluster = Cluster_9(selector=roof_selector_2)  # -> roof_stratigrafia_2, u_fac_si_2
cluster_2 = Cluster_9(selector=groundfloor_selector_2)  # -> roof_stratigrafia_2, u_fac_si_2
cluster_3 = Cluster_8(selector=envelope_selector_2)  # -> wall_stratigrafia_2, u_fac_si_2

roof_name = Text(cluster.roof_stratigrafia_2)
roof_u_fac = Text(cluster.u_fac_si_2)
groundfloor_name = Text(cluster_2.roof_stratigrafia_2)
groundfloorf_u_fac = Text(cluster_2.u_fac_si_2)
envelope_u_fac = Text(cluster_3.u_fac_si_2)
envelope_name = Text(cluster_3.wall_stratigrafia_2)
roof_u_fac_2 = ClusterOutput(roof_u_fac)
roof_name_2 = ClusterOutput(roof_name)
groundfloorf_u_fac_2 = ClusterOutput(groundfloorf_u_fac)
envelope_name_2 = ClusterOutput(envelope_name)
groundfloor_name_2 = ClusterOutput(groundfloor_name)
envelope_u_fac_2 = ClusterOutput(envelope_u_fac)
constructionset = HBConstructionSet(
    base_constr_set=constrsetclimate,
    exterior_subset=exteriorsubset,
    ground_subset=groundsubset,
    subface_subset=subfacesubset)  # -> constr_set; plug-in component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
dup_2 = DuplicateData(Data=constructionset, Number=lng, Order=True)
trim_2 = TrimTree(Tree=dup_2, Depth=Slider(3, range=0..10))  # -> graft(Tree)
constr_set = Data(constructionset)
panel_5 = Panel(trim_2)
constr_set_2 = ClusterOutput(constr_set)

# ==== cluster Cluster_3
data = ClusterInput()
data_2 = Data(data)
clean_tree = CleanTree(RemoveNulls=True, RemoveInvalid=True, RemoveEmpty=True, Tree=data_2)
data_3 = Data(clean_tree)
data_4 = ClusterOutput(data_3)

# ==== cluster Cluster_8
selector = ClusterInput()
selector_2 = Number(selector)
muratura_blocco_termico_altamente_isolat = Muratura_blocco_termico_altamente_isolato()  # -> name_2, u_fac_si, constr, environmental_cobenefit_3, social_cobenefit_3, economic_cobenefit_2, albedo_7, thermalemissivity_3, gwp_kg_co2_m2_2; "Muratura_blocco_termico_altamente_isolato"
muratura_blocco_termico_isolato = Muratura_blocco_termico_isolato()  # -> name_2, u_fac_si, constr, environmental_cobenefit_3, social_cobenefit_3, economic_cobenefit_2, albedo_7, thermalemissivity_3, gwp_kg_co2_m2_2
muratura_lateerizio_altamente_isolato = Muratura_lateerizio_altamente_isolato()  # -> name_2, u_fac_si, constr, environmental_cobenefit_3, social_cobenefit_3, economic_cobenefit_2, albedo_7, thermalemissivity_3, gwp_kg_co2_m2_2
# Muratura_laterizio_non_isolato              = 0
# Muratura_laterizio_isolato                  = 1
# Muratura_lateerizio_altamente_isolato       = 2
# Muratura_blocco_termico_isolato             = 3
# Muratura_blocco_termico_altamente_isolato   = 4
# Muratura_calcestruzzo_non_isolato           = 5
# Muratura_calcestruzzo_medio_isolato_esterno = 6
# Muratura_calcestruzzo_medio_isolato_interno = 7
# Muratura_calcestruzzo_altamente_isolato     = 8
# Muratura_pietra_non_isolato                 = 9
# Muratura_pietra_medio_isolato               = 10
# Muratura_pietra_altamente_isolato           = 11
# Muratura_mattoni_non_isolato                = 12
# Muratura_mattoni_medio_isolato              = 13
# Muratura_mattoni_altamente_isolato          = 14
# PACCHETTO CALCESTRUZZO                      = 15
# PACCHETTO CALCESTRUZZO PARETE VENTILATA     = 16
# PACCHETTO LEGNO A UMIDO                     = 17
# PACCHETTO ACCIAIO                           = 18
# PACCHETTO LEGNO A SECCO                     = 19
muratura_laterizio_isolato = Muratura_laterizio_isolato()  # -> name_2, u_fac_si, constr, environmental_cobenefit_3, social_cobenefit_3, economic_cobenefit_2, albedo_7, thermalemissivity_3, gwp_kg_co2_m2_2
pacchetto_calcestruzzo = PACCHETTOCALCESTRUZZO()  # -> name_2, u_fac_si, constr, environmental_cobenefit_3, social_cobenefit_3, economic_cobenefit_2, albedo_3, thermalemissivity_3, gwp_kg_co2_m2_2
pacchetto_calcestruzzo_parete_ventilata = PACCHETTOCALCESTRUZZOPARETEVENTILATA()  # -> name_2, u_fac_si, constr, environmental_cobenefit_3, social_cobenefit_3, economic_cobenefit_2, albedo_3, thermalemissivity_3, gwp_kg_co2_m2_2
muratura_laterizio_non_isolato = Muratura_laterizio_non_isolato()  # -> name_2, u_fac_si, constr, environmental_cobenefit_3, social_cobenefit_3, economic_cobenefit_2, albedo_6, thermalemissivity_3, gwp_kg_co2_m2_2
muratura_calcestruzzo_medio_isolato_inte = Muratura_calcestruzzo_medio_isolato_interno()  # -> name_2, u_fac_si, constr, environmental_cobenefit_3, social_cobenefit_3, economic_cobenefit_2, albedo_8, thermalemissivity_3, gwp_kg_co2_m2_2; "Muratura_calcestruzzo_medio_isolato_interno"
muratura_calcestruzzo_medio_isolato_este = Muratura_calcestruzzo_medio_isolato_esterno()  # -> name_2, u_fac_si, constr, environmental_cobenefit_3, social_cobenefit_3, economic_cobenefit_2, albedo_8, thermalemissivity_3, gwp_kg_co2_m2_2; "Muratura_calcestruzzo_medio_isolato_esterno"
muratura_calcestruzzo_altamente_isolato = Muratura_calcestruzzo_altamente_isolato()  # -> name_2, u_fac_si, constr, environmental_cobenefit_3, social_cobenefit_3, economic_cobenefit_2, albedo_8, thermalemissivity_3, gwp_kg_co2_m2_2
muratura_calcestruzzo_non_isolato = Muratura_calcestruzzo_non_isolato()  # -> name_2, u_fac_si, constr, environmental_cobenefit_3, social_cobenefit_3, economic_cobenefit_2, albedo_7, thermalemissivity_3, gwp_kg_co2_m2_2
pacchetto_legno_a_secco = PACCHETTOLEGNOASECCO()  # -> name_2, u_fac_si, constr, environmental_cobenefit_3, social_cobenefit_3, economic_cobenefit_2, albedo_3, thermalemissivity_3, gwp_kg_co2_m2_2
pacchetto_legno_a_umido = PACCHETTOLEGNOAUMIDO()  # -> name_2, u_fac_si, constr, environmental_cobenefit_3, social_cobenefit_3, economic_cobenefit_2, albedo_3, thermalemissivity_3, gwp_kg_co2_m2_2
pacchetto_acciaio = PACCHETTOACCIAIO()  # -> name_2, u_fac_si, constr, environmental_cobenefit_3, social_cobenefit_3, economic_cobenefit_2, albedo_3, thermalemissivity_3, gwp_kg_co2_m2_2
muratura_pietra_medio_isolato = Muratura_pietra_medio_isolato()  # -> name_2, u_fac_si, constr, environmental_cobenefit_3, social_cobenefit_3, economic_cobenefit_2, albedo_7, thermalemissivity_3, gwp_kg_co2_m2_2
muratura_pietra_altamente_isolato = Muratura_pietra_altamente_isolato()  # -> name_2, u_fac_si, constr, environmental_cobenefit_3, social_cobenefit_3, economic_cobenefit_2, albedo_7, thermalemissivity_3, gwp_kg_co2_m2_2
muratura_mattoni_altamente_isolato = Muratura_mattoni_altamente_isolato()  # -> name_2, u_fac_si, constr, environmental_cobenefit_3, social_cobenefit_3, economic_cobenefit_2, albedo_7, thermalemissivity_3, gwp_kg_co2_m2_2
muratura_mattoni_non_isolato = Muratura_mattoni_non_isolato()  # -> name_2, u_fac_si, constr, environmental_cobenefit_3, social_cobenefit_3, economic_cobenefit_2, albedo_6, thermalemissivity_3, gwp_kg_co2_m2_2
muratura_mattoni_medio_isolato = Muratura_mattoni_medio_isolato()  # -> name_2, u_fac_si, constr, environmental_cobenefit_3, social_cobenefit_3, economic_cobenefit_2, albedo_7, thermalemissivity_3, gwp_kg_co2_m2_2
muratura_pietra_non_isolato = Muratura_pietra_non_isolato()  # -> name_2, u_fac_si, constr, environmental_cobenefit_3, social_cobenefit_3, economic_cobenefit_2, albedo_6, thermalemissivity_3, gwp_kg_co2_m2_2
stream_filter = StreamFilter(
    Gate=selector_2,
    Stream0=muratura_laterizio_non_isolato.name_2,
    Stream1=muratura_laterizio_isolato.name_2,
    Stream2=muratura_lateerizio_altamente_isolato.name_2,
    Stream3=muratura_blocco_termico_isolato.name_2,
    Stream4=muratura_blocco_termico_altamente_isolat.name_2,
    Stream5=muratura_calcestruzzo_non_isolato.name_2,
    Stream6=muratura_calcestruzzo_medio_isolato_este.name_2,
    Stream7=muratura_calcestruzzo_medio_isolato_inte.name_2,
    Stream8=muratura_calcestruzzo_altamente_isolato.name_2,
    Stream9=muratura_pietra_non_isolato.name_2,
    Stream10=muratura_pietra_medio_isolato.name_2,
    Stream11=muratura_pietra_altamente_isolato.name_2,
    Stream12=muratura_mattoni_non_isolato.name_2,
    Stream13=muratura_mattoni_medio_isolato.name_2,
    Stream14=muratura_mattoni_altamente_isolato.name_2,
    Stream15=pacchetto_calcestruzzo.name_2,
    Stream16=pacchetto_calcestruzzo_parete_ventilata.name_2,
    Stream17=pacchetto_legno_a_umido.name_2,
    Stream18=pacchetto_acciaio.name_2,
    Stream19=pacchetto_legno_a_secco.name_2)
stream_filter_2 = StreamFilter(
    Gate=selector_2,
    Stream0=muratura_laterizio_non_isolato.u_fac_si,
    Stream1=muratura_laterizio_isolato.u_fac_si,
    Stream2=muratura_lateerizio_altamente_isolato.u_fac_si,
    Stream3=muratura_blocco_termico_isolato.u_fac_si,
    Stream4=muratura_blocco_termico_altamente_isolat.u_fac_si,
    Stream5=muratura_calcestruzzo_non_isolato.u_fac_si,
    Stream6=muratura_calcestruzzo_medio_isolato_este.u_fac_si,
    Stream7=muratura_calcestruzzo_medio_isolato_inte.u_fac_si,
    Stream8=muratura_calcestruzzo_altamente_isolato.u_fac_si,
    Stream9=muratura_pietra_non_isolato.u_fac_si,
    Stream10=muratura_pietra_medio_isolato.u_fac_si,
    Stream11=muratura_pietra_altamente_isolato.u_fac_si,
    Stream12=muratura_mattoni_non_isolato.u_fac_si,
    Stream13=muratura_mattoni_medio_isolato.u_fac_si,
    Stream14=muratura_mattoni_altamente_isolato.u_fac_si,
    Stream15=pacchetto_calcestruzzo.u_fac_si,
    Stream16=pacchetto_calcestruzzo_parete_ventilata.u_fac_si,
    Stream17=pacchetto_legno_a_umido.u_fac_si,
    Stream18=pacchetto_acciaio.u_fac_si,
    Stream19=pacchetto_legno_a_secco.u_fac_si)
u_fac_si = Data(stream_filter_2)
wall_stratigrafia = Data(stream_filter)
u_fac_si_2 = ClusterOutput(u_fac_si)
wall_stratigrafia_2 = ClusterOutput(wall_stratigrafia)

# ==== cluster Cluster_9
selector = ClusterInput()
selector_2 = Number(selector)
solaio_laterocemento_altamente_isolato = Solaio_laterocemento_altamente_isolato()  # -> name_2, u_fac_si, constr, environmental_cobenefit_3, social_cobenefit_3, economic_cobenefit_2, albedo_3, thermalemissivity_3, gwp_kg_co2_m2_2
solaio_legno_altamente_isolato = Solaio_legno_altamente_isolato()  # -> name_2, u_fac_si, constr, environmental_cobenefit_3, social_cobenefit_3, economic_cobenefit_2, albedo_3, thermalemissivity_3, gwp_kg_co2_m2_2
solaio_laterocemento_scarso_isolato = Solaio_laterocemento_scarso_isolato()  # -> name_2, u_fac_si, constr, environmental_cobenefit_3, social_cobenefit_3, economic_cobenefit_2, albedo_3, thermalemissivity_3, gwp_kg_co2_m2_2
solaio_laterocemento_non_isolato = Solaio_laterocemento_non_isolato()  # -> name_2, u_fac_si, constr, environmental_cobenefit_3, social_cobenefit_3, economic_cobenefit_2, albedo_3, thermalemissivity_3, gwp_kg_co2_m2_2
copertura_calcestruzzo = Copertura_calcestruzzo()  # -> name_2, u_fac_si, constr, environmental_cobenefit_3, social_cobenefit_3, economic_cobenefit_2, albedo_3, thermalemissivity_3, gwp_kg_co2_m2_2
# Solaio_legno_non_isolato                 = 0
# Solaio_legno_scarso_isolato              = 1
# Solaio_legno_altamente_isolato           = 2
# Solaio_laterocemento_non_isolato         = 3
# Solaio_laterocemento_scarso_isolato      = 4
# Solaio_laterocemento_altamente_isolato   = 5
# Solaio_allegerito_eps_medio_isolato      = 6
# Solaio_allegerito_eps_isolato            = 7
# Solaio_allegerito_eps_altamente_isolato  = 8
# Solaio_calcestruzzo_igloo_non_isolato    = 9
# Solaio_calcestruzzo_igloo_scarso_isolato = 10
# Solaio_calcestruzzo_igloo_isolato        = 11
# Copertura_calcestruzzo                   = 12
# Copertura_acciaio                        = 13
# Copertura_legno                          = 14
# Copertura_Verde_estensivo                = 15
solaio_legno_scarso_isolato = Solaio_legno_scarso_isolato()  # -> name_2, u_fac_si, constr, environmental_cobenefit_3, social_cobenefit_3, economic_cobenefit_2, albedo_3, thermalemissivity_3, gwp_kg_co2_m2_2
copertura_acciaio = Copertura_acciaio()  # -> name_2, u_fac_si, constr, environmental_cobenefit_3, social_cobenefit_3, economic_cobenefit_2, albedo_3, thermalemissivity_3, gwp_kg_co2_m2_2
solaio_legno_non_isolato = Solaio_legno_non_isolato()  # -> name_2, u_fac_si, constr, environmental_cobenefit_3, social_cobenefit_3, economic_cobenefit_2, albedo_3, thermalemissivity_3, gwp_kg_co2_m2_2
copertura_verde_estensivo = Copertura_Verde_estensivo()  # -> name_2, u_fac_si, constr, environmental_cobenefit_3, social_cobenefit_3, economic_cobenefit_2, albedo_3, thermalemissivity_3, gwp_kg_co2_m2_2
copertura_legno = Copertura_legno()  # -> name_2, u_fac_si, constr, environmental_cobenefit_3, social_cobenefit_3, economic_cobenefit_2, albedo_3, thermalemissivity_3, gwp_kg_co2_m2_2
solaio_calcestruzzo_igloo_isolato = Solaio_calcestruzzo_igloo_isolato()  # -> name_2, u_fac_si, constr, environmental_cobenefit_3, social_cobenefit_3, economic_cobenefit_2, albedo_3, thermalemissivity_3, gwp_kg_co2_m2_2
solaio_allegerito_eps_altamente_isolato = Solaio_allegerito_eps_altamente_isolato()  # -> name_2, u_fac_si, constr, environmental_cobenefit_3, social_cobenefit_3, economic_cobenefit_2, albedo_3, thermalemissivity_3, gwp_kg_co2_m2_2
solaio_calcestruzzo_igloo_non_isolato = Solaio_calcestruzzo_igloo_non_isolato()  # -> name_2, u_fac_si, constr, environmental_cobenefit_3, social_cobenefit_3, economic_cobenefit_2, albedo_3, thermalemissivity_3, gwp_kg_co2_m2_2
solaio_calcestruzzo_igloo_scarso_isolato = Solaio_calcestruzzo_igloo_scarso_isolato()  # -> name_2, u_fac_si, constr, environmental_cobenefit_3, social_cobenefit_3, economic_cobenefit_2, albedo_3, thermalemissivity_3, gwp_kg_co2_m2_2
solaio_allegerito_eps_medio_isolato = Solaio_allegerito_eps_medio_isolato()  # -> name_2, u_fac_si, constr, environmental_cobenefit_3, social_cobenefit_3, economic_cobenefit_2, albedo_3, thermalemissivity_3, gwp_kg_co2_m2_2
solaio_allegerito_eps_isolato = Solaio_allegerito_eps_isolato()  # -> name_2, u_fac_si, constr, environmental_cobenefit_3, social_cobenefit_3, economic_cobenefit_2, albedo_3, thermalemissivity_3, gwp_kg_co2_m2_2
stream_filter = StreamFilter(
    Gate=selector_2,
    Stream0=solaio_legno_non_isolato.u_fac_si,
    Stream1=solaio_legno_scarso_isolato.u_fac_si,
    Stream2=solaio_legno_altamente_isolato.u_fac_si,
    Stream3=solaio_laterocemento_non_isolato.u_fac_si,
    Stream4=solaio_laterocemento_scarso_isolato.u_fac_si,
    Stream5=solaio_laterocemento_altamente_isolato.u_fac_si,
    Stream6=solaio_allegerito_eps_medio_isolato.u_fac_si,
    Stream7=solaio_allegerito_eps_isolato.u_fac_si,
    Stream8=solaio_allegerito_eps_altamente_isolato.u_fac_si,
    Stream9=solaio_calcestruzzo_igloo_non_isolato.u_fac_si,
    Stream10=solaio_calcestruzzo_igloo_scarso_isolato.u_fac_si,
    Stream11=solaio_calcestruzzo_igloo_isolato.u_fac_si,
    Stream12=copertura_calcestruzzo.u_fac_si,
    Stream13=copertura_acciaio.u_fac_si,
    Stream14=copertura_legno.u_fac_si,
    Stream15=copertura_verde_estensivo.u_fac_si)
stream_filter_2 = StreamFilter(
    Gate=selector_2,
    Stream0=solaio_legno_non_isolato.name_2,
    Stream1=solaio_legno_scarso_isolato.name_2,
    Stream2=solaio_legno_altamente_isolato.name_2,
    Stream3=solaio_laterocemento_non_isolato.name_2,
    Stream4=solaio_laterocemento_scarso_isolato.name_2,
    Stream5=solaio_laterocemento_altamente_isolato.name_2,
    Stream6=solaio_allegerito_eps_medio_isolato.name_2,
    Stream7=solaio_allegerito_eps_isolato.name_2,
    Stream8=solaio_allegerito_eps_altamente_isolato.name_2,
    Stream9=solaio_calcestruzzo_igloo_non_isolato.name_2,
    Stream10=solaio_calcestruzzo_igloo_scarso_isolato.name_2,
    Stream11=solaio_calcestruzzo_igloo_isolato.name_2,
    Stream12=copertura_calcestruzzo.name_2,
    Stream13=copertura_acciaio.name_2,
    Stream14=copertura_legno.name_2,
    Stream15=copertura_verde_estensivo.name_2)
roof_stratigrafia = Data(stream_filter_2)
u_fac_si = Data(stream_filter)
u_fac_si_2 = ClusterOutput(u_fac_si)
roof_stratigrafia_2 = ClusterOutput(roof_stratigrafia)

# ==== cluster CustomProgramNonResidential
period_of_low_occupation = Panel("""Dec 24 to Jan 5
Aug 1 to Aug 31""")
national_holidays = Panel("""Jan 1
Jan 6
Apr 25
May 1
Jun 2
Aug 15
Nov 1
Dec 8
Dec 25
Dec 26""")

change_value = Slider(0, range=0..100)
gene_pool = GenePool(
    Decimals=2,
    Maximum=1,
    Minimum=0,
    Value=[0, 0, 0, 0, 0, 0, 0, 0, 0.6, 0.8, 0.8, 0.8, 0.8, 0.2, 0.65, 0.65, 0.65, 0.6, 0.2, 0, 0, 0, 0, 0])
occupancyschedule = OccupancySchedule(mon_fri=gene_pool, change_value=change_value, national_holiday=national_holidays, change_period=period_of_low_occupation)
m2_per_persona_ufficio = Slider(5, range=5..12)
division = Division(A="1", B=m2_per_persona_ufficio)
panel = Panel(division)

change_value_2 = Slider(0, range=0..100)
gene_pool_2 = GenePool(
    Decimals=2,
    Maximum=1,
    Minimum=0.3,
    Value=[0.3, 0.3, 0.3, 0.3, 0.3, 0.3, 0.3, 0.3, 0.7, 0.85, 0.85, 0.85, 0.85, 0.65, 0.75, 0.75, 0.75, 0.75, 0.45, 0.3, 0.3, 0.3, 0.3, 0.3])
ecquipmentschedule = EcquipmentSchedule(
    mon_fri=gene_pool_2,
    change_value=change_value_2,
    national_holiday=national_holidays,
    change_period=period_of_low_occupation)
equipment = HBEquipment(name="ecquipaggiamneto elettrico", watts_per_area=Slider(7, range=0..10), schedule=ecquipmentschedule)  # -> equip; plug-in component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

gene_pool_3 = GenePool(
    Decimals=2,
    Maximum=1,
    Minimum=0,
    Value=[0, 0, 0, 0, 0, 0, 0, 0, 0.35, 0.25, 0.25, 0.25, 0.25, 0.5, 0.5, 0.25, 0.25, 0.35, 0.15, 0, 0, 0, 0, 0])
hotwaterschedule = HotWaterSchedule(mon_fri=gene_pool_3, national_holiday=national_holidays)
servicehotwater = HBServiceHotWater(name="acqua calda", flow_per_area="0.05", schedule=hotwaterschedule)  # -> hot_water; plug-in component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

period_of_low_occupation_2 = Panel("Aug 1 to Aug 31")

change_value__summer = Slider(0, range=0..100)
gene_pool_4 = GenePool(
    Decimals=2,
    Maximum=1,
    Minimum=0.05,
    Value=[0.05, 0.05, 0.05, 0.05, 0.05, 0.05, 0.05, 0.05, 0.65, 0.85, 0.85, 0.85, 0.85, 0.7625, 0.85, 0.85, 0.85, 0.85, 0.525, 0.05, 0.05, 0.05, 0.05, 0.05])
lightingschedule = LightingSchedule(
    mon_fri=gene_pool_4,
    change_value__summer=change_value__summer,
    national_holiday=national_holidays,
    change_period=period_of_low_occupation_2)
lighting = HBLighting(name="luce", watts_per_area=Slider(5, range=0..10), schedule=lightingschedule)  # -> lighting; plug-in component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

period_of_low_occupation_3 = Panel("Dec 24 to Jan 5")
period_of_low_occupation_4 = Panel("Aug 1 to Aug 31")

gene_pool_5 = GenePool(
    Decimals=0,
    Maximum=22,
    Minimum=17,
    Value=[17, 17, 17, 17, 17, 17, 17, 17, 19, 21, 21, 21, 21, 21, 17, 21, 21, 21, 21, 20, 19, 17, 17, 17])
gene_pool_6 = GenePool(
    Decimals=0,
    Maximum=28,
    Minimum=24,
    Value=[28, 28, 28, 28, 28, 28, 28, 28, 28, 27.33333333, 26, 26, 26, 26, 26, 26, 26, 26, 26, 27.33333333, 28, 28, 28, 28])
coolingschedule = CoolingSchedule(data=gene_pool_6, data_3=national_holidays, data_2=period_of_low_occupation_4)
heatingschedule = HeatingSchedule(data=gene_pool_5, data_2=national_holidays, data_3=period_of_low_occupation_3)
setpoint = HBSetpoint(name="setpoint", heating_sch=heatingschedule, cooling_sch=coolingschedule)  # -> setpoint; plug-in component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

people = HBPeople(name="occupazione persone", ppl_per_area=division, occupancy_sch=occupancyschedule)  # -> people; plug-in component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
hb_building_programs = HBBuildingPrograms({"LargeOffice", "MediumOffice", "SmallOffice", "MidriseApartment", "HighriseApartment", "Retail", "StripMall", "PrimarySchool", "SecondarySchool", "SmallHotel", "LargeHotel", "Hospital", "Outpatient", "Laboratory", "Warehouse", "SuperMarket", "FullServiceRestaurant", "QuickServiceRestaurant", "Courthouse", "LargeDataCenterHighITE", "LargeDataCenterLowITE", "SmallDataCenterHighITE", "SmallDataCenterLowITE"}, selected="MediumOffice")
programtype = HBProgramType(
    name="program_NonResidential",
    base_program=hb_building_programs,
    people=people,
    lighting=lighting,
    electric_equip=equipment,
    hot_water=servicehotwater,
    setpoint=setpoint)  # -> program; plug-in component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
program = ClusterOutput(programtype)

# ==== cluster CustomProgramResidential

# ----
# riferimenti: peole_0,1_D.M. Sanità 5 luglio 1975 Art. 2 "Per ogni abitante deve essere assicurata una superficie abitabile non inferiore a mq 14, per i primi 4 abitanti, ed a mq 10, per ciascuno dei successivi"
# https://www.sorgenia.it/guida-energia/lumen-cosa-sono_ 4 W/m2
# 
# acqua calda_0,125_"si stima che in media il consumo di acqua calda giornaliero a persona oscilla tra i 20 e i 40 litri"_https://www.acea.it/guide/risparmiare-consumi-acqua-calda
consumo_medio_acqua_calda_l_g_per_person = Slider(30, range=0..100)  # "consumo medio acqua calda l/g per persona"
ore = Slider(24, range=0..100)
division = Division(A=Slider(1, range=0..1), B=Slider(10, range=0..10))
division_2 = Division(A=consumo_medio_acqua_calda_l_g_per_person, B=ore)
# RIFERIENTI
occupazione_p_m2 = Panel(division)
multiplication = Multiplication(A=division_2, B=division)
acqua_calda_l_m_m2 = Panel(multiplication)

# ----
# Una casa in condizioni “medie”, oggi, consuma circa 150-200 kWh/mq
# 
# https://www.immobilgreen.it/news/efficienza-energetica/quanto-consuma-la-tua-casa/
# ripartizione dei consumi
# 
# https://luce-gas.it/guida/consumo/elettrodomestici
number_slider = Slider(1000, range=0..1000)
kwh_m2_annui = Slider(150, range=0..1000)
multiplication_2 = Multiplication(A=kwh_m2_annui, B=number_slider)
wh_m2_annui = Panel(multiplication_2)
# SETPOINT: https://www.daikin.ch/it_ch/products/product.html/EKRTR.html_ inverno giorno 21 C notte 17 C, estate giorno 24 C e notte 28 C
number_slider_2 = Slider(6, range=0..10)
division_3 = Division(A=multiplication_2, B=Slider(360, range=0..1000))
division_4 = Division(A=division_3, B=Slider(24, range=0..100))
division_5 = Division(A=division_4, B=Slider(100, range=0..100))
w_m2_tot = Panel(division_4)
multiplication_3 = Multiplication(A=division_5, B=number_slider_2)
subtraction = Subtraction(A=division_4, B=multiplication_3)
luce = Panel(multiplication_3)
ecuipaggiamento_elettrico = Panel(subtraction)

gene_pool = GenePool(
    Decimals=0,
    Maximum=22,
    Minimum=17,
    Value=[17, 17, 17, 17, 17, 17, 17, 17, 20, 21, 21, 21, 21, 21, 21, 21, 21, 21, 21, 20, 20, 17, 17, 17])
gene_pool_2 = GenePool(
    Decimals=0,
    Maximum=28,
    Minimum=24,
    Value=[28, 28, 28, 28, 28, 28, 28, 28, 28, 27.33333333, 26, 26, 26, 26, 26, 26, 26, 26, 26, 27.33333333, 28, 28, 28, 28])
coolingschedule = CoolingSchedule_2(data=gene_pool_2)
heatingschedule = HeatingSchedule_2(data=gene_pool)
setpoint = HBSetpoint(name="setpoint", heating_sch=heatingschedule, cooling_sch=coolingschedule)  # -> setpoint; plug-in component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

gene_pool_3 = GenePool(
    Decimals=1,
    Maximum=1,
    Minimum=0,
    Value=[1, 1, 1, 1, 1, 1, 1, 0.7, 0.2, 0.2, 0.2, 0.2, 0.2, 0.3, 0.5, 0.5, 0.5, 0.5, 0.7, 0.7, 0.7, 1, 1, 1])
occupancyschedule = OccupancySchedule_2(mon_fri=gene_pool_3)

gene_pool_4 = GenePool(
    Decimals=1,
    Maximum=1,
    Minimum=0,
    Value=[0.2, 0, 0, 0, 0, 0, 0.8, 0.8, 0.8, 0.2, 0.2, 0.25, 0.25, 0.5, 0.5, 0.4, 0.4, 0.4, 0.8, 0.8, 0.8, 0.8, 0.8, 0.4])
hotwaterschedule = LightingSchedule_2(mon_fri=gene_pool_4)

gene_pool_5 = GenePool(
    Decimals=1,
    Maximum=1,
    Minimum=0.2,
    Value=[0.3, 0.2, 0.2, 0.2, 0.2, 0.2, 0.5, 0.5, 0.4, 0.4, 0.4, 0.4, 0.4, 0.4, 0.5, 0.6, 0.6, 0.7, 0.7, 0.7, 0.7, 0.7, 0.7, 0.5])
ecquipmentschedule = LightingSchedule_2(mon_fri=gene_pool_5)

gene_pool_6 = GenePool(
    Decimals=2,
    Maximum=1,
    Minimum=0.05,
    Value=[0.05, 0.05, 0.05, 0.05, 0.05, 0.05, 0.8, 0.8, 0.05, 0.05, 0.05, 0.05, 0.05, 0.05, 0.05, 0.05, 0.5, 0.5, 0.7, 0.8, 0.8, 0.8, 0.7, 0.5])
lightingschedule = LightingSchedule_2(mon_fri=gene_pool_6)

# ----
# PROGRAMMA_DESTINAZIONE_D’USO_RESIDENZIALE
occupazione_p_m2_2 = Panel(division)
acqua_calda_l_m_m2_2 = Panel(multiplication)
luce_2 = Panel(multiplication_3)
ecuipaggiamento_elettrico_2 = Panel(subtraction)
hb_building_programs = HBBuildingPrograms({"LargeOffice", "MediumOffice", "SmallOffice", "MidriseApartment", "HighriseApartment", "Retail", "StripMall", "PrimarySchool", "SecondarySchool", "SmallHotel", "LargeHotel", "Hospital", "Outpatient", "Laboratory", "Warehouse", "SuperMarket", "FullServiceRestaurant", "QuickServiceRestaurant", "Courthouse", "LargeDataCenterHighITE", "LargeDataCenterLowITE", "SmallDataCenterHighITE", "SmallDataCenterLowITE"}, selected="MidriseApartment")

servicehotwater = HBServiceHotWater(name="acqua calda", flow_per_area=acqua_calda_l_m_m2_2, schedule=hotwaterschedule)  # -> hot_water; plug-in component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

lighting = HBLighting(name="luce", watts_per_area=luce_2, schedule=lightingschedule)  # -> lighting; plug-in component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

equipment = HBEquipment(name="ecquipaggiamneto elettrico", watts_per_area=ecuipaggiamento_elettrico_2, schedule=ecquipmentschedule)  # -> equip; plug-in component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

people = HBPeople(name="occupazione persone", ppl_per_area=occupazione_p_m2_2, occupancy_sch=occupancyschedule)  # -> people; plug-in component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

programtype = HBProgramType(
    name="program_residential",
    base_program=hb_building_programs,
    people=people,
    lighting=lighting,
    electric_equip=equipment,
    hot_water=servicehotwater,
    setpoint=setpoint)  # -> program; plug-in component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

program = ClusterOutput(programtype)

# ==== cluster CustomProgram_school
national_holidays = Panel("""Jan 1
Jan 6
Apr 1
Apr 2
Apr 25
May 1
Jun 2
Aug 15
Nov 1
Dec 8
Dec 25
Dec 26""")
period_of_low_occupation = Panel("""Dec 24 to Jan 5
Jul 1 to 31 Jul
Aug 1 to Aug 31""")

gene_pool = GenePool(
    Decimals=0,
    Maximum=22,
    Minimum=17,
    Value=[17, 17, 17, 17, 17, 17, 17, 19, 20, 21, 21, 21, 21, 21, 21, 21, 21, 21, 21, 20, 19, 17, 17, 17])
gene_pool_2 = GenePool(
    Decimals=0,
    Maximum=28,
    Minimum=24,
    Value=[28, 28, 28, 28, 28, 28, 28, 28, 28, 27.33333333, 26, 26, 26, 26, 26, 26, 26, 26, 26, 27.33333333, 28, 28, 28, 28])
period_of_low_occupation_2 = Panel("""Jun 1 to Jun 31
Aug 1 to Aug 31""")
period_of_low_occupation_3 = Panel("Dec 24 to Jan 5")
cooling_sch = Heating_sch(mon_sat=gene_pool_2, change_period=period_of_low_occupation_2, national_holiday=national_holidays)
heating_sch = Heating_sch(mon_sat=gene_pool, change_period=period_of_low_occupation_3, national_holiday=national_holidays)
setpoint = HBSetpoint(name="setpoint", heating_sch=heating_sch, cooling_sch=cooling_sch)  # -> setpoint; plug-in component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

change_value = Slider(0, range=0..100)
gene_pool_3 = GenePool(
    Decimals=2,
    Maximum=1,
    Minimum=0,
    Value=[0, 0, 0, 0, 0, 0, 0, 0, 0.35, 0.25, 0.25, 0.25, 0.25, 0.5, 0.5, 0.25, 0.25, 0.35, 0.16, 0, 0, 0, 0, 0])
hotwater_sch = Occupancy_sch(
    mon_sat=gene_pool_3,
    change_value=change_value,
    change_period=period_of_low_occupation,
    national_holiday=national_holidays)
servicehotwater = HBServiceHotWater(name="acqua calda", flow_per_area="0.05", schedule=hotwater_sch)  # -> hot_water; plug-in component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

change_value_2 = Slider(0, range=0..100)
gene_pool_4 = GenePool(
    Decimals=2,
    Maximum=1,
    Minimum=0,
    Value=[0, 0, 0, 0, 0, 0, 0, 0, 0.8, 0.8, 0.8, 0.8, 0.8, 0.8, 0.8, 0.4, 0.4, 0.4, 0.4, 0, 0, 0, 0, 0])
m2_per_persona_ufficio = Slider(1.88, range=0..12)
occupancy_sch = Occupancy_sch(
    mon_sat=gene_pool_4,
    change_value=change_value_2,
    change_period=period_of_low_occupation,
    national_holiday=national_holidays)
division = Division(A="1", B=m2_per_persona_ufficio)
panel = Panel(division)
people = HBPeople(name="occupazione persone", ppl_per_area=division, occupancy_sch=occupancy_sch)  # -> people; plug-in component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

change_value__summer = Slider(0, range=0..100)
gene_pool_5 = GenePool(
    Decimals=2,
    Maximum=1,
    Minimum=0.05,
    Value=[0.17, 0.17, 0.17, 0.17, 0.17, 0.17, 0.17, 0.17, 0.7, 0.7, 0.7, 0.7, 0.7, 0.7, 0.7, 0.7, 0.7, 0.7, 0.525, 0.17, 0.17, 0.17, 0.17, 0.17])
lighting_sch = Occupancy_sch(
    mon_sat=gene_pool_5,
    change_value=change_value__summer,
    change_period=period_of_low_occupation,
    national_holiday=national_holidays)
lighting = HBLighting(name="illuminazione", watts_per_area=Slider(11, range=0..12), schedule=lighting_sch)  # -> lighting; plug-in component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

change_value_3 = Slider(0, range=0..100)
gene_pool_6 = GenePool(
    Decimals=2,
    Maximum=1,
    Minimum=0.28,
    Value=[0.28, 0.28, 0.28, 0.28, 0.28, 0.28, 0.28, 0.28, 0.85, 0.8457142857, 0.8457142857, 0.8457142857, 0.8457142857, 0.85, 0.85, 0.85, 0.85, 0.4, 0.4, 0.28, 0.28, 0.28, 0.28, 0.28])
equiment_sch = Occupancy_sch(
    mon_sat=gene_pool_6,
    change_value=change_value_3,
    change_period=period_of_low_occupation,
    national_holiday=national_holidays)
equipment = HBEquipment(name="equipaggiamento elettrico", watts_per_area=Slider(14, range=0..15), schedule=equiment_sch)  # -> equip; plug-in component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

programtype = HBProgramType(
    name="program_NonResidential-school",
    people=people,
    lighting=lighting,
    electric_equip=equipment,
    hot_water=servicehotwater,
    setpoint=setpoint)  # -> program; plug-in component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
program = ClusterOutput(programtype)

# ==== cluster Muratura_pietra_non_isolato
albedo = Panel("0.650")
albedo_2 = Panel("0.300")
albedo_3 = Panel("0.650")
subtraction = Subtraction(A="1", B=albedo_2)
subtraction_2 = Subtraction(A="1", B=albedo_3)
subtraction_3 = Subtraction(A="1", B=albedo)
opaquemat = HBOpaqueMaterial(
    name="Pietra",
    thickness="0.5",
    conductivity="2.4",
    density="2500",
    spec_heat="1000",
    therm_absp="0.92",
    sol_absp=subtraction,
    vis_absp=subtraction)  # -> mat; plug-in component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
opaquemat_2 = HBOpaqueMaterial(
    name="Intonaco_interno",
    thickness="0.02",
    conductivity="0.7",
    density="1500",
    spec_heat="1000",
    therm_absp="0.9",
    sol_absp=subtraction_2,
    vis_absp=subtraction_2)  # -> mat; plug-in component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
opaquemat_3 = HBOpaqueMaterial(
    name="Intonaco_esterno",
    thickness="0.02",
    conductivity="0.7",
    density="1500",
    spec_heat="1000",
    therm_absp="0.9",
    sol_absp=subtraction_3,
    vis_absp=subtraction_3)  # -> mat; plug-in component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
panel = Panel("Muratura_Pietra_non_isolato")
economical_cobenefit = Panel("EMPLOYMENT AND INCOME GENERATION")
merge = Merge(Data1=opaquemat_3, Data2=opaquemat, Data3=opaquemat_2)
social_cobenefit = Panel("HEALTH IMPACTS")
environmental_cobenefit = Panel("AIR QUALITY")
thermalemissivity = Panel("0.90")
albedo_4 = Panel("0.65")
gwp = Panel("0")
opaqueconstr = HBOpaqueConstruction(name=panel, materials=merge)  # -> constr; plug-in component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
name = Data(panel)
economic_cobenefit = Text(economical_cobenefit)
social_cobenefit_2 = Text(social_cobenefit)
albedo_5 = Number(albedo_4)
name_2 = ClusterOutput(name)
environmental_cobenefit_2 = Text(environmental_cobenefit)
thermalemissivity_2 = Number(thermalemissivity)
gwp_kg_co2_m2 = Number(gwp)
decnstrconstr = HBDeconstructConstruction(constr=opaqueconstr)  # -> materials, layers, r_val_si, r_val_ip, u_fac_si, u_fac_ip, shgc, t_sol, t_vis; plug-in component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
economic_cobenefit_2 = ClusterOutput(economic_cobenefit)
albedo_6 = ClusterOutput(albedo_5)
thermalemissivity_3 = ClusterOutput(thermalemissivity_2)
environmental_cobenefit_3 = ClusterOutput(environmental_cobenefit_2)
social_cobenefit_3 = ClusterOutput(social_cobenefit_2)
gwp_kg_co2_m2_2 = ClusterOutput(gwp_kg_co2_m2)
constr = ClusterOutput(opaqueconstr)
u_fac_si = ClusterOutput(decnstrconstr.u_fac_si)
panel_2 = Panel(decnstrconstr.u_fac_si)

# ==== cluster Muratura_pietra_medio_isolato
albedo = Panel("0.700")
albedo_2 = Panel("0.300")
albedo_3 = Panel("0.650")
albedo_4 = Panel("0.650")
subtraction = Subtraction(A="1", B=albedo)
subtraction_2 = Subtraction(A="1", B=albedo_2)
subtraction_3 = Subtraction(A="1", B=albedo_3)
subtraction_4 = Subtraction(A="1", B=albedo_4)
opaquemat = HBOpaqueMaterial(
    name="Intonaco_esterno",
    thickness="0.02",
    conductivity="0.7",
    density="1500",
    spec_heat="1000",
    therm_absp="0.9",
    sol_absp=subtraction_3,
    vis_absp=subtraction_3)  # -> mat; plug-in component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
opaquemat_2 = HBOpaqueMaterial(
    name="Isolante",
    thickness="0.05",
    conductivity="0.045",
    density="100",
    spec_heat="840",
    therm_absp="0.1",
    sol_absp=subtraction,
    vis_absp=subtraction)  # -> mat; plug-in component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
opaquemat_3 = HBOpaqueMaterial(
    name="Pietra",
    thickness="0.5",
    conductivity="2.4",
    density="2500",
    spec_heat="1000",
    therm_absp="0.92",
    sol_absp=subtraction_2,
    vis_absp=subtraction_2)  # -> mat; plug-in component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
opaquemat_4 = HBOpaqueMaterial(
    name="Intonaco_interno",
    thickness="0.02",
    conductivity="0.7",
    density="1500",
    spec_heat="1000",
    therm_absp="0.9",
    sol_absp=subtraction_4,
    vis_absp=subtraction_4)  # -> mat; plug-in component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
panel = Panel("Muratura_Pietra_medio_isolante")
economical_cobenefit = Panel("EMPLOYMENT AND INCOME GENERATION")
environmental_cobenefit = Panel("AIR QUALITY")
social_cobenefit = Panel("HEALTH IMPACTS")
merge = Merge(Data1=opaquemat, Data2=opaquemat_2, Data3=opaquemat_3, Data4=opaquemat_4)
gwp = Panel("0")
albedo_5 = Panel("0.65")
thermalemissivity = Panel("0.90")
name = Data(panel)
name_2 = ClusterOutput(name)
opaqueconstr = HBOpaqueConstruction(name=panel, materials=merge)  # -> constr; plug-in component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
economic_cobenefit = Text(economical_cobenefit)
social_cobenefit_2 = Text(social_cobenefit)
albedo_6 = Number(albedo_5)
environmental_cobenefit_2 = Text(environmental_cobenefit)
thermalemissivity_2 = Number(thermalemissivity)
gwp_kg_co2_m2 = Number(gwp)
decnstrconstr = HBDeconstructConstruction(constr=opaqueconstr)  # -> materials, layers, r_val_si, r_val_ip, u_fac_si, u_fac_ip, shgc, t_sol, t_vis; plug-in component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
economic_cobenefit_2 = ClusterOutput(economic_cobenefit)
albedo_7 = ClusterOutput(albedo_6)
thermalemissivity_3 = ClusterOutput(thermalemissivity_2)
constr = ClusterOutput(opaqueconstr)
environmental_cobenefit_3 = ClusterOutput(environmental_cobenefit_2)
social_cobenefit_3 = ClusterOutput(social_cobenefit_2)
gwp_kg_co2_m2_2 = ClusterOutput(gwp_kg_co2_m2)
u_fac_si = ClusterOutput(decnstrconstr.u_fac_si)

# ==== cluster Muratura_pietra_altamente_isolato
albedo = Panel("0.300")
albedo_2 = Panel("0.700")
albedo_3 = Panel("0.650")
albedo_4 = Panel("0.650")
subtraction = Subtraction(A="1", B=albedo_2)
subtraction_2 = Subtraction(A="1", B=albedo)
subtraction_3 = Subtraction(A="1", B=albedo_3)
subtraction_4 = Subtraction(A="1", B=albedo_4)
opaquemat = HBOpaqueMaterial(
    name="Intonaco_esterno",
    thickness="0.02",
    conductivity="0.7",
    density="1500",
    spec_heat="1000",
    therm_absp="0.9",
    sol_absp=subtraction_3,
    vis_absp=subtraction_3)  # -> mat; plug-in component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
opaquemat_2 = HBOpaqueMaterial(
    name="Isolante",
    thickness="0.1",
    conductivity="0.032",
    density="30",
    spec_heat="1250",
    therm_absp="0.1",
    sol_absp=subtraction,
    vis_absp=subtraction)  # -> mat; plug-in component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
opaquemat_3 = HBOpaqueMaterial(
    name="Pietra",
    thickness="0.5",
    conductivity="2.4",
    density="2500",
    spec_heat="1000",
    therm_absp="0.92",
    sol_absp=subtraction_2,
    vis_absp=subtraction_2)  # -> mat; plug-in component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
opaquemat_4 = HBOpaqueMaterial(
    name="Intonaco_interno",
    thickness="0.02",
    conductivity="0.7",
    density="1500",
    spec_heat="1000",
    therm_absp="0.9",
    sol_absp=subtraction_4,
    vis_absp=subtraction_4)  # -> mat; plug-in component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
panel = Panel("Muratura_Pietra_isolante")
economical_cobenefit = Panel("EMPLOYMENT AND INCOME GENERATION")
social_cobenefit = Panel("HEALTH IMPACTS")
environmental_cobenefit = Panel("AIR QUALITY")
merge = Merge(Data1=opaquemat, Data2=opaquemat_2, Data3=opaquemat_3, Data4=opaquemat_4)
albedo_5 = Panel("0.65")
thermalemissivity = Panel("0.90")
gwp = Panel("0")
name = Data(panel)
name_2 = ClusterOutput(name)
opaqueconstr = HBOpaqueConstruction(name=panel, materials=merge)  # -> constr; plug-in component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
decnstrconstr = HBDeconstructConstruction(constr=opaqueconstr)  # -> materials, layers, r_val_si, r_val_ip, u_fac_si, u_fac_ip, shgc, t_sol, t_vis; plug-in component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
economic_cobenefit = Text(economical_cobenefit)
social_cobenefit_2 = Text(social_cobenefit)
albedo_6 = Number(albedo_5)
environmental_cobenefit_2 = Text(environmental_cobenefit)
thermalemissivity_2 = Number(thermalemissivity)
gwp_kg_co2_m2 = Number(gwp)
constr = ClusterOutput(opaqueconstr)
economic_cobenefit_2 = ClusterOutput(economic_cobenefit)
albedo_7 = ClusterOutput(albedo_6)
thermalemissivity_3 = ClusterOutput(thermalemissivity_2)
environmental_cobenefit_3 = ClusterOutput(environmental_cobenefit_2)
social_cobenefit_3 = ClusterOutput(social_cobenefit_2)
gwp_kg_co2_m2_2 = ClusterOutput(gwp_kg_co2_m2)
u_fac_si = ClusterOutput(decnstrconstr.u_fac_si)
panel_2 = Panel(decnstrconstr.u_fac_si)

# ==== cluster Muratura_mattoni_non_isolato
albedo = Panel("0.650")
albedo_2 = Panel("0.650")
albedo_3 = Panel("0.400")
subtraction = Subtraction(A="1", B=albedo_3)
subtraction_2 = Subtraction(A="1", B=albedo_2)
subtraction_3 = Subtraction(A="1", B=albedo)
opaquemat = HBOpaqueMaterial(
    name="Mattoni_pieni",
    thickness="0.4",
    conductivity="0.78",
    density="1800",
    spec_heat="840",
    therm_absp="0.95",
    sol_absp=subtraction,
    vis_absp=subtraction)  # -> mat; plug-in component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
opaquemat_2 = HBOpaqueMaterial(
    name="Intonaco_interno",
    thickness="0.02",
    conductivity="0.7",
    density="1500",
    spec_heat="1000",
    therm_absp="0.9",
    sol_absp=subtraction_2,
    vis_absp=subtraction_2)  # -> mat; plug-in component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
opaquemat_3 = HBOpaqueMaterial(
    name="Intonaco_esterno",
    thickness="0.02",
    conductivity="0.7",
    density="1500",
    spec_heat="1000",
    therm_absp="0.9",
    sol_absp=subtraction_3,
    vis_absp=subtraction_3)  # -> mat; plug-in component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
panel = Panel("Muratura_Mattoni_non_isolato")
merge = Merge(Data1=opaquemat_3, Data2=opaquemat, Data3=opaquemat_2)
economical_cobenefit = Panel("EMPLOYMENT AND INCOME GENERATION")
environmental_cobenefit = Panel("AIR QUALITY")
social_cobenefit = Panel("HEALTH IMPACTS")
name = Data(panel)
albedo_4 = Panel("0.65")
thermalemissivity = Panel("0.90")
gwp = Panel("0")
name_2 = ClusterOutput(name)
opaqueconstr = HBOpaqueConstruction(name=panel, materials=merge)  # -> constr; plug-in component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
economic_cobenefit = Text(economical_cobenefit)
social_cobenefit_2 = Text(social_cobenefit)
albedo_5 = Number(albedo_4)
environmental_cobenefit_2 = Text(environmental_cobenefit)
decnstrconstr = HBDeconstructConstruction(constr=opaqueconstr)  # -> materials, layers, r_val_si, r_val_ip, u_fac_si, u_fac_ip, shgc, t_sol, t_vis; plug-in component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
constr = ClusterOutput(opaqueconstr)
thermalemissivity_2 = Number(thermalemissivity)
gwp_kg_co2_m2 = Number(gwp)
economic_cobenefit_2 = ClusterOutput(economic_cobenefit)
albedo_6 = ClusterOutput(albedo_5)
thermalemissivity_3 = ClusterOutput(thermalemissivity_2)
environmental_cobenefit_3 = ClusterOutput(environmental_cobenefit_2)
social_cobenefit_3 = ClusterOutput(social_cobenefit_2)
gwp_kg_co2_m2_2 = ClusterOutput(gwp_kg_co2_m2)
u_fac_si = ClusterOutput(decnstrconstr.u_fac_si)
panel_2 = Panel(decnstrconstr.u_fac_si)

# ==== cluster Muratura_mattoni_medio_isolato
panel = Panel("0.1")
albedo = Panel("0.400")
albedo_2 = Panel("0.650")
albedo_3 = Panel("0.700")
albedo_4 = Panel("0.650")
subtraction = Subtraction(A="1", B=albedo_3)
subtraction_2 = Subtraction(A="1", B=albedo)
subtraction_3 = Subtraction(A="1", B=albedo_2)
subtraction_4 = Subtraction(A="1", B=albedo_4)
opaquemat = HBOpaqueMaterial(
    name="Intonaco_esterno",
    thickness="0.02",
    conductivity="0.7",
    density="1500",
    spec_heat="1000",
    therm_absp="0.9",
    sol_absp=subtraction_3,
    vis_absp=subtraction_3)  # -> mat; plug-in component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
opaquemat_2 = HBOpaqueMaterial(
    name="Isolante",
    thickness="0.05",
    conductivity="0.045",
    density="100",
    spec_heat="840",
    therm_absp=albedo_3,
    sol_absp=subtraction,
    vis_absp=subtraction)  # -> mat; plug-in component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
opaquemat_3 = HBOpaqueMaterial(
    name="Mattoni_pieni",
    thickness="0.4",
    conductivity="0.78",
    density="1800",
    spec_heat="840",
    therm_absp="0.9",
    sol_absp=subtraction_2,
    vis_absp=subtraction_2)  # -> mat; plug-in component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
opaquemat_4 = HBOpaqueMaterial(
    name="Intonaco_interno",
    thickness="0.02",
    conductivity="0.7",
    density="1500",
    spec_heat="1000",
    therm_absp="0.9",
    sol_absp=subtraction_4,
    vis_absp=subtraction_4)  # -> mat; plug-in component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
panel_2 = Panel("Muratura_Mattoni_medio_isolante")
economical_cobenefit = Panel("EMPLOYMENT AND INCOME GENERATION")
social_cobenefit = Panel("HEALTH IMPACTS")
environmental_cobenefit = Panel("AIR QUALITY")
merge = Merge(Data1=opaquemat, Data2=opaquemat_2, Data3=opaquemat_3, Data4=opaquemat_4)
name = Data(panel_2)
albedo_5 = Panel("0.65")
thermalemissivity = Panel("0.90")
gwp = Panel("0")
name_2 = ClusterOutput(name)
opaqueconstr = HBOpaqueConstruction(name=panel_2, materials=merge)  # -> constr; plug-in component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
decnstrconstr = HBDeconstructConstruction(constr=opaqueconstr)  # -> materials, layers, r_val_si, r_val_ip, u_fac_si, u_fac_ip, shgc, t_sol, t_vis; plug-in component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
economic_cobenefit = Text(economical_cobenefit)
social_cobenefit_2 = Text(social_cobenefit)
albedo_6 = Number(albedo_5)
environmental_cobenefit_2 = Text(environmental_cobenefit)
thermalemissivity_2 = Number(thermalemissivity)
constr = ClusterOutput(opaqueconstr)
gwp_kg_co2_m2 = Number(gwp)
economic_cobenefit_2 = ClusterOutput(economic_cobenefit)
albedo_7 = ClusterOutput(albedo_6)
thermalemissivity_3 = ClusterOutput(thermalemissivity_2)
environmental_cobenefit_3 = ClusterOutput(environmental_cobenefit_2)
social_cobenefit_3 = ClusterOutput(social_cobenefit_2)
gwp_kg_co2_m2_2 = ClusterOutput(gwp_kg_co2_m2)
panel_3 = Panel(decnstrconstr.u_fac_si)
u_fac_si = ClusterOutput(decnstrconstr.u_fac_si)

# ==== cluster Muratura_mattoni_altamente_isolato
albedo = Panel("0.400")
albedo_2 = Panel("0.700")
albedo_3 = Panel("0.650")
albedo_4 = Panel("0.650")
subtraction = Subtraction(A="1", B=albedo_2)
subtraction_2 = Subtraction(A="1", B=albedo)
subtraction_3 = Subtraction(A="1", B=albedo_4)
subtraction_4 = Subtraction(A="1", B=albedo_3)
opaquemat = HBOpaqueMaterial(
    name="Intonaco_esterno",
    thickness="0.02",
    conductivity="0.7",
    density="1500",
    spec_heat="1000",
    therm_absp="0.9",
    sol_absp=subtraction_3,
    vis_absp=subtraction_3)  # -> mat; plug-in component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
opaquemat_2 = HBOpaqueMaterial(
    name="Isolante",
    thickness="0.1",
    conductivity="0.032",
    density="30",
    spec_heat="1250",
    therm_absp="0.1",
    sol_absp=subtraction,
    vis_absp=subtraction)  # -> mat; plug-in component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
opaquemat_3 = HBOpaqueMaterial(
    name="Mattoni_pieni",
    thickness="0.4",
    conductivity="0.78",
    density="1800",
    spec_heat="840",
    therm_absp="0.95",
    sol_absp=subtraction_2,
    vis_absp=subtraction_2)  # -> mat; plug-in component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
opaquemat_4 = HBOpaqueMaterial(
    name="Intonaco_interno",
    thickness="0.02",
    conductivity="0.7",
    density="1500",
    spec_heat="1000",
    therm_absp="0.9",
    sol_absp=subtraction_4,
    vis_absp=subtraction_4)  # -> mat; plug-in component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
panel = Panel("Muratura_Mattoni_isolante")
merge = Merge(Data1=opaquemat, Data2=opaquemat_2, Data3=opaquemat_3, Data4=opaquemat_4)
name = Data(panel)
name_2 = ClusterOutput(name)
economical_cobenefit = Panel("EMPLOYMENT AND INCOME GENERATION")
environmental_cobenefit = Panel("AIR QUALITY")
social_cobenefit = Panel("HEALTH IMPACTS")
opaqueconstr = HBOpaqueConstruction(name=panel, materials=merge)  # -> constr; plug-in component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
albedo_5 = Panel("0.65")
thermalemissivity = Panel("0.90")
gwp = Panel("0")
decnstrconstr = HBDeconstructConstruction(constr=opaqueconstr)  # -> materials, layers, r_val_si, r_val_ip, u_fac_si, u_fac_ip, shgc, t_sol, t_vis; plug-in component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
constr = ClusterOutput(opaqueconstr)
economic_cobenefit = Text(economical_cobenefit)
social_cobenefit_2 = Text(social_cobenefit)
albedo_6 = Number(albedo_5)
environmental_cobenefit_2 = Text(environmental_cobenefit)
thermalemissivity_2 = Number(thermalemissivity)
gwp_kg_co2_m2 = Number(gwp)
u_fac_si = ClusterOutput(decnstrconstr.u_fac_si)
economic_cobenefit_2 = ClusterOutput(economic_cobenefit)
panel_2 = Panel(decnstrconstr.u_fac_si)
albedo_7 = ClusterOutput(albedo_6)
thermalemissivity_3 = ClusterOutput(thermalemissivity_2)
environmental_cobenefit_3 = ClusterOutput(environmental_cobenefit_2)
social_cobenefit_3 = ClusterOutput(social_cobenefit_2)
gwp_kg_co2_m2_2 = ClusterOutput(gwp_kg_co2_m2)

# ==== cluster Muratura_laterizio_non_isolato
albedo = Panel("0.400")
albedo_2 = Panel("0.650")
albedo_3 = Panel("0.650")
# ENVIRONMENTAL: AIR QUALITY
# GHG EMISSIONS
# WATER RECOLLECTION AND SECURITY
# WATER QUALITY
# BIODIVERSITY
# LANDSLIDES AND WEATHERING
# SOCIAL: HEALTH IMPACTS
# PUBBLIC SPACE ACCESS
# AESTHETIC VALUE
# COMMUUNITY INCLUSION
# CULTURAL
# ECONOMIC: EMPLOYMENT AND INCOME GENERATION
# SAVINGS
# INNOVATION AND INVESTIMENT
# PROPERTY VALUE
panel = Panel("1")
subtraction = Subtraction(A="1", B=albedo)
subtraction_2 = Subtraction(A=panel, B=albedo_3)
subtraction_3 = Subtraction(A="1", B=albedo_2)
opaquemat = HBOpaqueMaterial(
    name="Laterizio_forato",
    thickness="0.3",
    conductivity="0.305",
    density="755",
    spec_heat="840",
    therm_absp="0.95",
    sol_absp=subtraction,
    vis_absp=subtraction)  # -> mat; plug-in component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
opaquemat_2 = HBOpaqueMaterial(
    name="Intonaco_interno",
    thickness="0.02",
    conductivity="0.7",
    density="1500",
    spec_heat="1000",
    therm_absp="0.9",
    sol_absp=subtraction_2,
    vis_absp=subtraction_2)  # -> mat; plug-in component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
opaquemat_3 = HBOpaqueMaterial(
    name="Intonaco_esterno",
    thickness="0.02",
    conductivity="0.7",
    density="1500",
    spec_heat="1000",
    therm_absp="0.9",
    sol_absp=subtraction_3,
    vis_absp=subtraction_3)  # -> mat; plug-in component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
merge = Merge(Data1=opaquemat_3, Data2=opaquemat, Data3=opaquemat_2)
panel_2 = Panel("Muratura_Laterizio_non_isolato")
economical_cobenefit = Panel("EMPLOYMENT AND INCOME GENERATION")
social_cobenefit = Panel("HEALTH IMPACTS")
environmental_cobenefit = Panel("AIR QUALITY")
thermalemissivity = Panel("0.90")
albedo_4 = Panel("0.65")
gwp = Panel("0")
opaqueconstr = HBOpaqueConstruction(name=panel_2, materials=merge)  # -> constr; plug-in component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
economic_cobenefit = Text(economical_cobenefit)
social_cobenefit_2 = Text(social_cobenefit)
albedo_5 = Number(albedo_4)
environmental_cobenefit_2 = Text(environmental_cobenefit)
thermalemissivity_2 = Number(thermalemissivity)
gwp_kg_co2_m2 = Number(gwp)
economic_cobenefit_2 = ClusterOutput(economic_cobenefit)
name = Data(panel_2)
albedo_6 = ClusterOutput(albedo_5)
thermalemissivity_3 = ClusterOutput(thermalemissivity_2)
constr = ClusterOutput(opaqueconstr)
environmental_cobenefit_3 = ClusterOutput(environmental_cobenefit_2)
social_cobenefit_3 = ClusterOutput(social_cobenefit_2)
gwp_kg_co2_m2_2 = ClusterOutput(gwp_kg_co2_m2)
name_2 = ClusterOutput(name)
decnstrconstr = HBDeconstructConstruction(constr=opaqueconstr)  # -> materials, layers, r_val_si, r_val_ip, u_fac_si, u_fac_ip, shgc, t_sol, t_vis; plug-in component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
panel_3 = Panel(decnstrconstr.u_fac_si)
u_fac_si = ClusterOutput(decnstrconstr.u_fac_si)

# ==== cluster Muratura_laterizio_isolato
albedo = Panel("0.7")
albedo_2 = Panel("0.650")
albedo_3 = Panel("0.650")
albedo_4 = Panel("0.400")
subtraction = Subtraction(A="1", B=albedo)
subtraction_2 = Subtraction(A="1", B=albedo_2)
subtraction_3 = Subtraction(A="1", B=albedo_4)
subtraction_4 = Subtraction(A="1", B=albedo_3)
opaquemat = HBOpaqueMaterial(
    name="Isolante",
    thickness="0.1",
    conductivity="0.032",
    density="30",
    spec_heat="1250",
    therm_absp="0.1",
    sol_absp=subtraction,
    vis_absp=subtraction)  # -> mat; plug-in component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
opaquemat_2 = HBOpaqueMaterial(
    name="Intonaco_esterno",
    thickness="0.02",
    conductivity="0.7",
    density="1500",
    spec_heat="1000",
    therm_absp="0.9",
    sol_absp=subtraction_2,
    vis_absp=subtraction_2)  # -> mat; plug-in component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
opaquemat_3 = HBOpaqueMaterial(
    name="Laterizio_forato",
    thickness="0.3",
    conductivity="0.305",
    density="755",
    spec_heat="840",
    therm_absp="0.95",
    sol_absp=subtraction_3,
    vis_absp=subtraction_3)  # -> mat; plug-in component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
opaquemat_4 = HBOpaqueMaterial(
    name="Intonaco_interno",
    thickness="0.02",
    conductivity="0.7",
    density="1500",
    spec_heat="1000",
    therm_absp="0.9",
    sol_absp=subtraction_4,
    vis_absp=subtraction_4)  # -> mat; plug-in component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
panel = Panel("Muratura_Laterizio_isolato")
merge = Merge(Data1=opaquemat_2, Data2=opaquemat, Data3=opaquemat_3, Data4=opaquemat_4)
economical_cobenefit = Panel("EMPLOYMENT AND INCOME GENERATION")
environmental_cobenefit = Panel("AIR QUALITY")
social_cobenefit = Panel("HEALTH IMPACTS")
thermalemissivity = Panel("0.90")
albedo_5 = Panel("0.65")
gwp = Panel("0")
opaqueconstr = HBOpaqueConstruction(name=panel, materials=merge)  # -> constr; plug-in component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
name = Data(panel)
decnstrconstr = HBDeconstructConstruction(constr=opaqueconstr)  # -> materials, layers, r_val_si, r_val_ip, u_fac_si, u_fac_ip, shgc, t_sol, t_vis; plug-in component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
economic_cobenefit = Text(economical_cobenefit)
constr = ClusterOutput(opaqueconstr)
social_cobenefit_2 = Text(social_cobenefit)
albedo_6 = Number(albedo_5)
environmental_cobenefit_2 = Text(environmental_cobenefit)
thermalemissivity_2 = Number(thermalemissivity)
gwp_kg_co2_m2 = Number(gwp)
economic_cobenefit_2 = ClusterOutput(economic_cobenefit)
albedo_7 = ClusterOutput(albedo_6)
thermalemissivity_3 = ClusterOutput(thermalemissivity_2)
environmental_cobenefit_3 = ClusterOutput(environmental_cobenefit_2)
social_cobenefit_3 = ClusterOutput(social_cobenefit_2)
u_fac_si = ClusterOutput(decnstrconstr.u_fac_si)
name_2 = ClusterOutput(name)
panel_2 = Panel(decnstrconstr.u_fac_si)
gwp_kg_co2_m2_2 = ClusterOutput(gwp_kg_co2_m2)

# ==== cluster Muratura_lateerizio_altamente_isolato
albedo = Panel("0.650")
albedo_2 = Panel("0.7")
albedo_3 = Panel("0.650")
albedo_4 = Panel("0.400")
subtraction = Subtraction(A="1", B=albedo_2)
subtraction_2 = Subtraction(A="1", B=albedo)
subtraction_3 = Subtraction(A="1", B=albedo_4)
subtraction_4 = Subtraction(A="1", B=albedo_3)
opaquemat = HBOpaqueMaterial(
    name="Isolante",
    thickness="0.14",
    conductivity="0.032",
    density="30",
    spec_heat="1250",
    therm_absp="0.1",
    sol_absp=subtraction,
    vis_absp=subtraction)  # -> mat; plug-in component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
opaquemat_2 = HBOpaqueMaterial(
    name="Intonaco_esterno",
    thickness="0.02",
    conductivity="0.7",
    density="1500",
    spec_heat="1000",
    therm_absp="0.9",
    sol_absp=subtraction_2,
    vis_absp=subtraction_2)  # -> mat; plug-in component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
opaquemat_3 = HBOpaqueMaterial(
    name="Laterizio_forato",
    thickness="0.3",
    conductivity="0.305",
    density="755",
    spec_heat="840",
    therm_absp="0.95",
    sol_absp=subtraction_3,
    vis_absp=subtraction_3)  # -> mat; plug-in component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
opaquemat_4 = HBOpaqueMaterial(
    name="Intonaco_interno",
    thickness="0.02",
    conductivity="0.7",
    density="1500",
    spec_heat="1000",
    therm_absp="0.9",
    sol_absp=subtraction_4,
    vis_absp=subtraction_4)  # -> mat; plug-in component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
panel = Panel("Muratura_Laterizio_molto_isolato")
merge = Merge(Data1=opaquemat_2, Data2=opaquemat, Data3=opaquemat_3, Data4=opaquemat_4)
economical_cobenefit = Panel("EMPLOYMENT AND INCOME GENERATION")
social_cobenefit = Panel("HEALTH IMPACTS")
environmental_cobenefit = Panel("AIR QUALITY")
gwp = Panel("0")
thermalemissivity = Panel("0.90")
albedo_5 = Panel("0.65")
opaqueconstr = HBOpaqueConstruction(name=panel, materials=merge)  # -> constr; plug-in component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
name = Data(panel)
economic_cobenefit = Text(economical_cobenefit)
gwp_kg_co2_m2 = Number(gwp)
social_cobenefit_2 = Text(social_cobenefit)
albedo_6 = Number(albedo_5)
environmental_cobenefit_2 = Text(environmental_cobenefit)
thermalemissivity_2 = Number(thermalemissivity)
decnstrconstr = HBDeconstructConstruction(constr=opaqueconstr)  # -> materials, layers, r_val_si, r_val_ip, u_fac_si, u_fac_ip, shgc, t_sol, t_vis; plug-in component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
constr = ClusterOutput(opaqueconstr)
name_2 = ClusterOutput(name)
economic_cobenefit_2 = ClusterOutput(economic_cobenefit)
albedo_7 = ClusterOutput(albedo_6)
thermalemissivity_3 = ClusterOutput(thermalemissivity_2)
environmental_cobenefit_3 = ClusterOutput(environmental_cobenefit_2)
social_cobenefit_3 = ClusterOutput(social_cobenefit_2)
gwp_kg_co2_m2_2 = ClusterOutput(gwp_kg_co2_m2)
panel_2 = Panel(decnstrconstr.u_fac_si)
u_fac_si = ClusterOutput(decnstrconstr.u_fac_si)

# ==== cluster Muratura_blocco_termico_isolato
albedo = Panel("0.650")
albedo_2 = Panel("0.400")
albedo_3 = Panel("0.7")
albedo_4 = Panel("0.650")
subtraction = Subtraction(A="1", B=albedo_3)
subtraction_2 = Subtraction(A="1", B=albedo)
subtraction_3 = Subtraction(A="1", B=albedo_2)
subtraction_4 = Subtraction(A="1", B=albedo_4)
opaquemat = HBOpaqueMaterial(
    name="Isolante",
    thickness="0.1",
    conductivity="0.032",
    density="30",
    spec_heat="1250",
    therm_absp="0.1",
    sol_absp=subtraction,
    vis_absp=subtraction)  # -> mat; plug-in component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
opaquemat_2 = HBOpaqueMaterial(
    name="Intonaco_esterno",
    thickness="0.02",
    conductivity="0.7",
    density="1500",
    spec_heat="1000",
    therm_absp="0.9",
    sol_absp=subtraction_2,
    vis_absp=subtraction_2)  # -> mat; plug-in component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
opaquemat_3 = HBOpaqueMaterial(
    name="Blocco_termico",
    thickness="0.3",
    conductivity="0.223",
    density="550",
    spec_heat="1000",
    therm_absp="0.95",
    sol_absp=subtraction_3,
    vis_absp=subtraction_3)  # -> mat; plug-in component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
opaquemat_4 = HBOpaqueMaterial(
    name="Intonaco_interno",
    thickness="0.02",
    conductivity="0.7",
    density="1500",
    spec_heat="1000",
    therm_absp="0.9",
    sol_absp=subtraction_4,
    vis_absp=subtraction_4)  # -> mat; plug-in component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
panel = Panel("Muratura_Blocco_termico_isolato")
economical_cobenefit = Panel("EMPLOYMENT AND INCOME GENERATION")
social_cobenefit = Panel("HEALTH IMPACTS")
environmental_cobenefit = Panel("AIR QUALITY")
merge = Merge(Data1=opaquemat_2, Data2=opaquemat, Data3=opaquemat_3, Data4=opaquemat_4)
gwp = Panel("0")
albedo_5 = Panel("0.65")
thermalemissivity = Panel("0.90")
name = Data(panel)
opaqueconstr = HBOpaqueConstruction(name=panel, materials=merge)  # -> constr; plug-in component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
economic_cobenefit = Text(economical_cobenefit)
social_cobenefit_2 = Text(social_cobenefit)
albedo_6 = Number(albedo_5)
environmental_cobenefit_2 = Text(environmental_cobenefit)
thermalemissivity_2 = Number(thermalemissivity)
gwp_kg_co2_m2 = Number(gwp)
name_2 = ClusterOutput(name)
decnstrconstr = HBDeconstructConstruction(constr=opaqueconstr)  # -> materials, layers, r_val_si, r_val_ip, u_fac_si, u_fac_ip, shgc, t_sol, t_vis; plug-in component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
economic_cobenefit_2 = ClusterOutput(economic_cobenefit)
constr = ClusterOutput(opaqueconstr)
albedo_7 = ClusterOutput(albedo_6)
thermalemissivity_3 = ClusterOutput(thermalemissivity_2)
environmental_cobenefit_3 = ClusterOutput(environmental_cobenefit_2)
social_cobenefit_3 = ClusterOutput(social_cobenefit_2)
gwp_kg_co2_m2_2 = ClusterOutput(gwp_kg_co2_m2)
u_fac_si = ClusterOutput(decnstrconstr.u_fac_si)
panel_2 = Panel(decnstrconstr.u_fac_si)

# ==== cluster Muratura_blocco_termico_altamente_isolato
panel = Panel("0.95")
albedo = Panel("0.650")
albedo_2 = Panel("0.650")
albedo_3 = Panel("0.400")
albedo_4 = Panel("0.7")
subtraction = Subtraction(A="1", B=albedo_4)
subtraction_2 = Subtraction(A="1", B=albedo_2)
subtraction_3 = Subtraction(A="1", B=albedo_3)
subtraction_4 = Subtraction(A="1", B=albedo)
opaquemat = HBOpaqueMaterial(
    name="Isolante",
    thickness="0.14",
    conductivity="0.032",
    density="30",
    spec_heat="1250",
    therm_absp="0.1",
    sol_absp=subtraction,
    vis_absp=subtraction)  # -> mat; plug-in component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
opaquemat_2 = HBOpaqueMaterial(
    name="Intonaco_esterno",
    thickness="0.02",
    conductivity="0.7",
    density="1500",
    spec_heat="1000",
    therm_absp="0.9",
    sol_absp=subtraction_2,
    vis_absp=subtraction_2)  # -> mat; plug-in component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
opaquemat_3 = HBOpaqueMaterial(
    name="Blocco_termico_EPS",
    thickness="0.3",
    conductivity="0.065",
    density="550",
    spec_heat="1000",
    therm_absp=albedo_3,
    sol_absp=subtraction_3,
    vis_absp=subtraction_3)  # -> mat; plug-in component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
opaquemat_4 = HBOpaqueMaterial(
    name="Intonaco_interno",
    thickness="0.02",
    conductivity="0.7",
    density="1500",
    spec_heat="1000",
    therm_absp="0.9",
    sol_absp=subtraction_4,
    vis_absp=subtraction_4)  # -> mat; plug-in component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
panel_2 = Panel("Muratura_Blocco_termico_molto_isolato")
merge = Merge(Data1=opaquemat_2, Data2=opaquemat, Data3=opaquemat_3, Data4=opaquemat_4)
economical_cobenefit = Panel("EMPLOYMENT AND INCOME GENERATION")
environmental_cobenefit = Panel("AIR QUALITY")
social_cobenefit = Panel("HEALTH IMPACTS")
gwp = Panel("0")
albedo_5 = Panel("0.65")
thermalemissivity = Panel("0.90")
name = Data(panel_2)
name_2 = ClusterOutput(name)
opaqueconstr = HBOpaqueConstruction(name=panel_2, materials=merge)  # -> constr; plug-in component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
economic_cobenefit = Text(economical_cobenefit)
social_cobenefit_2 = Text(social_cobenefit)
albedo_6 = Number(albedo_5)
environmental_cobenefit_2 = Text(environmental_cobenefit)
thermalemissivity_2 = Number(thermalemissivity)
gwp_kg_co2_m2 = Number(gwp)
decnstrconstr = HBDeconstructConstruction(constr=opaqueconstr)  # -> materials, layers, r_val_si, r_val_ip, u_fac_si, u_fac_ip, shgc, t_sol, t_vis; plug-in component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
constr = ClusterOutput(opaqueconstr)
economic_cobenefit_2 = ClusterOutput(economic_cobenefit)
albedo_7 = ClusterOutput(albedo_6)
thermalemissivity_3 = ClusterOutput(thermalemissivity_2)
environmental_cobenefit_3 = ClusterOutput(environmental_cobenefit_2)
social_cobenefit_3 = ClusterOutput(social_cobenefit_2)
gwp_kg_co2_m2_2 = ClusterOutput(gwp_kg_co2_m2)
panel_3 = Panel(decnstrconstr.u_fac_si)
u_fac_si = ClusterOutput(decnstrconstr.u_fac_si)

# ==== cluster Muratura_calcestruzzo_non_isolato
albedo = Panel("0.25")
albedo_2 = Panel("0.25")
albedo_3 = Panel("0.650")
albedo_4 = Panel("0.650")
subtraction = Subtraction(A="1", B=albedo_2)
subtraction_2 = Subtraction(A="1", B=albedo)
subtraction_3 = Subtraction(A="1", B=albedo_3)
subtraction_4 = Subtraction(A="1", B=albedo_4)
opaquemat = HBOpaqueMaterial(
    name="custom_air_gap",
    thickness="0.05",
    conductivity="0.278",
    density="1.28",
    spec_heat="1000",
    roughness="Smooth",
    therm_absp="0.9",
    sol_absp="0.7",
    vis_absp="0.7")  # -> mat; plug-in component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
opaquemat_2 = HBOpaqueMaterial(
    name="Calcestruzzo",
    thickness="0.2",
    conductivity="1.7",
    density="2400",
    spec_heat="1000",
    therm_absp="0.9",
    sol_absp=subtraction,
    vis_absp=subtraction)  # -> mat; plug-in component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
opaquemat_3 = HBOpaqueMaterial(
    name="Calcestruzzo",
    thickness="0.2",
    conductivity="1.7",
    density="2400",
    spec_heat="1000",
    therm_absp="0.9",
    sol_absp=subtraction_2,
    vis_absp=subtraction_2)  # -> mat; plug-in component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
opaquemat_4 = HBOpaqueMaterial(
    name="Intonaco_esterno",
    thickness="0.02",
    conductivity="0.7",
    density="1500",
    spec_heat="1000",
    therm_absp="0.9",
    sol_absp=subtraction_3,
    vis_absp=subtraction_3)  # -> mat; plug-in component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
opaquemat_5 = HBOpaqueMaterial(
    name="Intonaco_interno",
    thickness="0.02",
    conductivity="0.7",
    density="1500",
    spec_heat="1000",
    therm_absp="0.9",
    sol_absp=subtraction_4,
    vis_absp=subtraction_4)  # -> mat; plug-in component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
panel = Panel("Muratura_Calcestruzzo_non_isolato")
merge = Merge(Data1=opaquemat_4, Data2=opaquemat_3, Data3=opaquemat, Data4=opaquemat_2, Data5=opaquemat_5)
economical_cobenefit = Panel("EMPLOYMENT AND INCOME GENERATION")
environmental_cobenefit = Panel("AIR QUALITY")
social_cobenefit = Panel("HEALTH IMPACTS")
gwp = Panel("0")
thermalemissivity = Panel("0.90")
albedo_5 = Panel("0.65")
name = Data(panel)
opaqueconstr = HBOpaqueConstruction(name=panel, materials=merge)  # -> constr; plug-in component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
name_2 = ClusterOutput(name)
decnstrconstr = HBDeconstructConstruction(constr=opaqueconstr)  # -> materials, layers, r_val_si, r_val_ip, u_fac_si, u_fac_ip, shgc, t_sol, t_vis; plug-in component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
constr = ClusterOutput(opaqueconstr)
economic_cobenefit = Text(economical_cobenefit)
gwp_kg_co2_m2 = Number(gwp)
social_cobenefit_2 = Text(social_cobenefit)
albedo_6 = Number(albedo_5)
environmental_cobenefit_2 = Text(environmental_cobenefit)
thermalemissivity_2 = Number(thermalemissivity)
economic_cobenefit_2 = ClusterOutput(economic_cobenefit)
albedo_7 = ClusterOutput(albedo_6)
thermalemissivity_3 = ClusterOutput(thermalemissivity_2)
environmental_cobenefit_3 = ClusterOutput(environmental_cobenefit_2)
gwp_kg_co2_m2_2 = ClusterOutput(gwp_kg_co2_m2)
social_cobenefit_3 = ClusterOutput(social_cobenefit_2)
u_fac_si = ClusterOutput(decnstrconstr.u_fac_si)
panel_2 = Panel(decnstrconstr.u_fac_si)

# ==== cluster Muratura_calcestruzzo_medio_isolato_esterno
albedo = Panel("0.650")
albedo_2 = Panel("0.7")
albedo_3 = Panel("0.25")
albedo_4 = Panel("0.25")
albedo_5 = Panel("0.650")
subtraction = Subtraction(A="1", B=albedo_2)
subtraction_2 = Subtraction(A="1", B=albedo)
subtraction_3 = Subtraction(A="1", B=albedo_3)
subtraction_4 = Subtraction(A="1", B=albedo_4)
subtraction_5 = Subtraction(A="1", B=albedo_5)
opaquemat = HBOpaqueMaterial(
    name="Isolante",
    thickness="0.05",
    conductivity="0.045",
    density="100",
    spec_heat="840",
    therm_absp="0.1",
    sol_absp=subtraction,
    vis_absp=subtraction)  # -> mat; plug-in component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
opaquemat_2 = HBOpaqueMaterial(
    name="Calcestruzzo",
    thickness="0.2",
    conductivity="1.7",
    density="2400",
    spec_heat="1000",
    therm_absp="0.9",
    sol_absp=subtraction_4,
    vis_absp=subtraction_4)  # -> mat; plug-in component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
opaquemat_3 = HBOpaqueMaterial(
    name="Intonaco_esterno",
    thickness="0.02",
    conductivity="0.7",
    density="1500",
    spec_heat="1000",
    therm_absp="0.9",
    sol_absp=subtraction_2,
    vis_absp=subtraction_2)  # -> mat; plug-in component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
opaquemat_4 = HBOpaqueMaterial(
    name="custom_air_gap",
    thickness="0.05",
    conductivity="0.278",
    density="1.28",
    spec_heat="1000",
    roughness="Smooth",
    therm_absp="0.9",
    sol_absp="0.7",
    vis_absp="0.7")  # -> mat; plug-in component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
opaquemat_5 = HBOpaqueMaterial(
    name="Calcestruzzo",
    thickness="0.2",
    conductivity="1.7",
    density="2400",
    spec_heat="1000",
    therm_absp="0.9",
    sol_absp=subtraction_3,
    vis_absp=subtraction_3)  # -> mat; plug-in component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
opaquemat_6 = HBOpaqueMaterial(
    name="Intonaco_interno",
    thickness="0.02",
    conductivity="0.7",
    density="1500",
    spec_heat="1000",
    therm_absp="0.9",
    sol_absp=subtraction_5,
    vis_absp=subtraction_5)  # -> mat; plug-in component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
panel = Panel("Muratura_Calcestruzzo_medio_isolato_esterno")
economical_cobenefit = Panel("EMPLOYMENT AND INCOME GENERATION")
environmental_cobenefit = Panel("AIR QUALITY")
social_cobenefit = Panel("HEALTH IMPACTS")
merge = Merge(Data1=opaquemat_3, Data2=opaquemat, Data3=opaquemat_2, Data4=opaquemat_4, Data5=opaquemat_5, Data6=opaquemat_6)
gwp = Panel("0")
thermalemissivity = Panel("0.90")
albedo_6 = Panel("0.65")
opaqueconstr = HBOpaqueConstruction(name=panel, materials=merge)  # -> constr; plug-in component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
name = Data(panel)
name_2 = ClusterOutput(name)
economic_cobenefit = Text(economical_cobenefit)
gwp_kg_co2_m2 = Number(gwp)
social_cobenefit_2 = Text(social_cobenefit)
albedo_7 = Number(albedo_6)
decnstrconstr = HBDeconstructConstruction(constr=opaqueconstr)  # -> materials, layers, r_val_si, r_val_ip, u_fac_si, u_fac_ip, shgc, t_sol, t_vis; plug-in component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
environmental_cobenefit_2 = Text(environmental_cobenefit)
thermalemissivity_2 = Number(thermalemissivity)
constr = ClusterOutput(opaqueconstr)
economic_cobenefit_2 = ClusterOutput(economic_cobenefit)
albedo_8 = ClusterOutput(albedo_7)
thermalemissivity_3 = ClusterOutput(thermalemissivity_2)
environmental_cobenefit_3 = ClusterOutput(environmental_cobenefit_2)
social_cobenefit_3 = ClusterOutput(social_cobenefit_2)
gwp_kg_co2_m2_2 = ClusterOutput(gwp_kg_co2_m2)
u_fac_si = ClusterOutput(decnstrconstr.u_fac_si)
panel_2 = Panel(decnstrconstr.u_fac_si)

# ==== cluster Muratura_calcestruzzo_medio_isolato_interno
albedo = Panel("0.650")
albedo_2 = Panel("0.25")
albedo_3 = Panel("0.7")
albedo_4 = Panel("0.650")
albedo_5 = Panel("0.25")
subtraction = Subtraction(A="1", B=albedo_2)
subtraction_2 = Subtraction(A="1", B=albedo)
subtraction_3 = Subtraction(A="1", B=albedo_3)
subtraction_4 = Subtraction(A="1", B=albedo_5)
subtraction_5 = Subtraction(A="1", B=albedo_4)
opaquemat = HBOpaqueMaterial(
    name="Calcestruzzo",
    thickness="0.2",
    conductivity="1.7",
    density="2400",
    spec_heat="1000",
    therm_absp="0.9",
    sol_absp=subtraction,
    vis_absp=subtraction)  # -> mat; plug-in component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
opaquemat_2 = HBOpaqueMaterial(
    name="Intonaco_esterno",
    thickness="0.02",
    conductivity="0.7",
    density="1500",
    spec_heat="1000",
    therm_absp="0.9",
    sol_absp=subtraction_2,
    vis_absp=subtraction_2)  # -> mat; plug-in component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
opaquemat_3 = HBOpaqueMaterial(
    name="Isolante",
    thickness="0.05",
    conductivity="0.045",
    density="100",
    spec_heat="840",
    therm_absp="0.1",
    sol_absp=subtraction_3,
    vis_absp=subtraction_3)  # -> mat; plug-in component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
opaquemat_4 = HBOpaqueMaterial(
    name="Calcestruzzo",
    thickness="0.2",
    conductivity="1.7",
    density="2400",
    spec_heat="1000",
    therm_absp="0.9",
    sol_absp=subtraction_4,
    vis_absp=subtraction_4)  # -> mat; plug-in component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
opaquemat_5 = HBOpaqueMaterial(
    name="Intonaco_interno",
    thickness="0.02",
    conductivity="0.7",
    density="1500",
    spec_heat="1000",
    therm_absp="0.9",
    sol_absp=subtraction_5,
    vis_absp=subtraction_5)  # -> mat; plug-in component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
panel = Panel("Muratura_Calcestruzzo_medio_isolato_interno")
economical_cobenefit = Panel("EMPLOYMENT AND INCOME GENERATION")
environmental_cobenefit = Panel("AIR QUALITY")
social_cobenefit = Panel("HEALTH IMPACTS")
merge = Merge(Data1=opaquemat_2, Data2=opaquemat, Data3=opaquemat_3, Data4=opaquemat_4, Data5=opaquemat_5)
albedo_6 = Panel("0.65")
thermalemissivity = Panel("0.90")
gwp = Panel("0")
name = Data(panel)
opaqueconstr = HBOpaqueConstruction(name=panel, materials=merge)  # -> constr; plug-in component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
name_2 = ClusterOutput(name)
economic_cobenefit = Text(economical_cobenefit)
social_cobenefit_2 = Text(social_cobenefit)
albedo_7 = Number(albedo_6)
environmental_cobenefit_2 = Text(environmental_cobenefit)
thermalemissivity_2 = Number(thermalemissivity)
decnstrconstr = HBDeconstructConstruction(constr=opaqueconstr)  # -> materials, layers, r_val_si, r_val_ip, u_fac_si, u_fac_ip, shgc, t_sol, t_vis; plug-in component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
gwp_kg_co2_m2 = Number(gwp)
economic_cobenefit_2 = ClusterOutput(economic_cobenefit)
albedo_8 = ClusterOutput(albedo_7)
constr = ClusterOutput(opaqueconstr)
thermalemissivity_3 = ClusterOutput(thermalemissivity_2)
environmental_cobenefit_3 = ClusterOutput(environmental_cobenefit_2)
social_cobenefit_3 = ClusterOutput(social_cobenefit_2)
gwp_kg_co2_m2_2 = ClusterOutput(gwp_kg_co2_m2)
panel_2 = Panel(decnstrconstr.u_fac_si)
u_fac_si = ClusterOutput(decnstrconstr.u_fac_si)

# ==== cluster Muratura_calcestruzzo_altamente_isolato
albedo = Panel("0.7")
albedo_2 = Panel("0.25")
albedo_3 = Panel("0.650")
albedo_4 = Panel("0.650")
albedo_5 = Panel("0.25")
subtraction = Subtraction(A="1", B=albedo_2)
subtraction_2 = Subtraction(A="1", B=albedo)
subtraction_3 = Subtraction(A="1", B=albedo_3)
subtraction_4 = Subtraction(A="1", B=albedo_5)
subtraction_5 = Subtraction(A="1", B=albedo_4)
opaquemat = HBOpaqueMaterial(
    name="custom_air_gap",
    thickness="0.05",
    conductivity="0.278",
    density="1.28",
    spec_heat="1000",
    roughness="Smooth",
    therm_absp="0.9",
    sol_absp="0.7",
    vis_absp="0.7")  # -> mat; plug-in component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
opaquemat_2 = HBOpaqueMaterial(
    name="Calcestruzzo",
    thickness="0.2",
    conductivity="1.7",
    density="2400",
    spec_heat="1000",
    therm_absp="0.9",
    sol_absp=subtraction,
    vis_absp=subtraction)  # -> mat; plug-in component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
opaquemat_3 = HBOpaqueMaterial(
    name="Isolante",
    thickness="0.1",
    conductivity="0.032",
    density="30",
    spec_heat="1250",
    therm_absp="0.1",
    sol_absp=subtraction_2,
    vis_absp=subtraction_2)  # -> mat; plug-in component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
opaquemat_4 = HBOpaqueMaterial(
    name="Calcestruzzo",
    thickness="0.2",
    conductivity="1.7",
    density="2400",
    spec_heat="1000",
    therm_absp="0.9",
    sol_absp=subtraction_4,
    vis_absp=subtraction_4)  # -> mat; plug-in component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
opaquemat_5 = HBOpaqueMaterial(
    name="Intonaco_esterno",
    thickness="0.02",
    conductivity="0.7",
    density="1500",
    spec_heat="1000",
    therm_absp="0.9",
    sol_absp=subtraction_3,
    vis_absp=subtraction_3)  # -> mat; plug-in component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
opaquemat_6 = HBOpaqueMaterial(
    name="Intonaco_interno",
    thickness="0.02",
    conductivity="0.7",
    density="1500",
    spec_heat="1000",
    therm_absp="0.9",
    sol_absp=subtraction_5,
    vis_absp=subtraction_5)  # -> mat; plug-in component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
economical_cobenefit = Panel("EMPLOYMENT AND INCOME GENERATION")
social_cobenefit = Panel("HEALTH IMPACTS")
environmental_cobenefit = Panel("AIR QUALITY")
panel = Panel("Muratura_Calcestruzzo_isolato")
thermalemissivity = Panel("0.90")
albedo_6 = Panel("0.65")
gwp = Panel("0")
merge = Merge(Data1=opaquemat_5, Data2=opaquemat_3, Data3=opaquemat_4, Data4=opaquemat, Data5=opaquemat_2, Data6=opaquemat_6)
name = Data(panel)
name_2 = ClusterOutput(name)
opaqueconstr = HBOpaqueConstruction(name=panel, materials=merge)  # -> constr; plug-in component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
economic_cobenefit = Text(economical_cobenefit)
social_cobenefit_2 = Text(social_cobenefit)
albedo_7 = Number(albedo_6)
environmental_cobenefit_2 = Text(environmental_cobenefit)
thermalemissivity_2 = Number(thermalemissivity)
gwp_kg_co2_m2 = Number(gwp)
economic_cobenefit_2 = ClusterOutput(economic_cobenefit)
albedo_8 = ClusterOutput(albedo_7)
thermalemissivity_3 = ClusterOutput(thermalemissivity_2)
environmental_cobenefit_3 = ClusterOutput(environmental_cobenefit_2)
social_cobenefit_3 = ClusterOutput(social_cobenefit_2)
constr = ClusterOutput(opaqueconstr)
decnstrconstr = HBDeconstructConstruction(constr=opaqueconstr)  # -> materials, layers, r_val_si, r_val_ip, u_fac_si, u_fac_ip, shgc, t_sol, t_vis; plug-in component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
gwp_kg_co2_m2_2 = ClusterOutput(gwp_kg_co2_m2)
u_fac_si = ClusterOutput(decnstrconstr.u_fac_si)
panel_2 = Panel(decnstrconstr.u_fac_si)

# ==== cluster PACCHETTOLEGNOASECCO
subtraction = Subtraction(A="1", B="0.7")
opaquemat = HBOpaqueMaterial(
    name="Tavolato legno grezzo",
    thickness="0.024",
    conductivity="0.26",
    density="1350",
    spec_heat="1880",
    sol_absp=subtraction,
    vis_absp=subtraction)  # -> mat; plug-in component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
opaquemat_2 = HBOpaqueMaterial(name="Fibra di legno Fibertherm® Protect 230", thickness="0.06", conductivity="0.046", density="230", spec_heat="2100")  # -> mat; plug-in component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
opaquemat_3 = HBOpaqueMaterial(name="Fibra di legno Fibertherm® Protect 230", thickness="0.06", conductivity="0.046", density="230", spec_heat="2100")  # -> mat; plug-in component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
opaquemat_4 = HBOpaqueMaterial(name="Lastra in gessofibra", thickness="0.0125", conductivity="0.32", density="1180", spec_heat="1100")  # -> mat; plug-in component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
opaquemat_5 = HBOpaqueMaterial(name="XLAM", thickness="0.12", conductivity="0.12", density="470", spec_heat="1600")  # -> mat; plug-in component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
panel = Panel(opaquemat)
panel_2 = Panel(opaquemat_5)
panel_3 = Panel(opaquemat_2)
panel_4 = Panel(opaquemat_3)
panel_5 = Panel(opaquemat_4)
economical_cobenefit = Panel("EMPLOYMENT AND INCOME GENERATION")
environmental_cobenefit = Panel("AIR QUALITY")
social_cobenefit = Panel("HEALTH IMPACTS")
merge = Merge(Data1=opaquemat, Data2=opaquemat_2, Data3=opaquemat_5, Data4=opaquemat_3, Data5=opaquemat_4)
gwp = Panel("-20")
albedo = Panel("0.65")
thermalemissivity = Panel("0.90")
opaqueconstr = HBOpaqueConstruction(name="Parete legno a secco", materials=merge)  # -> constr; plug-in component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
constr = ClusterOutput(opaqueconstr)
name = Text("Parete legno a secco")
economic_cobenefit = Text(economical_cobenefit)
social_cobenefit_2 = Text(social_cobenefit)
albedo_2 = Number(albedo)
environmental_cobenefit_2 = Text(environmental_cobenefit)
thermalemissivity_2 = Number(thermalemissivity)
gwp_kg_co2_m2 = Number(gwp)
decnstrconstr = HBDeconstructConstruction(constr=opaqueconstr)  # -> materials, layers, r_val_si, r_val_ip, u_fac_si, u_fac_ip, shgc, t_sol, t_vis; plug-in component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
economic_cobenefit_2 = ClusterOutput(economic_cobenefit)
albedo_3 = ClusterOutput(albedo_2)
name_2 = ClusterOutput(name)
thermalemissivity_3 = ClusterOutput(thermalemissivity_2)
environmental_cobenefit_3 = ClusterOutput(environmental_cobenefit_2)
social_cobenefit_3 = ClusterOutput(social_cobenefit_2)
gwp_kg_co2_m2_2 = ClusterOutput(gwp_kg_co2_m2)
panel_6 = Panel(decnstrconstr.u_fac_si)
u_fac_si = ClusterOutput(decnstrconstr.u_fac_si)

# ==== cluster PACCHETTOACCIAIO
subtraction = Subtraction(A="1", B="0.5")
opaquemat = HBOpaqueMaterial(
    name="PACCHETTO ACCIAIO",
    thickness="0.252",
    conductivity="0.0665",
    density="72.5",
    spec_heat="2000",
    sol_absp=subtraction,
    vis_absp=subtraction)  # -> mat; plug-in component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
economical_cobenefit = Panel("EMPLOYMENT AND INCOME GENERATION")
social_cobenefit = Panel("HEALTH IMPACTS")
environmental_cobenefit = Panel("AIR QUALITY")
gwp = Panel("20")
thermalemissivity = Panel("0.90")
albedo = Panel("0.50")
opaqueconstr = HBOpaqueConstruction(name="Parete acciaio", materials=opaquemat)  # -> constr; plug-in component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
name = Text("Parete acciaio")
name_2 = ClusterOutput(name)
constr = ClusterOutput(opaqueconstr)
economic_cobenefit = Text(economical_cobenefit)
social_cobenefit_2 = Text(social_cobenefit)
albedo_2 = Number(albedo)
environmental_cobenefit_2 = Text(environmental_cobenefit)
thermalemissivity_2 = Number(thermalemissivity)
gwp_kg_co2_m2 = Number(gwp)
decnstrconstr = HBDeconstructConstruction(constr=opaqueconstr)  # -> materials, layers, r_val_si, r_val_ip, u_fac_si, u_fac_ip, shgc, t_sol, t_vis; plug-in component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
economic_cobenefit_2 = ClusterOutput(economic_cobenefit)
albedo_3 = ClusterOutput(albedo_2)
thermalemissivity_3 = ClusterOutput(thermalemissivity_2)
environmental_cobenefit_3 = ClusterOutput(environmental_cobenefit_2)
social_cobenefit_3 = ClusterOutput(social_cobenefit_2)
gwp_kg_co2_m2_2 = ClusterOutput(gwp_kg_co2_m2)
panel = Panel(decnstrconstr.u_fac_si)
u_fac_si = ClusterOutput(decnstrconstr.u_fac_si)

# ==== cluster PACCHETTOLEGNOAUMIDO
subtraction = Subtraction(A="1", B="0.7")

# ---- group: LEGNO
opaquemat = HBOpaqueMaterial(name="XLAM", thickness="0.15", conductivity="0.12", density="470", spec_heat="1600")  # -> mat; plug-in component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
opaquemat_2 = HBOpaqueMaterial(name="Mapetherm ar1gg", thickness="0.01", conductivity="0.32", density="1400", spec_heat="700")  # -> mat; plug-in component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
opaquemat_3 = HBOpaqueMaterial(name="Fibra di legno Fibertherm® Protect 230", thickness="0.12", conductivity="0.046", density="230", spec_heat="2100")  # -> mat; plug-in component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
opaquemat_4 = HBOpaqueMaterial(name="Mapetherm ar1gg", thickness="0.01", conductivity="0.32", density="1400", spec_heat="700")  # -> mat; plug-in component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
opaquemat_5 = HBOpaqueMaterial(
    name="Quarzolite Tonachino",
    thickness="0.02",
    conductivity="0.89",
    density="1650",
    spec_heat="1000",
    sol_absp=subtraction,
    vis_absp=subtraction)  # -> mat; plug-in component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
panel = Panel(opaquemat)
panel_2 = Panel(opaquemat_5)
panel_3 = Panel(opaquemat_2)
panel_4 = Panel(opaquemat_3)
panel_5 = Panel(opaquemat_4)

# ----
economical_cobenefit = Panel("EMPLOYMENT AND INCOME GENERATION")
environmental_cobenefit = Panel("AIR QUALITY")
social_cobenefit = Panel("HEALTH IMPACTS")
merge = Merge(Data1=opaquemat_5, Data2=opaquemat_4, Data3=opaquemat_3, Data4=opaquemat_2, Data5=opaquemat)
gwp = Panel("-24")
thermalemissivity = Panel("0.90")
albedo = Panel("0.70")
opaqueconstr = HBOpaqueConstruction(name="Parete legno a umido", materials=merge)  # -> constr; plug-in component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
name = Text("Parete legno a umido")
name_2 = ClusterOutput(name)
economic_cobenefit = Text(economical_cobenefit)
social_cobenefit_2 = Text(social_cobenefit)
albedo_2 = Number(albedo)
constr = ClusterOutput(opaqueconstr)
environmental_cobenefit_2 = Text(environmental_cobenefit)
decnstrconstr = HBDeconstructConstruction(constr=opaqueconstr)  # -> materials, layers, r_val_si, r_val_ip, u_fac_si, u_fac_ip, shgc, t_sol, t_vis; plug-in component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
thermalemissivity_2 = Number(thermalemissivity)
gwp_kg_co2_m2 = Number(gwp)
economic_cobenefit_2 = ClusterOutput(economic_cobenefit)
albedo_3 = ClusterOutput(albedo_2)
thermalemissivity_3 = ClusterOutput(thermalemissivity_2)
environmental_cobenefit_3 = ClusterOutput(environmental_cobenefit_2)
social_cobenefit_3 = ClusterOutput(social_cobenefit_2)
gwp_kg_co2_m2_2 = ClusterOutput(gwp_kg_co2_m2)
panel_6 = Panel(decnstrconstr.u_fac_si)
u_fac_si = ClusterOutput(decnstrconstr.u_fac_si)

# ==== cluster PACCHETTOCALCESTRUZZOPARETEVENTILATA
subtraction = Subtraction(A="1", B="0.6")

# ---- group: PACCHETTO CALCESTRUZZO CON PARETE VENTILATA
opaquemat = HBOpaqueMaterial(name="intonaco interno", thickness="0.02", conductivity="0.7", density="1500", spec_heat="1000")  # -> mat; plug-in component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
opaquemat_2 = HBOpaqueMaterial(name="Blocco Termico", thickness="0.3", conductivity="0.223", density="550", spec_heat="1000")  # -> mat; plug-in component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
opaquemat_3 = HBOpaqueMaterial(name="Quarzolite Base Coat", thickness="0.002", conductivity="1", density="1580", spec_heat="1000")  # -> mat; plug-in component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
opaquemat_4 = HBOpaqueMaterial(name="Quarzolite Tonachino", thickness="0.02", conductivity="0.89", density="1650", spec_heat="1000", sol_absp="0.7")  # -> mat; plug-in component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
opaquemat_5 = HBOpaqueMaterial(
    name="Acquapanel outdoor",
    thickness="0.0125",
    conductivity="0.35",
    density="1150",
    spec_heat="1000",
    sol_absp=subtraction,
    vis_absp=subtraction)  # -> mat; plug-in component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
opaquemat_6 = HBOpaqueMaterial(name="Mapetherm EPS 100 CAM", thickness="0.1", conductivity="0.035", density="1000", spec_heat="1260")  # -> mat; plug-in component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
opaquemat_7 = HBOpaqueMaterial(name="Camera d'aria", thickness="0.1", conductivity="0.08", density="1225", spec_heat="1005")  # -> mat; plug-in component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
panel = Panel(opaquemat)
panel_2 = Panel(opaquemat_5)
panel_3 = Panel(opaquemat_2)
panel_4 = Panel(opaquemat_4)
panel_5 = Panel(opaquemat_3)
panel_6 = Panel(opaquemat_6)
panel_7 = Panel(opaquemat_7)

# ----
economical_cobenefit = Panel("EMPLOYMENT AND INCOME GENERATION")
environmental_cobenefit = Panel("AIR QUALITY")
social_cobenefit = Panel("HEALTH IMPACTS")
merge = Merge(
    Data1=opaquemat_5,
    Data2=opaquemat_7,
    Data3=opaquemat_6,
    Data4=opaquemat_4,
    Data5=opaquemat_3,
    Data6=opaquemat_2,
    Data7=opaquemat)
panel_8 = Panel("Parete calcestruzzo con camera d'aria")
albedo = Panel("0.60")
thermalemissivity = Panel("0.90")
gwp = Panel("9.29")
opaqueconstr = HBOpaqueConstruction(name=panel_8, materials=merge)  # -> constr; plug-in component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
name = Text(panel_8)
economic_cobenefit = Text(economical_cobenefit)
social_cobenefit_2 = Text(social_cobenefit)
albedo_2 = Number(albedo)
environmental_cobenefit_2 = Text(environmental_cobenefit)
thermalemissivity_2 = Number(thermalemissivity)
gwp_kg_co2_m2 = Number(gwp)
constr = ClusterOutput(opaqueconstr)
economic_cobenefit_2 = ClusterOutput(economic_cobenefit)
albedo_3 = ClusterOutput(albedo_2)
thermalemissivity_3 = ClusterOutput(thermalemissivity_2)
name_2 = ClusterOutput(name)
environmental_cobenefit_3 = ClusterOutput(environmental_cobenefit_2)
social_cobenefit_3 = ClusterOutput(social_cobenefit_2)
decnstrconstr = HBDeconstructConstruction(constr=opaqueconstr)  # -> materials, layers, r_val_si, r_val_ip, u_fac_si, u_fac_ip, shgc, t_sol, t_vis; plug-in component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
gwp_kg_co2_m2_2 = ClusterOutput(gwp_kg_co2_m2)
u_fac_si = ClusterOutput(decnstrconstr.u_fac_si)
panel_9 = Panel(decnstrconstr.materials)

# ==== cluster PACCHETTOCALCESTRUZZO
economical_cobenefit = Panel("EMPLOYMENT AND INCOME GENERATION")
environmental_cobenefit = Panel("AIR QUALITY")
social_cobenefit = Panel("HEALTH IMPACTS")
albedo = Panel("0.70")
thermalemissivity = Panel("0.90")
gwp = Panel("5.71")
name = Text("Parete calcestruzzo")
economic_cobenefit = Text(economical_cobenefit)
social_cobenefit_2 = Text(social_cobenefit)
albedo_2 = Number(albedo)
name_2 = ClusterOutput(name)
environmental_cobenefit_2 = Text(environmental_cobenefit)
thermalemissivity_2 = Number(thermalemissivity)
gwp_kg_co2_m2 = Number(gwp)
economic_cobenefit_2 = ClusterOutput(economic_cobenefit)
albedo_3 = ClusterOutput(albedo_2)
thermalemissivity_3 = ClusterOutput(thermalemissivity_2)
environmental_cobenefit_3 = ClusterOutput(environmental_cobenefit_2)
social_cobenefit_3 = ClusterOutput(social_cobenefit_2)
gwp_kg_co2_m2_2 = ClusterOutput(gwp_kg_co2_m2)

# ---- group: PACCHETTO CALCESTRUZZO
panel = Panel("0.7")
panel_2 = Panel("0.002")
opaquemat = HBOpaqueMaterial(name="Quarzolite Base Coat", thickness=panel_2, conductivity="1", density="1580", spec_heat="1000")  # -> mat; plug-in component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
opaquemat_2 = HBOpaqueMaterial(name="Mapetherm ar1gg", thickness="0.01", conductivity="0.32", density="1400", spec_heat="700")  # -> mat; plug-in component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
opaquemat_3 = HBOpaqueMaterial(name="Blocco Termico", thickness="0.3", conductivity="0.223", density="550", spec_heat="1000")  # -> mat; plug-in component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
opaquemat_4 = HBOpaqueMaterial(name="Nivoplan+Planicrete", thickness="0.02", conductivity="0.95", density="1830", spec_heat="700")  # -> mat; plug-in component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
opaquemat_5 = HBOpaqueMaterial(name="Mapetherm ar1gg", thickness="0.01", conductivity="0.32", density="1400", spec_heat="700")  # -> mat; plug-in component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
opaquemat_6 = HBOpaqueMaterial(name="Mapetherm EPS 100 CAM", thickness="0.1", conductivity="0.035", density="1000", spec_heat="1260")  # -> mat; plug-in component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
opaquemat_7 = HBOpaqueMaterial(name="intonaco interno", thickness="0.02", conductivity="0.7", density="1500", spec_heat="1000")  # -> mat; plug-in component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
panel_3 = Panel(opaquemat)
panel_4 = Panel(opaquemat_2)
panel_5 = Panel(opaquemat_6)
panel_6 = Panel(opaquemat_4)
panel_7 = Panel(opaquemat_7)
panel_8 = Panel(opaquemat_5)
panel_9 = Panel(opaquemat_3)

# ----
subtraction = Subtraction(A="1", B=panel)
num = Number(panel_2)

# ---- group: PACCHETTO CALCESTRUZZO (continued)
opaquemat_8 = HBOpaqueMaterial(
    name="Quarzolite Tonachino",
    thickness="0.02",
    conductivity="0.89",
    density="1650",
    spec_heat="1000",
    sol_absp=subtraction,
    vis_absp=subtraction)  # -> mat; plug-in component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
panel_10 = Panel(opaquemat_8)

# ----
merge = Merge(
    Data1=opaquemat_8,
    Data2=opaquemat,
    Data3=opaquemat_2,
    Data4=opaquemat_6,
    Data5=opaquemat_5,
    Data6=opaquemat_4,
    Data7=opaquemat_3,
    Data8=opaquemat_7)
opaqueconstr = HBOpaqueConstruction(name="Parete calcestruzzo", materials=merge)  # -> constr; plug-in component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
constr = ClusterOutput(opaqueconstr)
decnstrconstr = HBDeconstructConstruction(constr=opaqueconstr)  # -> materials, layers, r_val_si, r_val_ip, u_fac_si, u_fac_ip, shgc, t_sol, t_vis; plug-in component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
u_fac_si = ClusterOutput(decnstrconstr.u_fac_si)
panel_11 = Panel(decnstrconstr.u_fac_si)
panel_12 = Panel(decnstrconstr.materials)

# ==== cluster Solaio_legno_non_isolato
subtraction = Subtraction(A="1", B="0.15")
subtraction_2 = Subtraction(A="1", B="0.4")
opaquemat = HBOpaqueMaterial(
    name="custom_air_gap",
    thickness="0.02",
    conductivity="0.125",
    density="1.28",
    spec_heat="1000",
    roughness="Smooth",
    therm_absp="0.9",
    sol_absp="0.7",
    vis_absp="0.7")  # -> mat; plug-in component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
opaquemat_2 = HBOpaqueMaterial(
    name="Tavolato_legno",
    thickness="0.04",
    conductivity="0.120",
    density="450",
    spec_heat="2200",
    therm_absp="0.85",
    sol_absp=subtraction,
    vis_absp=subtraction)  # -> mat; plug-in component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
opaquemat_3 = HBOpaqueMaterial(
    name="Tegole",
    thickness="0.02",
    conductivity="0.575",
    density="1350",
    spec_heat="840",
    therm_absp="0.91",
    sol_absp=subtraction_2,
    vis_absp=subtraction_2)  # -> mat; plug-in component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
panel = Panel("Solaio_Legno_non_isolato")
merge = Merge(Data1=opaquemat_3, Data2=opaquemat, Data3=opaquemat_2)
economical_cobenefit = Panel("")
environmental_cobenefit = Panel("")
social_cobenefit = Panel("")
albedo = Panel("0.4")
thermalemissivity = Panel("0.91")
gwp = Panel("0")
opaqueconstr = HBOpaqueConstruction(name=panel, materials=merge)  # -> constr; plug-in component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
name = Text(panel)
economic_cobenefit = Text(economical_cobenefit)
decnstrconstr = HBDeconstructConstruction(constr=opaqueconstr)  # -> materials, layers, r_val_si, r_val_ip, u_fac_si, u_fac_ip, shgc, t_sol, t_vis; plug-in component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
social_cobenefit_2 = Text(social_cobenefit)
albedo_2 = Number(albedo)
environmental_cobenefit_2 = Text(environmental_cobenefit)
thermalemissivity_2 = Number(thermalemissivity)
constr = ClusterOutput(opaqueconstr)
gwp_kg_co2_m2 = Number(gwp)
name_2 = ClusterOutput(name)
economic_cobenefit_2 = ClusterOutput(economic_cobenefit)
albedo_3 = ClusterOutput(albedo_2)
thermalemissivity_3 = ClusterOutput(thermalemissivity_2)
environmental_cobenefit_3 = ClusterOutput(environmental_cobenefit_2)
social_cobenefit_3 = ClusterOutput(social_cobenefit_2)
gwp_kg_co2_m2_2 = ClusterOutput(gwp_kg_co2_m2)
u_fac_si = ClusterOutput(decnstrconstr.u_fac_si)
panel_2 = Panel(decnstrconstr.u_fac_si)

# ==== cluster Solaio_legno_scarso_isolato
subtraction = Subtraction(A="1", B="0.4")
subtraction_2 = Subtraction(A="1", B="0.15")
subtraction_3 = Subtraction(A="1", B="0.15")
subtraction_4 = Subtraction(A="1", B="0.7")
opaquemat = HBOpaqueMaterial(
    name="Tegole",
    thickness="0.02",
    conductivity="0.575",
    density="1350",
    spec_heat="840",
    therm_absp="0.91",
    sol_absp=subtraction,
    vis_absp=subtraction)  # -> mat; plug-in component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
opaquemat_2 = HBOpaqueMaterial(
    name="custom_air_gap",
    thickness="0.02",
    conductivity="0.125",
    density="1.28",
    spec_heat="1000",
    roughness="Smooth",
    therm_absp="0.9",
    sol_absp="0.7",
    vis_absp="0.7")  # -> mat; plug-in component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
opaquemat_3 = HBOpaqueMaterial(
    name="Tavolato_legno",
    thickness="0.02",
    conductivity="0.120",
    density="450",
    spec_heat="2200",
    therm_absp="0.85",
    sol_absp=subtraction_2,
    vis_absp=subtraction_2)  # -> mat; plug-in component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
opaquemat_4 = HBOpaqueMaterial(
    name="Tavolato_legno",
    thickness="0.02",
    conductivity="0.120",
    density="450",
    spec_heat="2200",
    therm_absp="0.85",
    sol_absp=subtraction_3,
    vis_absp=subtraction_3)  # -> mat; plug-in component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
opaquemat_5 = HBOpaqueMaterial(
    name="Isolante",
    thickness="0.02",
    conductivity="0.045",
    density="100",
    spec_heat="840",
    therm_absp="0.1",
    sol_absp=subtraction_4,
    vis_absp=subtraction_4)  # -> mat; plug-in component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
panel = Panel("Solaio_Legno_medio_isolato")
economical_cobenefit = Panel("")
social_cobenefit = Panel("")
environmental_cobenefit = Panel("")
gwp = Panel("0")
albedo = Panel("0.40")
thermalemissivity = Panel("0.91")
merge = Merge(Data1=opaquemat, Data2=opaquemat_2, Data3=opaquemat_4, Data4=opaquemat_5, Data5=opaquemat_3)
opaqueconstr = HBOpaqueConstruction(name=panel, materials=merge)  # -> constr; plug-in component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
name = Text(panel)
economic_cobenefit = Text(economical_cobenefit)
name_2 = ClusterOutput(name)
social_cobenefit_2 = Text(social_cobenefit)
albedo_2 = Number(albedo)
environmental_cobenefit_2 = Text(environmental_cobenefit)
gwp_kg_co2_m2 = Number(gwp)
thermalemissivity_2 = Number(thermalemissivity)
constr = ClusterOutput(opaqueconstr)
decnstrconstr = HBDeconstructConstruction(constr=opaqueconstr)  # -> materials, layers, r_val_si, r_val_ip, u_fac_si, u_fac_ip, shgc, t_sol, t_vis; plug-in component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
economic_cobenefit_2 = ClusterOutput(economic_cobenefit)
albedo_3 = ClusterOutput(albedo_2)
thermalemissivity_3 = ClusterOutput(thermalemissivity_2)
environmental_cobenefit_3 = ClusterOutput(environmental_cobenefit_2)
social_cobenefit_3 = ClusterOutput(social_cobenefit_2)
gwp_kg_co2_m2_2 = ClusterOutput(gwp_kg_co2_m2)
u_fac_si = ClusterOutput(decnstrconstr.u_fac_si)
panel_2 = Panel(decnstrconstr.u_fac_si)

# ==== cluster Solaio_legno_altamente_isolato
subtraction = Subtraction(A="1", B="0.4")
subtraction_2 = Subtraction(A="1", B="0.15")
subtraction_3 = Subtraction(A="1", B="0.15")
subtraction_4 = Subtraction(A="1", B="0.7")
opaquemat = HBOpaqueMaterial(
    name="Tegole",
    thickness="0.02",
    conductivity="0.575",
    density="1350",
    spec_heat="840",
    therm_absp="0.91",
    sol_absp=subtraction,
    vis_absp=subtraction)  # -> mat; plug-in component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
opaquemat_2 = HBOpaqueMaterial(
    name="custom_air_gap",
    thickness="0.02",
    conductivity="0.125",
    density="1.28",
    spec_heat="1000",
    roughness="Smooth",
    therm_absp="0.9",
    sol_absp="0.7",
    vis_absp="0.7")  # -> mat; plug-in component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
opaquemat_3 = HBOpaqueMaterial(
    name="Tavolato_legno",
    thickness="0.02",
    conductivity="0.120",
    density="450",
    spec_heat="2200",
    therm_absp="0.85",
    sol_absp=subtraction_2,
    vis_absp=subtraction_2)  # -> mat; plug-in component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
opaquemat_4 = HBOpaqueMaterial(
    name="Tavolato_legno",
    thickness="0.02",
    conductivity="0.120",
    density="450",
    spec_heat="2200",
    therm_absp="0.85",
    sol_absp=subtraction_3,
    vis_absp=subtraction_3)  # -> mat; plug-in component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
opaquemat_5 = HBOpaqueMaterial(
    name="Isolante",
    thickness="0.18",
    conductivity="0.032",
    density="30",
    spec_heat="1250",
    therm_absp="0.1",
    sol_absp=subtraction_4,
    vis_absp=subtraction_4)  # -> mat; plug-in component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
panel = Panel("Solaio_Legno_altamente_isolato")
merge = Merge(Data1=opaquemat, Data2=opaquemat_2, Data3=opaquemat_4, Data4=opaquemat_5, Data5=opaquemat_3)
opaqueconstr = HBOpaqueConstruction(name=panel, materials=merge)  # -> constr; plug-in component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
name = Text(panel)
economical_cobenefit = Panel("")
social_cobenefit = Panel("")
environmental_cobenefit = Panel("")
gwp = Panel("0")
thermalemissivity = Panel("0.90")
albedo = Panel("0.4")
name_2 = ClusterOutput(name)
decnstrconstr = HBDeconstructConstruction(constr=opaqueconstr)  # -> materials, layers, r_val_si, r_val_ip, u_fac_si, u_fac_ip, shgc, t_sol, t_vis; plug-in component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
constr = ClusterOutput(opaqueconstr)
economic_cobenefit = Text(economical_cobenefit)
social_cobenefit_2 = Text(social_cobenefit)
albedo_2 = Number(albedo)
gwp_kg_co2_m2 = Number(gwp)
environmental_cobenefit_2 = Text(environmental_cobenefit)
thermalemissivity_2 = Number(thermalemissivity)
panel_2 = Panel(decnstrconstr.u_fac_si)
economic_cobenefit_2 = ClusterOutput(economic_cobenefit)
u_fac_si = ClusterOutput(decnstrconstr.u_fac_si)
albedo_3 = ClusterOutput(albedo_2)
thermalemissivity_3 = ClusterOutput(thermalemissivity_2)
environmental_cobenefit_3 = ClusterOutput(environmental_cobenefit_2)
gwp_kg_co2_m2_2 = ClusterOutput(gwp_kg_co2_m2)
social_cobenefit_3 = ClusterOutput(social_cobenefit_2)

# ==== cluster Solaio_laterocemento_non_isolato
subtraction = Subtraction(A="1", B="0.4")
subtraction_2 = Subtraction(A="1", B="0.250")
subtraction_3 = Subtraction(A="1", B="0.650")
opaquemat = HBOpaqueMaterial(
    name="Tegole",
    thickness="0.02",
    conductivity="0.575",
    density="1350",
    spec_heat="840",
    therm_absp="0.91",
    sol_absp=subtraction,
    vis_absp=subtraction)  # -> mat; plug-in component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
opaquemat_2 = HBOpaqueMaterial(
    name="Solaio_laterocemento",
    thickness="0.3",
    conductivity="0.720",
    density="1800",
    spec_heat="840",
    therm_absp="0.54",
    sol_absp=subtraction_2,
    vis_absp=subtraction_2)  # -> mat; plug-in component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
opaquemat_3 = HBOpaqueMaterial(
    name="custom_air_gap",
    thickness="0.02",
    conductivity="0.125",
    density="1.28",
    spec_heat="1000",
    roughness="Smooth",
    therm_absp="0.9",
    sol_absp="0.7",
    vis_absp="0.7")  # -> mat; plug-in component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
opaquemat_4 = HBOpaqueMaterial(
    name="Intonaco_interno",
    thickness="0.02",
    conductivity="0.700",
    density="1500",
    spec_heat="1000",
    therm_absp="0.9",
    sol_absp=subtraction_3,
    vis_absp=subtraction_3)  # -> mat; plug-in component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
panel = Panel("Solaio_laterocemento_non_isolato")
merge = Merge(Data1=opaquemat, Data2=opaquemat_3, Data3=opaquemat_2, Data4=opaquemat_4)
economical_cobenefit = Panel("")
social_cobenefit = Panel("")
environmental_cobenefit = Panel("")
thermalemissivity = Panel("0.90")
albedo = Panel("0.65")
gwp = Panel("0")
opaqueconstr = HBOpaqueConstruction(name=panel, materials=merge)  # -> constr; plug-in component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
name = Text(panel)
economic_cobenefit = Text(economical_cobenefit)
social_cobenefit_2 = Text(social_cobenefit)
albedo_2 = Number(albedo)
name_2 = ClusterOutput(name)
environmental_cobenefit_2 = Text(environmental_cobenefit)
constr = ClusterOutput(opaqueconstr)
thermalemissivity_2 = Number(thermalemissivity)
gwp_kg_co2_m2 = Number(gwp)
economic_cobenefit_2 = ClusterOutput(economic_cobenefit)
albedo_3 = ClusterOutput(albedo_2)
thermalemissivity_3 = ClusterOutput(thermalemissivity_2)
decnstrconstr = HBDeconstructConstruction(constr=opaqueconstr)  # -> materials, layers, r_val_si, r_val_ip, u_fac_si, u_fac_ip, shgc, t_sol, t_vis; plug-in component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
environmental_cobenefit_3 = ClusterOutput(environmental_cobenefit_2)
social_cobenefit_3 = ClusterOutput(social_cobenefit_2)
gwp_kg_co2_m2_2 = ClusterOutput(gwp_kg_co2_m2)
panel_2 = Panel(decnstrconstr.u_fac_si)
u_fac_si = ClusterOutput(decnstrconstr.u_fac_si)

# ==== cluster Solaio_laterocemento_scarso_isolato
subtraction = Subtraction(A="1", B="0.7")
subtraction_2 = Subtraction(A="1", B="0.4")
subtraction_3 = Subtraction(A="1", B="0.250")
subtraction_4 = Subtraction(A="1", B="0.650")
opaquemat = HBOpaqueMaterial(
    name="Isolante",
    thickness="0.02",
    conductivity="0.045",
    density="100",
    spec_heat="840",
    therm_absp="0.1",
    sol_absp=subtraction,
    vis_absp=subtraction)  # -> mat; plug-in component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
opaquemat_2 = HBOpaqueMaterial(
    name="Tegole",
    thickness="0.02",
    conductivity="0.575",
    density="1350",
    spec_heat="840",
    therm_absp="0.91",
    sol_absp=subtraction_2,
    vis_absp=subtraction_2)  # -> mat; plug-in component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
opaquemat_3 = HBOpaqueMaterial(
    name="custom_air_gap",
    thickness="0.02",
    conductivity="0.125",
    density="1.28",
    spec_heat="1000",
    roughness="Smooth",
    therm_absp="0.9",
    sol_absp="0.7",
    vis_absp="0.7")  # -> mat; plug-in component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
opaquemat_4 = HBOpaqueMaterial(
    name="Solaio_laterocemento",
    thickness="0.3",
    conductivity="0.720",
    density="1800",
    spec_heat="840",
    therm_absp="0.54",
    sol_absp=subtraction_3,
    vis_absp=subtraction_3)  # -> mat; plug-in component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
opaquemat_5 = HBOpaqueMaterial(
    name="Intonaco_interno",
    thickness="0.02",
    conductivity="0.700",
    density="1500",
    spec_heat="1000",
    therm_absp="0.9",
    sol_absp=subtraction_4,
    vis_absp=subtraction_4)  # -> mat; plug-in component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
panel = Panel("Solaio_laterocemento_medio_isolato")
merge = Merge(Data1=opaquemat_2, Data2=opaquemat_3, Data3=opaquemat, Data4=opaquemat_4, Data5=opaquemat_5)
economical_cobenefit = Panel("")
social_cobenefit = Panel("")
environmental_cobenefit = Panel("")
gwp = Panel("0")
albedo = Panel("0.65")
thermalemissivity = Panel("0.90")
opaqueconstr = HBOpaqueConstruction(name=panel, materials=merge)  # -> constr; plug-in component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
name = Text(panel)
economic_cobenefit = Text(economical_cobenefit)
social_cobenefit_2 = Text(social_cobenefit)
albedo_2 = Number(albedo)
decnstrconstr = HBDeconstructConstruction(constr=opaqueconstr)  # -> materials, layers, r_val_si, r_val_ip, u_fac_si, u_fac_ip, shgc, t_sol, t_vis; plug-in component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
environmental_cobenefit_2 = Text(environmental_cobenefit)
thermalemissivity_2 = Number(thermalemissivity)
gwp_kg_co2_m2 = Number(gwp)
constr = ClusterOutput(opaqueconstr)
economic_cobenefit_2 = ClusterOutput(economic_cobenefit)
albedo_3 = ClusterOutput(albedo_2)
thermalemissivity_3 = ClusterOutput(thermalemissivity_2)
name_2 = ClusterOutput(name)
environmental_cobenefit_3 = ClusterOutput(environmental_cobenefit_2)
social_cobenefit_3 = ClusterOutput(social_cobenefit_2)
gwp_kg_co2_m2_2 = ClusterOutput(gwp_kg_co2_m2)
panel_2 = Panel(decnstrconstr.u_fac_si)
u_fac_si = ClusterOutput(decnstrconstr.u_fac_si)

# ==== cluster Solaio_laterocemento_altamente_isolato
subtraction = Subtraction(A="1", B="0.7")
panel = Panel("0.1")
subtraction_2 = Subtraction(A="1", B="0.4")
subtraction_3 = Subtraction(A="1", B="0.250")
subtraction_4 = Subtraction(A="1", B="0.650")
opaquemat = HBOpaqueMaterial(
    name="custom_air_gap",
    thickness="0.02",
    conductivity="0.125",
    density="1.28",
    spec_heat="1000",
    roughness="Smooth",
    therm_absp="0.9",
    sol_absp="0.7",
    vis_absp="0.7")  # -> mat; plug-in component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
opaquemat_2 = HBOpaqueMaterial(
    name="Isolante",
    thickness="0.14",
    conductivity="0.032",
    density="30",
    spec_heat="1250",
    therm_absp="0.7",
    sol_absp=subtraction,
    vis_absp=subtraction)  # -> mat; plug-in component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
opaquemat_3 = HBOpaqueMaterial(
    name="Tegole",
    thickness="0.02",
    conductivity="0.575",
    density="1350",
    spec_heat="840",
    therm_absp="0.91",
    sol_absp=subtraction_2,
    vis_absp=subtraction_2)  # -> mat; plug-in component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
opaquemat_4 = HBOpaqueMaterial(
    name="Solaio_laterocemento",
    thickness="0.3",
    conductivity="0.720",
    density="1800",
    spec_heat="840",
    therm_absp="0.54",
    sol_absp=subtraction_3,
    vis_absp=subtraction_3)  # -> mat; plug-in component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
opaquemat_5 = HBOpaqueMaterial(
    name="Intonaco_interno",
    thickness="0.02",
    conductivity="0.700",
    density="1500",
    spec_heat="1000",
    therm_absp="0.9",
    sol_absp=subtraction_4,
    vis_absp=subtraction_4)  # -> mat; plug-in component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
panel_2 = Panel("Solaio_laterocemento_altamente_isolato")
economical_cobenefit = Panel("")
environmental_cobenefit = Panel("")
social_cobenefit = Panel("")
thermalemissivity = Panel("0.90")
albedo = Panel("0.65")
merge = Merge(Data1=opaquemat_3, Data2=opaquemat, Data3=opaquemat_2, Data4=opaquemat_4, Data5=opaquemat_5)
gwp = Panel("0")
opaqueconstr = HBOpaqueConstruction(name=panel_2, materials=merge)  # -> constr; plug-in component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
name = Text(panel_2)
economic_cobenefit = Text(economical_cobenefit)
social_cobenefit_2 = Text(social_cobenefit)
albedo_2 = Number(albedo)
decnstrconstr = HBDeconstructConstruction(constr=opaqueconstr)  # -> materials, layers, r_val_si, r_val_ip, u_fac_si, u_fac_ip, shgc, t_sol, t_vis; plug-in component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
environmental_cobenefit_2 = Text(environmental_cobenefit)
thermalemissivity_2 = Number(thermalemissivity)
gwp_kg_co2_m2 = Number(gwp)
constr = ClusterOutput(opaqueconstr)
economic_cobenefit_2 = ClusterOutput(economic_cobenefit)
albedo_3 = ClusterOutput(albedo_2)
name_2 = ClusterOutput(name)
thermalemissivity_3 = ClusterOutput(thermalemissivity_2)
environmental_cobenefit_3 = ClusterOutput(environmental_cobenefit_2)
social_cobenefit_3 = ClusterOutput(social_cobenefit_2)
gwp_kg_co2_m2_2 = ClusterOutput(gwp_kg_co2_m2)
panel_3 = Panel(decnstrconstr.u_fac_si)
u_fac_si = ClusterOutput(decnstrconstr.u_fac_si)

# ==== cluster Solaio_allegerito_eps_medio_isolato
subtraction = Subtraction(A="1", B="0.4")
subtraction_2 = Subtraction(A="1", B="0.7")
subtraction_3 = Subtraction(A="1", B="0.250")
subtraction_4 = Subtraction(A="1", B="0.650")
opaquemat = HBOpaqueMaterial(
    name="custom_air_gap",
    thickness="0.02",
    conductivity="0.125",
    density="1.28",
    spec_heat="1000",
    roughness="Smooth",
    therm_absp="0.9",
    sol_absp="0.7",
    vis_absp="0.7")  # -> mat; plug-in component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
opaquemat_2 = HBOpaqueMaterial(
    name="Tegole",
    thickness="0.02",
    conductivity="0.575",
    density="1350",
    spec_heat="840",
    therm_absp="0.91",
    sol_absp=subtraction,
    vis_absp=subtraction)  # -> mat; plug-in component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
opaquemat_3 = HBOpaqueMaterial(
    name="Isolante",
    thickness="0.05",
    conductivity="0.045",
    density="100",
    spec_heat="840",
    therm_absp="0.1",
    sol_absp=subtraction_2,
    vis_absp=subtraction_2)  # -> mat; plug-in component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
opaquemat_4 = HBOpaqueMaterial(
    name="Solaio_alleggerito_EPS",
    thickness="0.3",
    conductivity="0.220",
    density="800",
    spec_heat="1000",
    therm_absp="0.54",
    sol_absp=subtraction_3,
    vis_absp=subtraction_3)  # -> mat; plug-in component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
opaquemat_5 = HBOpaqueMaterial(
    name="Intonaco_interno",
    thickness="0.02",
    conductivity="0.700",
    density="1500",
    spec_heat="1000",
    therm_absp="0.9",
    sol_absp=subtraction_4,
    vis_absp=subtraction_4)  # -> mat; plug-in component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
panel = Panel("Solaio_alleggerito_EPS_medio_isolato")
merge = Merge(Data1=opaquemat_2, Data2=opaquemat, Data3=opaquemat_3, Data4=opaquemat_4, Data5=opaquemat_5)
economical_cobenefit = Panel("")
social_cobenefit = Panel("")
environmental_cobenefit = Panel("")
thermalemissivity = Panel("0.90")
albedo = Panel("0.40")
gwp = Panel("0")
opaqueconstr = HBOpaqueConstruction(name=panel, materials=merge)  # -> constr; plug-in component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
name = Text(panel)
decnstrconstr = HBDeconstructConstruction(constr=opaqueconstr)  # -> materials, layers, r_val_si, r_val_ip, u_fac_si, u_fac_ip, shgc, t_sol, t_vis; plug-in component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
name_2 = ClusterOutput(name)
constr = ClusterOutput(opaqueconstr)
economic_cobenefit = Text(economical_cobenefit)
social_cobenefit_2 = Text(social_cobenefit)
albedo_2 = Number(albedo)
environmental_cobenefit_2 = Text(environmental_cobenefit)
thermalemissivity_2 = Number(thermalemissivity)
gwp_kg_co2_m2 = Number(gwp)
economic_cobenefit_2 = ClusterOutput(economic_cobenefit)
albedo_3 = ClusterOutput(albedo_2)
thermalemissivity_3 = ClusterOutput(thermalemissivity_2)
environmental_cobenefit_3 = ClusterOutput(environmental_cobenefit_2)
social_cobenefit_3 = ClusterOutput(social_cobenefit_2)
gwp_kg_co2_m2_2 = ClusterOutput(gwp_kg_co2_m2)
u_fac_si = ClusterOutput(decnstrconstr.u_fac_si)
panel_2 = Panel(decnstrconstr.u_fac_si)

# ==== cluster Copertura_Verde_estensivo
subtraction = Subtraction(A="1", B="0.15")
vegetationmat = HBVegetationMaterial(
    name="GRASS",
    plant_height="0.06",
    leaf_area_ind="0.30",
    leaf_reflect="0.22",
    leaf_emiss="0.95",
    soil_reflect="0.4",
    soil_emiss="0.6",
    stomat_resist="180",
    thickness="1",
    conductivity="0.3",
    density="1100",
    spec_heat="1200")  # -> mat; plug-in component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
opaquemat = HBOpaqueMaterial(
    name="DAKU ROOF SOIL",
    thickness="0.08",
    conductivity="0.2",
    density="980",
    spec_heat="836.8",
    therm_absp="0.3",
    sol_absp=subtraction,
    vis_absp=subtraction)  # -> mat; plug-in component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
opaquemat_2 = HBOpaqueMaterial(name="DAKU FSD 10", thickness="0.047", conductivity="0.1", density="25", spec_heat="1338")  # -> mat; plug-in component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
opaquemat_3 = HBOpaqueMaterial(name="Mapetherm EPS 100 CAM", thickness="0.1", conductivity="0.035", density="1000", spec_heat="1260")  # -> mat; plug-in component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
opaquemat_4 = HBOpaqueMaterial(name="Intonaco interno", thickness="0.02", conductivity="0.7", density="1500", spec_heat="1000")  # -> mat; plug-in component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
opaquemat_5 = HBOpaqueMaterial(name="Solaio in laterocemento ", thickness="0.3", conductivity="0.72", density="1800", spec_heat="840")  # -> mat; plug-in component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
merge = Merge(Data1=vegetationmat, Data2=opaquemat, Data3=opaquemat_2, Data4=opaquemat_3, Data5=opaquemat_5, Data6=opaquemat_4)
panel = Panel("Copertura_Verde_estensivo")
economical_cobenefit = Panel("")
social_cobenefit = Panel("")
environmental_cobenefit = Panel("")
thermalemissivity = Panel("0.95")
albedo = Panel("0.25")
gwp = Panel("12")
opaqueconstr = HBOpaqueConstruction(name=panel, materials=merge)  # -> constr; plug-in component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
name = Text(panel)
constr = ClusterOutput(opaqueconstr)
economic_cobenefit = Text(economical_cobenefit)
social_cobenefit_2 = Text(social_cobenefit)
albedo_2 = Number(albedo)
environmental_cobenefit_2 = Text(environmental_cobenefit)
thermalemissivity_2 = Number(thermalemissivity)
gwp_kg_co2_m2 = Number(gwp)
name_2 = ClusterOutput(name)
decnstrconstr = HBDeconstructConstruction(constr=opaqueconstr)  # -> materials, layers, r_val_si, r_val_ip, u_fac_si, u_fac_ip, shgc, t_sol, t_vis; plug-in component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
economic_cobenefit_2 = ClusterOutput(economic_cobenefit)
albedo_3 = ClusterOutput(albedo_2)
thermalemissivity_3 = ClusterOutput(thermalemissivity_2)
environmental_cobenefit_3 = ClusterOutput(environmental_cobenefit_2)
social_cobenefit_3 = ClusterOutput(social_cobenefit_2)
gwp_kg_co2_m2_2 = ClusterOutput(gwp_kg_co2_m2)
panel_2 = Panel(decnstrconstr.u_fac_si)
u_fac_si = ClusterOutput(decnstrconstr.u_fac_si)

# ==== cluster Solaio_allegerito_eps_isolato
subtraction = Subtraction(A="1", B="0.4")
subtraction_2 = Subtraction(A="1", B="0.7")
subtraction_3 = Subtraction(A="1", B="0.250")
subtraction_4 = Subtraction(A="1", B="0.650")
opaquemat = HBOpaqueMaterial(
    name="custom_air_gap",
    thickness="0.02",
    conductivity="0.125",
    density="1.28",
    spec_heat="1000",
    roughness="Smooth",
    therm_absp="0.9",
    sol_absp="0.7",
    vis_absp="0.7")  # -> mat; plug-in component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
opaquemat_2 = HBOpaqueMaterial(
    name="Tegole",
    thickness="0.02",
    conductivity="0.575",
    density="1350",
    spec_heat="840",
    therm_absp="0.91",
    sol_absp=subtraction,
    vis_absp=subtraction)  # -> mat; plug-in component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
opaquemat_3 = HBOpaqueMaterial(
    name="Isolante",
    thickness="0.1",
    conductivity="0.045",
    density="100",
    spec_heat="840",
    therm_absp="0.1",
    sol_absp=subtraction_2,
    vis_absp=subtraction_2)  # -> mat; plug-in component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
opaquemat_4 = HBOpaqueMaterial(
    name="Solaio_alleggerito_EPS",
    thickness="0.3",
    conductivity="0.220",
    density="800",
    spec_heat="1000",
    therm_absp="0.54",
    sol_absp=subtraction_3,
    vis_absp=subtraction_3)  # -> mat; plug-in component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
opaquemat_5 = HBOpaqueMaterial(
    name="Intonaco_interno",
    thickness="0.02",
    conductivity="0.700",
    density="1500",
    spec_heat="1000",
    therm_absp="0.9",
    sol_absp=subtraction_4,
    vis_absp=subtraction_4)  # -> mat; plug-in component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
panel = Panel("Solaio_alleggerito_EPS_isolato")
gwp = Panel("0")
economical_cobenefit = Panel("")
environmental_cobenefit = Panel("")
social_cobenefit = Panel("")
albedo = Panel("0.40")
thermalemissivity = Panel("0.90")
merge = Merge(Data1=opaquemat_2, Data2=opaquemat, Data3=opaquemat_3, Data4=opaquemat_4, Data5=opaquemat_5)
opaqueconstr = HBOpaqueConstruction(name=panel, materials=merge)  # -> constr; plug-in component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
gwp_kg_co2_m2 = Number(gwp)
economic_cobenefit = Text(economical_cobenefit)
social_cobenefit_2 = Text(social_cobenefit)
albedo_2 = Number(albedo)
environmental_cobenefit_2 = Text(environmental_cobenefit)
thermalemissivity_2 = Number(thermalemissivity)
name = Text(panel)
constr = ClusterOutput(opaqueconstr)
decnstrconstr = HBDeconstructConstruction(constr=opaqueconstr)  # -> materials, layers, r_val_si, r_val_ip, u_fac_si, u_fac_ip, shgc, t_sol, t_vis; plug-in component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
economic_cobenefit_2 = ClusterOutput(economic_cobenefit)
albedo_3 = ClusterOutput(albedo_2)
thermalemissivity_3 = ClusterOutput(thermalemissivity_2)
gwp_kg_co2_m2_2 = ClusterOutput(gwp_kg_co2_m2)
environmental_cobenefit_3 = ClusterOutput(environmental_cobenefit_2)
social_cobenefit_3 = ClusterOutput(social_cobenefit_2)
name_2 = ClusterOutput(name)
panel_2 = Panel(decnstrconstr.u_fac_si)
u_fac_si = ClusterOutput(decnstrconstr.u_fac_si)

# ==== cluster Copertura_legno
subtraction = Subtraction(A="1", B="0.7")
opaquemat = HBOpaqueMaterial(
    name="tavolato di legno grezzo",
    thickness="0.024",
    conductivity="0.26",
    density="1350",
    spec_heat="1880",
    therm_absp="0.69",
    sol_absp=subtraction,
    vis_absp=subtraction)  # -> mat; plug-in component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
opaquemat_2 = HBOpaqueMaterial(name="Fibra di legno Fibertherm Protect 230", thickness="0.06", conductivity="0.046", density="230", spec_heat="2100")  # -> mat; plug-in component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
opaquemat_3 = HBOpaqueMaterial(name="X-LAM", thickness="0.12", conductivity="0.12", density="470", spec_heat="1600")  # -> mat; plug-in component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
opaquemat_4 = HBOpaqueMaterial(name="Lastra gessofibra fermacell", thickness="0.0125", conductivity="0.32", density="1180", spec_heat="1100")  # -> mat; plug-in component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
opaquemat_5 = HBOpaqueMaterial(name="Fibra di legno Fibertherm Protect 230", thickness="0.06", conductivity="0.046", density="230", spec_heat="2100")  # -> mat; plug-in component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
merge = Merge(Data1=opaquemat, Data2=opaquemat_2, Data3=opaquemat_3, Data4=opaquemat_5, Data5=opaquemat_4)
economical_cobenefit = Panel("")
social_cobenefit = Panel("")
environmental_cobenefit = Panel("")
gwp = Panel("-20")
thermalemissivity = Panel("0.69")
albedo = Panel("0.70")
opaqueconstr = HBOpaqueConstruction(name="Copertura_legno", materials=merge)  # -> constr; plug-in component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
name = Text("Copertura_legno")
constr = ClusterOutput(opaqueconstr)
economic_cobenefit = Text(economical_cobenefit)
social_cobenefit_2 = Text(social_cobenefit)
albedo_2 = Number(albedo)
environmental_cobenefit_2 = Text(environmental_cobenefit)
thermalemissivity_2 = Number(thermalemissivity)
gwp_kg_co2_m2 = Number(gwp)
name_2 = ClusterOutput(name)
decnstrconstr = HBDeconstructConstruction(constr=opaqueconstr)  # -> materials, layers, r_val_si, r_val_ip, u_fac_si, u_fac_ip, shgc, t_sol, t_vis; plug-in component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
economic_cobenefit_2 = ClusterOutput(economic_cobenefit)
albedo_3 = ClusterOutput(albedo_2)
thermalemissivity_3 = ClusterOutput(thermalemissivity_2)
environmental_cobenefit_3 = ClusterOutput(environmental_cobenefit_2)
social_cobenefit_3 = ClusterOutput(social_cobenefit_2)
gwp_kg_co2_m2_2 = ClusterOutput(gwp_kg_co2_m2)
panel = Panel(decnstrconstr.u_fac_si)
u_fac_si = ClusterOutput(decnstrconstr.u_fac_si)

# ==== cluster Solaio_allegerito_eps_altamente_isolato
subtraction = Subtraction(A="1", B="0.4")
subtraction_2 = Subtraction(A="1", B="0.7")
subtraction_3 = Subtraction(A="1", B="0.250")
subtraction_4 = Subtraction(A="1", B="0.650")
opaquemat = HBOpaqueMaterial(
    name="custom_air_gap",
    thickness="0.02",
    conductivity="0.125",
    density="1.28",
    spec_heat="1000",
    roughness="Smooth",
    therm_absp="0.9",
    sol_absp="0.7",
    vis_absp="0.7")  # -> mat; plug-in component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
opaquemat_2 = HBOpaqueMaterial(
    name="Tegole",
    thickness="0.02",
    conductivity="0.575",
    density="1350",
    spec_heat="840",
    therm_absp="0.91",
    sol_absp=subtraction,
    vis_absp=subtraction)  # -> mat; plug-in component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
opaquemat_3 = HBOpaqueMaterial(
    name="Isolante",
    thickness="0.14",
    conductivity="0.032",
    density="30",
    spec_heat="1250",
    therm_absp="0.1",
    sol_absp=subtraction_2,
    vis_absp=subtraction_2)  # -> mat; plug-in component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
opaquemat_4 = HBOpaqueMaterial(
    name="Solaio_alleggerito_EPS",
    thickness="0.3",
    conductivity="0.220",
    density="800",
    spec_heat="1000",
    therm_absp="0.54",
    sol_absp=subtraction_3,
    vis_absp=subtraction_3)  # -> mat; plug-in component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
opaquemat_5 = HBOpaqueMaterial(
    name="Intonaco_interno",
    thickness="0.02",
    conductivity="0.700",
    density="1500",
    spec_heat="1000",
    therm_absp="0.9",
    sol_absp=subtraction_4,
    vis_absp=subtraction_4)  # -> mat; plug-in component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
panel = Panel("Solaio_alleggerito_EPS_altamente_isolato")
merge = Merge(Data1=opaquemat_2, Data2=opaquemat, Data3=opaquemat_3, Data4=opaquemat_4, Data5=opaquemat_5)
economical_cobenefit = Panel("")
environmental_cobenefit = Panel("")
social_cobenefit = Panel("")
gwp = Panel("0")
name = Text(panel)
opaqueconstr = HBOpaqueConstruction(name=panel, materials=merge)  # -> constr; plug-in component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
albedo = Panel("0.40")
thermalemissivity = Panel("0.90")
name_2 = ClusterOutput(name)
decnstrconstr = HBDeconstructConstruction(constr=opaqueconstr)  # -> materials, layers, r_val_si, r_val_ip, u_fac_si, u_fac_ip, shgc, t_sol, t_vis; plug-in component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
constr = ClusterOutput(opaqueconstr)
economic_cobenefit = Text(economical_cobenefit)
social_cobenefit_2 = Text(social_cobenefit)
albedo_2 = Number(albedo)
gwp_kg_co2_m2 = Number(gwp)
environmental_cobenefit_2 = Text(environmental_cobenefit)
thermalemissivity_2 = Number(thermalemissivity)
u_fac_si = ClusterOutput(decnstrconstr.u_fac_si)
economic_cobenefit_2 = ClusterOutput(economic_cobenefit)
panel_2 = Panel(decnstrconstr.u_fac_si)
albedo_3 = ClusterOutput(albedo_2)
thermalemissivity_3 = ClusterOutput(thermalemissivity_2)
environmental_cobenefit_3 = ClusterOutput(environmental_cobenefit_2)
social_cobenefit_3 = ClusterOutput(social_cobenefit_2)
gwp_kg_co2_m2_2 = ClusterOutput(gwp_kg_co2_m2)

# ==== cluster Copertura_acciaio
opaquemat = HBOpaqueMaterial(name="Glass fibre quilt", thickness="0.1", conductivity="0.04", density="12,5", spec_heat="1030")  # -> mat; plug-in component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
opaquemat_2 = HBOpaqueMaterial(name="RW3 rock fibre slab", thickness="0.11", conductivity="0.039", density="60", spec_heat="1030")  # -> mat; plug-in component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
merge = Merge(Data1=opaquemat, Data2=opaquemat_2)
economical_cobenefit = Panel("")
social_cobenefit = Panel("")
environmental_cobenefit = Panel("")
thermalemissivity = Panel("0.90")
albedo = Panel("0.65")
gwp = Panel("25.4")
opaqueconstr = HBOpaqueConstruction(name="Copertura_Acciaio", materials=merge)  # -> constr; plug-in component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
economic_cobenefit = Text(economical_cobenefit)
social_cobenefit_2 = Text(social_cobenefit)
albedo_2 = Number(albedo)
environmental_cobenefit_2 = Text(environmental_cobenefit)
name = Text("Copertura_Acciaio")
thermalemissivity_2 = Number(thermalemissivity)
gwp_kg_co2_m2 = Number(gwp)
constr = ClusterOutput(opaqueconstr)
decnstrconstr = HBDeconstructConstruction(constr=opaqueconstr)  # -> materials, layers, r_val_si, r_val_ip, u_fac_si, u_fac_ip, shgc, t_sol, t_vis; plug-in component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
economic_cobenefit_2 = ClusterOutput(economic_cobenefit)
albedo_3 = ClusterOutput(albedo_2)
thermalemissivity_3 = ClusterOutput(thermalemissivity_2)
name_2 = ClusterOutput(name)
environmental_cobenefit_3 = ClusterOutput(environmental_cobenefit_2)
social_cobenefit_3 = ClusterOutput(social_cobenefit_2)
gwp_kg_co2_m2_2 = ClusterOutput(gwp_kg_co2_m2)
panel = Panel(decnstrconstr.u_fac_si)
u_fac_si = ClusterOutput(decnstrconstr.u_fac_si)

# ==== cluster Solaio_calcestruzzo_igloo_non_isolato
subtraction = Subtraction(A="1", B="0.250")
subtraction_2 = Subtraction(A="1", B="0.250")
subtraction_3 = Subtraction(A="1", B="0.2")
opaquemat = HBOpaqueMaterial(
    name="custom_air_gap",
    thickness="0.22",
    conductivity="1.22",
    density="1.28",
    spec_heat="1000",
    roughness="Smooth",
    therm_absp="0.9",
    sol_absp="0.7",
    vis_absp="0.7")  # -> mat; plug-in component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
opaquemat_2 = HBOpaqueMaterial(
    name="Calcestruzzo",
    thickness="0.3",
    conductivity="1.7",
    density="2400",
    spec_heat="1000",
    therm_absp="0.9",
    sol_absp=subtraction,
    vis_absp=subtraction)  # -> mat; plug-in component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
opaquemat_3 = HBOpaqueMaterial(
    name="massetto_calcestruzzo",
    thickness="0.05",
    conductivity="2.02",
    density="2200",
    spec_heat="1000",
    therm_absp="0.9",
    sol_absp=subtraction_2,
    vis_absp=subtraction_2)  # -> mat; plug-in component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
opaquemat_4 = HBOpaqueMaterial(
    name="pavimentazione",
    thickness="0.01",
    conductivity="1.300",
    density="2300",
    spec_heat="840",
    therm_absp="0.85",
    sol_absp=subtraction_3,
    vis_absp=subtraction_3)  # -> mat; plug-in component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
panel = Panel("Solaio_calcestruzzo_igloo_non_isolato")
merge = Merge(Data1=opaquemat, Data2=opaquemat_2, Data3=opaquemat_3, Data4=opaquemat_4)
economical_cobenefit = Panel("")
social_cobenefit = Panel("")
environmental_cobenefit = Panel("")
thermalemissivity = Panel("0.90")
gwp = Panel("0")
albedo = Panel("0.40")
opaqueconstr = HBOpaqueConstruction(name=panel, materials=merge)  # -> constr; plug-in component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
economic_cobenefit = Text(economical_cobenefit)
social_cobenefit_2 = Text(social_cobenefit)
albedo_2 = Number(albedo)
environmental_cobenefit_2 = Text(environmental_cobenefit)
constr = ClusterOutput(opaqueconstr)
decnstrconstr = HBDeconstructConstruction(constr=opaqueconstr)  # -> materials, layers, r_val_si, r_val_ip, u_fac_si, u_fac_ip, shgc, t_sol, t_vis; plug-in component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
thermalemissivity_2 = Number(thermalemissivity)
gwp_kg_co2_m2 = Number(gwp)
name = Text(panel)
economic_cobenefit_2 = ClusterOutput(economic_cobenefit)
albedo_3 = ClusterOutput(albedo_2)
thermalemissivity_3 = ClusterOutput(thermalemissivity_2)
environmental_cobenefit_3 = ClusterOutput(environmental_cobenefit_2)
social_cobenefit_3 = ClusterOutput(social_cobenefit_2)
gwp_kg_co2_m2_2 = ClusterOutput(gwp_kg_co2_m2)
name_2 = ClusterOutput(name)
u_fac_si = ClusterOutput(decnstrconstr.u_fac_si)
panel_2 = Panel(decnstrconstr.u_fac_si)

# ==== cluster Copertura_calcestruzzo
subtraction = Subtraction(A="1", B="0.4")
opaquemat = HBOpaqueMaterial(name="Mapetherm EPS 100 CAM", thickness="0.1", conductivity="0.035", density="1000", spec_heat="1260")  # -> mat; plug-in component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
opaquemat_2 = HBOpaqueMaterial(name="Solaio in laterocemento", thickness="0.3", conductivity="0.72", density="1800", spec_heat="840")  # -> mat; plug-in component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
opaquemat_3 = HBOpaqueMaterial(name="Intonaco interno", thickness="0.02", conductivity="0.7", density="1500", spec_heat="1000")  # -> mat; plug-in component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
opaquemat_4 = HBOpaqueMaterial(
    name="Tegole",
    thickness="0.02",
    conductivity="0.575",
    density="1350",
    spec_heat="840",
    therm_absp="0.91",
    sol_absp=subtraction,
    vis_absp=subtraction)  # -> mat; plug-in component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
merge = Merge(Data1=opaquemat_4, Data2=opaquemat, Data3=opaquemat_2, Data4=opaquemat_3)
economical_cobenefit = Panel("")
social_cobenefit = Panel("")
environmental_cobenefit = Panel("")
thermalemissivity = Panel("0.90")
albedo = Panel("0.40")
gwp = Panel("4.13")
opaqueconstr = HBOpaqueConstruction(name="Copertura_Calcestruzzo", materials=merge)  # -> constr; plug-in component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
name = Text("Copertura_Calcestruzzo")
constr = ClusterOutput(opaqueconstr)
economic_cobenefit = Text(economical_cobenefit)
decnstrconstr = HBDeconstructConstruction(constr=opaqueconstr)  # -> materials, layers, r_val_si, r_val_ip, u_fac_si, u_fac_ip, shgc, t_sol, t_vis; plug-in component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
social_cobenefit_2 = Text(social_cobenefit)
albedo_2 = Number(albedo)
environmental_cobenefit_2 = Text(environmental_cobenefit)
thermalemissivity_2 = Number(thermalemissivity)
gwp_kg_co2_m2 = Number(gwp)
name_2 = ClusterOutput(name)
economic_cobenefit_2 = ClusterOutput(economic_cobenefit)
albedo_3 = ClusterOutput(albedo_2)
thermalemissivity_3 = ClusterOutput(thermalemissivity_2)
environmental_cobenefit_3 = ClusterOutput(environmental_cobenefit_2)
social_cobenefit_3 = ClusterOutput(social_cobenefit_2)
gwp_kg_co2_m2_2 = ClusterOutput(gwp_kg_co2_m2)
panel = Panel(decnstrconstr.u_fac_si)
u_fac_si = ClusterOutput(decnstrconstr.u_fac_si)

# ==== cluster Solaio_calcestruzzo_igloo_scarso_isolato
subtraction = Subtraction(A="1", B="0.250")
subtraction_2 = Subtraction(A="1", B="0.250")
subtraction_3 = Subtraction(A="1", B="0.250")
subtraction_4 = Subtraction(A="1", B="0.2")
subtraction_5 = Subtraction(A="1", B="0.7")
panel = Panel("0.1")
opaquemat = HBOpaqueMaterial(
    name="Calcestruzzo",
    thickness="0.3",
    conductivity="1.7",
    density="2400",
    spec_heat="1000",
    therm_absp="0.9",
    sol_absp=subtraction_2,
    vis_absp=subtraction_2)  # -> mat; plug-in component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
opaquemat_2 = HBOpaqueMaterial(
    name="massetto_calcestruzzo",
    thickness="0.05",
    conductivity="2.02",
    density="2200",
    spec_heat="1000",
    therm_absp="0.9",
    sol_absp=subtraction,
    vis_absp=subtraction)  # -> mat; plug-in component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
opaquemat_3 = HBOpaqueMaterial(
    name="massetto_calcestruzzo",
    thickness="0.05",
    conductivity="2.02",
    density="2200",
    spec_heat="1000",
    therm_absp="0.9",
    sol_absp=subtraction_3,
    vis_absp=subtraction_3)  # -> mat; plug-in component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
opaquemat_4 = HBOpaqueMaterial(
    name="custom_air_gap",
    thickness="0.22",
    conductivity="1.22",
    density="1.28",
    spec_heat="1000",
    roughness="Smooth",
    therm_absp="0.9",
    sol_absp="0.7",
    vis_absp="0.7")  # -> mat; plug-in component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
opaquemat_5 = HBOpaqueMaterial(
    name="pavimentazione",
    thickness="0.01",
    conductivity="1.300",
    density="2300",
    spec_heat="840",
    therm_absp="0.85",
    sol_absp=subtraction_4,
    vis_absp=subtraction_4)  # -> mat; plug-in component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
opaquemat_6 = HBOpaqueMaterial(
    name="isolante",
    thickness="0.02",
    conductivity="0.045",
    density="100",
    spec_heat="840",
    therm_absp="0.7",
    sol_absp=subtraction_5,
    vis_absp=subtraction_5)  # -> mat; plug-in component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
panel_2 = Panel("Solaio_calcestruzzo_igloo_scarso_isolato")
merge = Merge(Data1=opaquemat_4, Data2=opaquemat, Data3=opaquemat_3, Data4=opaquemat_6, Data5=opaquemat_2, Data6=opaquemat_5)
gwp = Panel("0")
economical_cobenefit = Panel("")
environmental_cobenefit = Panel("")
social_cobenefit = Panel("")
albedo = Panel("0.40")
thermalemissivity = Panel("0.90")
opaqueconstr = HBOpaqueConstruction(name=panel_2, materials=merge)  # -> constr; plug-in component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
constr = ClusterOutput(opaqueconstr)
decnstrconstr = HBDeconstructConstruction(constr=opaqueconstr)  # -> materials, layers, r_val_si, r_val_ip, u_fac_si, u_fac_ip, shgc, t_sol, t_vis; plug-in component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
economic_cobenefit = Text(economical_cobenefit)
gwp_kg_co2_m2 = Number(gwp)
social_cobenefit_2 = Text(social_cobenefit)
albedo_2 = Number(albedo)
environmental_cobenefit_2 = Text(environmental_cobenefit)
name = Text(panel_2)
thermalemissivity_2 = Number(thermalemissivity)
economic_cobenefit_2 = ClusterOutput(economic_cobenefit)
albedo_3 = ClusterOutput(albedo_2)
thermalemissivity_3 = ClusterOutput(thermalemissivity_2)
environmental_cobenefit_3 = ClusterOutput(environmental_cobenefit_2)
gwp_kg_co2_m2_2 = ClusterOutput(gwp_kg_co2_m2)
social_cobenefit_3 = ClusterOutput(social_cobenefit_2)
name_2 = ClusterOutput(name)
panel_3 = Panel(decnstrconstr.u_fac_si)
u_fac_si = ClusterOutput(decnstrconstr.u_fac_si)

# ==== cluster Solaio_calcestruzzo_igloo_isolato
subtraction = Subtraction(A="1", B="0.250")
subtraction_2 = Subtraction(A="1", B="0.250")
subtraction_3 = Subtraction(A="1", B="0.250")
subtraction_4 = Subtraction(A="1", B="0.2")
subtraction_5 = Subtraction(A="1", B="0.7")
opaquemat = HBOpaqueMaterial(
    name="custom_air_gap",
    thickness="0.22",
    conductivity="1.22",
    density="1.28",
    spec_heat="1000",
    roughness="Smooth",
    therm_absp="0.9",
    sol_absp="0.7",
    vis_absp="0.7")  # -> mat; plug-in component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
opaquemat_2 = HBOpaqueMaterial(
    name="Calcestruzzo",
    thickness="0.3",
    conductivity="1.7",
    density="2400",
    spec_heat="1000",
    therm_absp="0.9",
    sol_absp=subtraction_2,
    vis_absp=subtraction_2)  # -> mat; plug-in component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
opaquemat_3 = HBOpaqueMaterial(
    name="massetto_calcestruzzo",
    thickness="0.05",
    conductivity="2.02",
    density="2200",
    spec_heat="1000",
    therm_absp="0.9",
    sol_absp=subtraction,
    vis_absp=subtraction)  # -> mat; plug-in component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
opaquemat_4 = HBOpaqueMaterial(
    name="massetto_calcestruzzo",
    thickness="0.05",
    conductivity="2.02",
    density="2200",
    spec_heat="1000",
    therm_absp="0.9",
    sol_absp=subtraction_3,
    vis_absp=subtraction_3)  # -> mat; plug-in component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
opaquemat_5 = HBOpaqueMaterial(
    name="pavimentazione",
    thickness="0.01",
    conductivity="1.300",
    density="2300",
    spec_heat="840",
    therm_absp="0.85",
    sol_absp=subtraction_4,
    vis_absp=subtraction_4)  # -> mat; plug-in component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
opaquemat_6 = HBOpaqueMaterial(
    name="isolante",
    thickness="0.1",
    conductivity="0.032",
    density="30",
    spec_heat="1250",
    therm_absp="0.1",
    sol_absp=subtraction_5,
    vis_absp=subtraction_5)  # -> mat; plug-in component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
panel = Panel("Solaio_calcestruzzo_igloo_scarso_isolato")
economical_cobenefit = Panel("")
environmental_cobenefit = Panel("")
social_cobenefit = Panel("")
albedo = Panel("0.40")
thermalemissivity = Panel("0.90")
merge = Merge(Data1=opaquemat, Data2=opaquemat_2, Data3=opaquemat_4, Data4=opaquemat_6, Data5=opaquemat_3, Data6=opaquemat_5)
gwp = Panel("0")
opaqueconstr = HBOpaqueConstruction(name=panel, materials=merge)  # -> constr; plug-in component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
name = Text(panel)
economic_cobenefit = Text(economical_cobenefit)
social_cobenefit_2 = Text(social_cobenefit)
albedo_2 = Number(albedo)
environmental_cobenefit_2 = Text(environmental_cobenefit)
thermalemissivity_2 = Number(thermalemissivity)
gwp_kg_co2_m2 = Number(gwp)
constr = ClusterOutput(opaqueconstr)
decnstrconstr = HBDeconstructConstruction(constr=opaqueconstr)  # -> materials, layers, r_val_si, r_val_ip, u_fac_si, u_fac_ip, shgc, t_sol, t_vis; plug-in component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
economic_cobenefit_2 = ClusterOutput(economic_cobenefit)
albedo_3 = ClusterOutput(albedo_2)
thermalemissivity_3 = ClusterOutput(thermalemissivity_2)
name_2 = ClusterOutput(name)
environmental_cobenefit_3 = ClusterOutput(environmental_cobenefit_2)
social_cobenefit_3 = ClusterOutput(social_cobenefit_2)
gwp_kg_co2_m2_2 = ClusterOutput(gwp_kg_co2_m2)
panel_2 = Panel(decnstrconstr.u_fac_si)
u_fac_si = ClusterOutput(decnstrconstr.u_fac_si)

# ==== cluster OccupancySchedule
national_holiday = ClusterInput()
change_period = ClusterInput()
change_value = ClusterInput()
mon_fri = ClusterInput()
national_holiday_2 = Data(national_holiday)
change_period_2 = Data(change_period)
mon_fri_2 = Data(mon_fri)
change_value_2 = Data(change_value)
division = Division(A=mon_fri_2, B="100")
sort_list = SortList(Keys=mon_fri_2)  # -> Keys, ValuesValuesA
multiplication = Multiplication(A=division, B=change_value_2)
subtraction = Subtraction(A=mon_fri_2, B=multiplication)
list_length = ListLength(List=mon_fri_2)
list_item = ListItem(List=sort_list.Keys, Index="0", Wrap=True)
panel = Panel(list_item)
construct_domain = ConstructDomain(DomainStart=panel, DomainEnd="1")
panel_2 = Panel(mon_fri_2)
repeat_data = RepeatData(Data=list_item, Length=list_length)
remap_numbers = RemapNumbers(Value=subtraction, Source=construct_domain, Target=construct_domain)  # -> Mapped, Clipped
panel_3 = Panel(remap_numbers.Clipped)
weeklyschedule = HBWeeklySchedule(sun=list_item, mon=mon_fri_2, tue=mon_fri_2, wed=mon_fri_2, thu=mon_fri_2, fri=mon_fri_2, sat=list_item)  # -> out, schedule, idf_year, idf_week, idf_days; plug-in component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
weeklyschedule_2 = HBWeeklySchedule(
    sun=list_item,
    mon=remap_numbers.Clipped,
    tue=remap_numbers.Clipped,
    wed=remap_numbers.Clipped,
    thu=remap_numbers.Clipped,
    fri=remap_numbers.Clipped,
    sat=list_item)  # -> out, schedule, idf_year, idf_week, idf_days; plug-in component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
list_length_2 = ListLength(List=change_period_2)
holiday = Holiday(values=list_item, list=national_holiday_2, date=national_holiday_2)  # -> flatten(holiday), period, hoys, dates
periods = Periods(text=change_period_2)  # -> period, hoys, dates
repeat_data_2 = RepeatData(Data=weeklyschedule_2.schedule, Length=list_length_2)  # -> flatten(Data)
seasonalschedule = HBSeasonalSchedule(
    base_schedule=weeklyschedule.schedule,
    season_scheds=[repeat_data_2, holiday.holiday],
    analysis_periods=[holiday.period, periods.period])  # -> out, schedule, idf_year, idf_week, idf_days; plug-in component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
schedule = ClusterOutput(seasonalschedule.schedule)

# ==== cluster LightingSchedule
change_value__summer = ClusterInput()
change_value__winter = ClusterInput()
change_period = ClusterInput()
national_holiday = ClusterInput()
mon_fri = ClusterInput()
mon_fri_2 = Data(mon_fri)
change_value__winter_2 = Data(change_value__winter)
change_period_2 = Data(change_period)
national_holiday_2 = Data(national_holiday)
change_value__summer_2 = Data(change_value__summer)

sort_list = SortList(Keys=mon_fri_2)  # -> Keys, ValuesValuesA
list_item = ListItem(List=sort_list.Keys, Index="0", Wrap=True)
list_length = ListLength(List=mon_fri_2)
repeat_data = RepeatData(Data=list_item, Length=list_length)

division = Division(A=mon_fri_2, B="100")
multiplication = Multiplication(A=division, B=change_value__summer_2)
panel = Panel(list_item)
subtraction = Subtraction(A=mon_fri_2, B=multiplication)
construct_domain = ConstructDomain(DomainStart=panel, DomainEnd="1")
remap_numbers = RemapNumbers(Value=subtraction, Source=construct_domain, Target=construct_domain)  # -> Mapped, Clipped

panel_2 = Panel(mon_fri_2)
panel_3 = Panel(remap_numbers.Clipped)
weeklyschedule = HBWeeklySchedule(sun=repeat_data, mon=mon_fri_2, tue=mon_fri_2, wed=mon_fri_2, thu=mon_fri_2, fri=mon_fri_2, sat=repeat_data)  # -> out, schedule, idf_year, idf_week, idf_days; plug-in component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
weeklyschedule_2 = HBWeeklySchedule(
    sun=repeat_data,
    mon=remap_numbers.Clipped,
    tue=remap_numbers.Clipped,
    wed=remap_numbers.Clipped,
    thu=remap_numbers.Clipped,
    fri=remap_numbers.Clipped,
    sat=repeat_data)  # -> out, schedule, idf_year, idf_week, idf_days; plug-in component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
holiday = Holiday(values=list_item, list=national_holiday_2, date=national_holiday_2)  # -> holiday, period, hoys, dates
periods = Periods(text=change_period_2)  # -> period, hoys, dates
seasonalschedule = HBSeasonalSchedule(
    base_schedule=weeklyschedule.schedule,
    season_scheds=flatten([weeklyschedule_2.schedule, holiday.holiday]),
    analysis_periods=[periods.period, holiday.period])  # -> out, schedule, idf_year, idf_week, idf_days; plug-in component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
schedule = ClusterOutput(seasonalschedule.schedule)

# ==== cluster HotWaterSchedule
national_holiday = ClusterInput()
mon_fri = ClusterInput()
national_holiday_2 = Data(national_holiday)
mon_fri_2 = Data(mon_fri)

sort_list = SortList(Keys=mon_fri_2)  # -> Keys, ValuesValuesA
list_item = ListItem(List=sort_list.Keys, Index="0", Wrap=True)
list_length = ListLength(List=mon_fri_2)
repeat_data = RepeatData(Data=list_item, Length=list_length)

weeklyschedule = HBWeeklySchedule(sun=repeat_data, mon=mon_fri_2, tue=mon_fri_2, wed=mon_fri_2, thu=mon_fri_2, fri=mon_fri_2, sat=repeat_data)  # -> out, schedule, idf_year, idf_week, idf_days; plug-in component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
holiday = Holiday(values=list_item, list=national_holiday_2, date=national_holiday_2)  # -> holiday, period, hoys, dates
seasonalschedule = HBSeasonalSchedule(base_schedule=weeklyschedule.schedule, season_scheds=flatten(holiday.holiday), analysis_periods=holiday.period)  # -> out, schedule, idf_year, idf_week, idf_days; plug-in component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
schedule = ClusterOutput(seasonalschedule.schedule)

# ==== cluster EcquipmentSchedule
change_period = ClusterInput()
national_holiday = ClusterInput()
change_value = ClusterInput()
mon_fri = ClusterInput()
change_value_2 = Data(change_value)
national_holiday_2 = Data(national_holiday)
mon_fri_2 = Data(mon_fri)
change_period_2 = Data(change_period)

sort_list = SortList(Keys=mon_fri_2)  # -> Keys, ValuesValuesA
list_item = ListItem(List=sort_list.Keys, Index="0", Wrap=True)
list_length = ListLength(List=mon_fri_2)
repeat_data = RepeatData(Data=list_item, Length=list_length)

division = Division(A=mon_fri_2, B="100")
multiplication = Multiplication(A=division, B=change_value_2)
panel = Panel(list_item)
subtraction = Subtraction(A=mon_fri_2, B=multiplication)
construct_domain = ConstructDomain(DomainStart=panel, DomainEnd="1")
remap_numbers = RemapNumbers(Value=subtraction, Source=construct_domain, Target=construct_domain)  # -> Mapped, Clipped

weeklyschedule = HBWeeklySchedule(sun=repeat_data, mon=mon_fri_2, tue=mon_fri_2, wed=mon_fri_2, thu=mon_fri_2, fri=mon_fri_2, sat=repeat_data)  # -> out, schedule, idf_year, idf_week, idf_days; plug-in component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
weeklyschedule_2 = HBWeeklySchedule(
    sun=repeat_data,
    mon=remap_numbers.Clipped,
    tue=remap_numbers.Clipped,
    wed=remap_numbers.Clipped,
    thu=remap_numbers.Clipped,
    fri=remap_numbers.Clipped,
    sat=repeat_data)  # -> out, schedule, idf_year, idf_week, idf_days; plug-in component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
list_length_2 = ListLength(List=change_period_2)
repeat_data_2 = RepeatData(Data=weeklyschedule_2.schedule, Length=list_length_2)
periods = Periods(text=change_period_2)  # -> period, hoys, dates
holiday = Holiday(values=list_item, list=national_holiday_2, date=national_holiday_2)  # -> holiday, period, hoys, dates
seasonalschedule = HBSeasonalSchedule(
    base_schedule=weeklyschedule.schedule,
    season_scheds=flatten([repeat_data_2, holiday.holiday]),
    analysis_periods=[periods.period, holiday.period])  # -> out, schedule, idf_year, idf_week, idf_days; plug-in component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
schedule = ClusterOutput(seasonalschedule.schedule)

# ==== cluster HeatingSchedule
data = ClusterInput()
data_2 = ClusterInput()
data_3 = ClusterInput()
data_4 = Data(data)
data_5 = Data(data_2)
data_6 = Data(data_3)
units = LBUnitConverter(values=data_4, from_u="C", to_u="K")  # -> all_u, values; plug-in component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

sort_list = SortList(Keys=data_4)  # -> Keys, ValuesValuesA
list_item = ListItem(List=sort_list.Keys, Index="0", Wrap=True)
list_length = ListLength(List=data_4)
repeat_data = RepeatData(Data=list_item, Length=list_length)

typelimit = HBTypeLimit(name="Temperature", low_limit="0", unit_type="Temperature")  # -> out, type_limit; plug-in component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
weeklyschedule = HBWeeklySchedule(
    sun=repeat_data,
    mon=data_4,
    tue=data_4,
    wed=data_4,
    thu=data_4,
    fri=data_4,
    sat=repeat_data,
    type_limit=typelimit.type_limit)  # -> out, schedule, idf_year, idf_week, idf_days; plug-in component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
holiday = Holiday(values=repeat_data, list=data_5, date=data_5)  # -> holiday, period, hoys, dates
periods = Periods(text=data_6)  # -> period, hoys, dates
seasonalschedule = HBSeasonalSchedule(
    base_schedule=weeklyschedule.schedule,
    season_scheds=flatten([weeklyschedule.schedule, holiday.holiday]),
    analysis_periods=[periods.period, holiday.period])  # -> out, schedule, idf_year, idf_week, idf_days; plug-in component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
schedule = ClusterOutput(seasonalschedule.schedule)

# ==== cluster CoolingSchedule
data = ClusterInput()
data_2 = ClusterInput()
data_3 = ClusterInput()
data_4 = Data(data)
data_5 = Data(data_2)
data_6 = Data(data_3)
units = LBUnitConverter(values=data_4, from_u="C", to_u="K")  # -> all_u, values; plug-in component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
typelimit = HBTypeLimit(name="Temperature", low_limit="0", unit_type="Temperature")  # -> out, type_limit; plug-in component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

sort_list = SortList(Keys=data_4)  # -> Keys, ValuesValuesA
list_item = ListItem(List=sort_list.Keys, Index="0", Wrap=True)
list_length = ListLength(List=data_4)
repeat_data = RepeatData(Data=list_item, Length=list_length)

weeklyschedule = HBWeeklySchedule(
    sun=repeat_data,
    mon=data_4,
    tue=data_4,
    wed=data_4,
    thu=data_4,
    fri=data_4,
    sat=repeat_data,
    type_limit=typelimit.type_limit)  # -> out, schedule, idf_year, idf_week, idf_days; plug-in component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
holiday = Holiday(values=repeat_data, list=data_6, date=data_6)  # -> holiday, period, hoys, dates
periods = Periods(text=data_5)  # -> period, hoys, dates
seasonalschedule = HBSeasonalSchedule(
    base_schedule=weeklyschedule.schedule,
    season_scheds=flatten([weeklyschedule.schedule, holiday.holiday]),
    analysis_periods=[periods.period, holiday.period])  # -> out, schedule, idf_year, idf_week, idf_days; plug-in component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
schedule = ClusterOutput(seasonalschedule.schedule)

# ==== cluster OccupancySchedule_2
mon_fri = ClusterInput()
mon_fri_2 = Data(mon_fri)
panel = Panel(mon_fri_2)
weeklyschedule = HBWeeklySchedule(sun=mon_fri_2, mon=mon_fri_2, tue=mon_fri_2, wed=mon_fri_2, thu=mon_fri_2, fri=mon_fri_2, sat=mon_fri_2)  # -> out, schedule, idf_year, idf_week, idf_days; plug-in component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
schedule = ClusterOutput(weeklyschedule.schedule)

# ==== cluster LightingSchedule_2
mon_fri = ClusterInput()
mon_fri_2 = Data(mon_fri)
weeklyschedule = HBWeeklySchedule(sun=mon_fri_2, mon=mon_fri_2, tue=mon_fri_2, wed=mon_fri_2, thu=mon_fri_2, fri=mon_fri_2, sat=mon_fri_2)  # -> out, schedule, idf_year, idf_week, idf_days; plug-in component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
schedule = ClusterOutput(weeklyschedule.schedule)

# ==== cluster HeatingSchedule_2
data = ClusterInput()
data_2 = Data(data)
units = LBUnitConverter(values=data_2, from_u="C", to_u="K")  # -> all_u, values; plug-in component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
typelimit = HBTypeLimit(name="Temperature", low_limit="0", unit_type="Temperature")  # -> out, type_limit; plug-in component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
panel = Panel(data_2)
weeklyschedule = HBWeeklySchedule(sun=data_2, mon=data_2, tue=data_2, wed=data_2, thu=data_2, fri=data_2, sat=data_2, type_limit=typelimit.type_limit)  # -> out, schedule, idf_year, idf_week, idf_days; plug-in component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
schedule = ClusterOutput(weeklyschedule.schedule)

# ==== cluster CoolingSchedule_2
data = ClusterInput()
data_2 = Data(data)
units = LBUnitConverter(values=data_2, from_u="C", to_u="K")  # -> all_u, values; plug-in component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
typelimit = HBTypeLimit(name="Temperature", low_limit="0", unit_type="Temperature")  # -> out, type_limit; plug-in component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
weeklyschedule = HBWeeklySchedule(sun=data_2, mon=data_2, tue=data_2, wed=data_2, thu=data_2, fri=data_2, sat=data_2, type_limit=typelimit.type_limit)  # -> out, schedule, idf_year, idf_week, idf_days; plug-in component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
schedule = ClusterOutput(weeklyschedule.schedule)

# ==== cluster Occupancy_sch
mon_sat = ClusterInput()
change_value = ClusterInput()
change_period = ClusterInput()
mon_sat_2 = Data(mon_sat)
change_value_2 = Data(change_value)
change_period_2 = Data(change_period)
division = Division(A=mon_sat_2, B="100")
sort_list = SortList(Keys=mon_sat_2)  # -> Keys, ValuesValuesA
multiplication = Multiplication(A=division, B=change_value_2)
subtraction = Subtraction(A=mon_sat_2, B=multiplication)
list_length = ListLength(List=mon_sat_2)
list_item = ListItem(List=sort_list.Keys, Index="0", Wrap=True)
panel = Panel(list_item)
construct_domain = ConstructDomain(DomainStart=panel, DomainEnd="1")
panel_2 = Panel(mon_sat_2)
repeat_data = RepeatData(Data=list_item, Length=list_length)
remap_numbers = RemapNumbers(Value=subtraction, Source=construct_domain, Target=construct_domain)  # -> Mapped, Clipped
panel_3 = Panel(remap_numbers.Clipped)
weeklyschedule = HBWeeklySchedule(sun=list_item, mon=mon_sat_2, tue=mon_sat_2, wed=mon_sat_2, thu=mon_sat_2, fri=mon_sat_2, sat=mon_sat_2)  # -> out, schedule, idf_year, idf_week, idf_days; plug-in component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
weeklyschedule_2 = HBWeeklySchedule(
    sun=list_item,
    mon=remap_numbers.Clipped,
    tue=remap_numbers.Clipped,
    wed=remap_numbers.Clipped,
    thu=remap_numbers.Clipped,
    fri=remap_numbers.Clipped,
    sat=remap_numbers.Clipped)  # -> out, schedule, idf_year, idf_week, idf_days; plug-in component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
national_holiday = ClusterInput()
national_holiday_2 = Data(national_holiday)
list_length_2 = ListLength(List=change_period_2)
holiday = Holiday(values=list_item, list=national_holiday_2, date=national_holiday_2)  # -> flatten(holiday), period, hoys, dates
periods = Periods_2(text=change_period_2)  # -> period, hoys, dates
repeat_data_2 = RepeatData(Data=weeklyschedule_2.schedule, Length=list_length_2)  # -> flatten(Data)
seasonalschedule = HBSeasonalSchedule(
    base_schedule=weeklyschedule.schedule,
    season_scheds=[repeat_data_2, holiday.holiday],
    analysis_periods=[holiday.period, periods.period])  # -> out, schedule, idf_year, idf_week, idf_days; plug-in component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
schedule = ClusterOutput(seasonalschedule.schedule)

# ==== cluster Heating_sch
mon_sat = ClusterInput()
change_period = ClusterInput()
mon_sat_2 = Data(mon_sat)
change_period_2 = Data(change_period)
division = Division(A=mon_sat_2, B="100")
sort_list = SortList(Keys=mon_sat_2)  # -> Keys, ValuesValuesA
multiplication = Multiplication(A=division)
subtraction = Subtraction(A=mon_sat_2, B=multiplication)
list_length = ListLength(List=mon_sat_2)
list_item = ListItem(List=sort_list.Keys, Index="0", Wrap=True)
panel = Panel(list_item)
construct_domain = ConstructDomain(DomainStart=panel, DomainEnd="1")
panel_2 = Panel(mon_sat_2)
repeat_data = RepeatData(Data=list_item, Length=list_length)
remap_numbers = RemapNumbers(Value=subtraction, Source=construct_domain, Target=construct_domain)  # -> Mapped, Clipped
units = LBUnitConverter(values=mon_sat_2, from_u="C", to_u="K")  # -> all_u, values; plug-in component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
panel_3 = Panel(remap_numbers.Clipped)
typelimit = HBTypeLimit(name="Temperature", low_limit="0", unit_type="Temperature")  # -> out, type_limit; plug-in component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
weeklyschedule = HBWeeklySchedule(
    sun=list_item,
    mon=mon_sat_2,
    tue=mon_sat_2,
    wed=mon_sat_2,
    thu=mon_sat_2,
    fri=mon_sat_2,
    sat=mon_sat_2,
    type_limit=typelimit.type_limit)  # -> out, schedule, idf_year, idf_week, idf_days; plug-in component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
weeklyschedule_2 = HBWeeklySchedule(
    sun=list_item,
    mon=remap_numbers.Clipped,
    tue=remap_numbers.Clipped,
    wed=remap_numbers.Clipped,
    thu=remap_numbers.Clipped,
    fri=remap_numbers.Clipped,
    sat=remap_numbers.Clipped,
    type_limit=typelimit.type_limit)  # -> out, schedule, idf_year, idf_week, idf_days; plug-in component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
national_holiday = ClusterInput()
national_holiday_2 = Data(national_holiday)
list_length_2 = ListLength(List=change_period_2)
holiday = Holiday(values=list_item, list=national_holiday_2, date=national_holiday_2)  # -> flatten(holiday), period, hoys, dates
periods = Periods_2(text=change_period_2)  # -> period, hoys, dates
repeat_data_2 = RepeatData(Data=weeklyschedule_2.schedule, Length=list_length_2)  # -> flatten(Data)
seasonalschedule = HBSeasonalSchedule(
    base_schedule=weeklyschedule.schedule,
    season_scheds=[repeat_data_2, holiday.holiday],
    analysis_periods=[holiday.period, periods.period])  # -> out, schedule, idf_year, idf_week, idf_days; plug-in component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
schedule = ClusterOutput(seasonalschedule.schedule)

# ==== cluster Holiday
date = ClusterInput()
values = ClusterInput()

deconstruct_date = DeconstructDate(Date=date)  # -> Year, Month, Day, Hour, Minute, Second
panel = Panel(deconstruct_date.Month)
panel_2 = Panel(deconstruct_date.Day)
analysisperiod = LBAnalysisPeriod(
    start_month=deconstruct_date.Month,
    start_day=deconstruct_date.Day,
    start_hour=0,
    end_month=deconstruct_date.Month,
    end_day=deconstruct_date.Day)  # -> period, hoys, dates; plug-in component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

panel_3 = Panel(values)
list = ClusterInput()

constantschedule = HBConstantSchedule(values=values, name="festività nazionali")  # -> out, schedule, idf_text; plug-in component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
list_length = ListLength(List=list)
repeat_data = RepeatData(Data=constantschedule.schedule, Length=list_length)

panel_4 = Panel(repeat_data)
holiday = ClusterOutput(repeat_data)
hoys = ClusterOutput(analysisperiod.hoys)
dates = ClusterOutput(analysisperiod.dates)
period = ClusterOutput(analysisperiod.period)

# ==== cluster Periods
text = ClusterInput()
replace_text = ReplaceText(Text=text, Find=" to ", Replace=" ", RecursiveReplace=False)
text_split = TextSplit(Text=replace_text, Separators=" ")  # -> simplify(Result)
panel = Panel(text_split)
list_item = ListItem(List=panel, Index="2", Wrap=True)  # -> flatten(Item)
list_item_2 = ListItem(List=panel, Index="0", Wrap=True)  # -> flatten(Item)
series = Series(Start="1", Step=1, Count="12")  # -> flatten(Series)
panel_2 = Panel(series)
panel_3 = Panel("""Jan
Feb
Mar
Apr
May
Jun
Jul
Aug
Sep
Oct
Nov
Dec""")
replace_members = ReplaceMembers(Set=list_item, Find=panel_3, Replace=series)  # -> flatten(Result)
replace_members_2 = ReplaceMembers(Set=list_item_2, Find=panel_3, Replace=series)  # -> flatten(Result)
list_item_3 = ListItem(List=panel, Index="1", Wrap=True)  # -> flatten(Item)
list_item_4 = ListItem(List=panel, Index="3", Wrap=True)  # -> flatten(Item)
analysisperiod = LBAnalysisPeriod(start_month=replace_members_2, start_day=list_item_3, start_hour=0, end_month=replace_members, end_day=list_item_4)  # -> period, hoys, dates; plug-in component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
period = ClusterOutput(analysisperiod.period)
dates = ClusterOutput(analysisperiod.dates)
hoys = ClusterOutput(analysisperiod.hoys)

# ==== cluster Periods_2
text = ClusterInput()
replace_text = ReplaceText(Text=text, Find=" to ", Replace=" ", RecursiveReplace=False)
text_split = TextSplit(Text=replace_text, Separators=" ")  # -> simplify(Result)
panel = Panel(text_split)
list_item = ListItem(List=panel, Index="0", Wrap=False)  # -> flatten(Item)
list_item_2 = ListItem(List=panel, Index="0", Wrap=False)  # -> flatten(Item)
series = Series(Start="1", Step=1, Count="12")  # -> flatten(Series)
panel_2 = Panel(list_item)
panel_3 = Panel("""Jan
Feb
Mar
Apr
May
Jun
Jul
Aug
Sep
Oct
Nov
Dec""")
panel_4 = Panel(series)
replace_members = ReplaceMembers(Set=list_item, Find=panel_3, Replace=series)  # -> flatten(Result)
replace_members_2 = ReplaceMembers(Set=list_item_2, Find=panel_3, Replace=series)  # -> flatten(Result)
list_item_3 = ListItem(List=panel, Index="1", Wrap=True)  # -> flatten(Item)
list_item_4 = ListItem(List=panel, Index="1", Wrap=True)  # -> flatten(Item)
analysisperiod = LBAnalysisPeriod(start_month=replace_members_2, start_day=list_item_3, start_hour=0, end_month=replace_members, end_day=list_item_4)  # -> period, hoys, dates; plug-in component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
period = ClusterOutput(analysisperiod.period)
dates = ClusterOutput(analysisperiod.dates)
hoys = ClusterOutput(analysisperiod.hoys)
