# Grasshopper definition LEED BDC Heat Island Reduction definition.gh (Grasshopper 1.0.7)
# plug-ins: HFTidyCanvas, Human, Wombat

# ---- group: EDIFICIO 1
geo = Geometry()

# ---- group: EXT PAVING 1
pavimentazione_1 = Surface(<surface referenced from the Rhino model>)

# ---- group: shadings
srf = Surface([<surface referenced from the Rhino model> x6])

# ----
area = Area(Geometry=srf)  # -> Area, Centroid

# ----
# make a copy of this group for every different ext paving material
# EXTERNAL PAVING 1
panel = Panel("concrete")
callfromepconstrlibrary = Honeybee_CallFromEPConstructionLibrary(keywords=panel)  # -> ThermMaterials, EPMaterials, EPWindowMaterials, EPConstructions; plug-in component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
list = ItemSelector(
    callfromepconstrlibrary.EPMaterials,
    {"8IN CONCRETE HW", "8IN CONCRETE HW REFBLDG", "M11 100MM LIGHTWEIGHT CONCRETE", "M15 200MM HEAVYWEIGHT CONCRETE", "MAT-CC05 4 HW CONCRETE", "MAT-CC05 8 HW CONCRETE"}, selected="8IN CONCRETE HW")
decomposeepmaterial = Honeybee_DecomposeEPMaterial(materialName=simplify(list))  # -> names, values, comments, UValue_SI, UValue_IP, RValue_SI, RValue_IP; plug-in component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
item = ListItem(List=decomposeepmaterial.values, Index="6", Wrap=True)  # -> Item, Item1
area_2 = Area(Geometry=pavimentazione_1)  # -> Area, Centroid
solar_abs = Number(item.Item1)

# ---- group: copia per ogni edificio
# BUILDING 1
geo_2 = Geometry(geo)
mass2zone = Honeybee_Masses2Zones(zoneMasses=flatten(geo_2), maxRoofAngle=30, createHBZones=Toggle(True))  # -> readMe, HBZones; plug-in component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
# make a copy of this group for every building that uses different materials
list_2 = ValueList({"GREEN ROOF": 0, "NON-GREEN ROOF": 1}, selected="GREEN ROOF")
fbd = BrepFacesByDirection(Brep=geo_2, Tolerance=0.9)  # -> Top, Bottom, Sides
area_3 = Area(Geometry=fbd.Sides)  # -> Area, Centroid
gate = StreamGate(Stream=fbd.Top, Gate=list_2)  # -> Target0, Target1
ma = MassAddition(Input=area_3.Area)  # -> Result, PartialResults

# ROOF
panel_2 = Panel("roof")
callfromepconstrlibrary_2 = Honeybee_CallFromEPConstructionLibrary(keywords=panel_2)  # -> ThermMaterials, EPMaterials, EPWindowMaterials, EPConstructions; plug-in component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
list_3 = ItemSelector(
    callfromepconstrlibrary_2.EPConstructions,
    {"ASHRAE 189.1-2009 EXTROOF IEAD CLIMATEZONE 1", "ASHRAE 189.1-2009 EXTROOF IEAD CLIMATEZONE 2-5", "ASHRAE 189.1-2009 EXTROOF IEAD CLIMATEZONE 6", "ASHRAE 189.1-2009 EXTROOF IEAD CLIMATEZONE 7-8", "ASHRAE 189.1-2009 EXTROOF METAL CLIMATEZONE 1", "ASHRAE 189.1-2009 EXTROOF METAL CLIMATEZONE 2-5"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}, selected="ASHRAE 90.1-2007 EXTROOF METAL CLIMATEZONE 2 SEMIHEATED")
decomposeepconstruction = Honeybee_DecomposeEPConstruction(cnstrName=list_3)  # -> materials, comments, UValue_SI, UValue_IP, RValue_SI, RValue_IP; plug-in component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
item_2 = ListItem(List=decomposeepconstruction.materials, Index=0, Wrap=True)
decomposeepmaterial_2 = Honeybee_DecomposeEPMaterial(materialName=simplify(item_2))  # -> names, values, comments, UValue_SI, UValue_IP, RValue_SI, RValue_IP; plug-in component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
item_3 = ListItem(List=decomposeepmaterial_2.values, Index="6", Wrap=True)  # -> Item, Item1
u_tetto = Panel(decomposeepconstruction.UValue_SI)
area_4 = Area(Geometry=gate.Target1)  # -> Area, Centroid
gate_2 = StreamGate(Stream=item_3.Item1, Gate=list_2)  # -> Target0, Target1
gate_3 = StreamGate(Stream=item_3.Item, Gate=list_2)  # -> Target0, Target1
solar_abs_2 = Number(gate_2.Target1)
thermal_abs = Number(gate_3.Target1)

# ---- group: copia per ogni edificio / GREENROOF
panel_3 = Panel("""Material:RoofVegetation,
GreenRoof,                        !- Name
    0.2,                     !- Height of Plants {m}
    1,                       !- Leaf Area Index {dimensionless}
    0.22,                    !- Leaf Reflectivity {dimensionless}
    0.95,                    !- Leaf Emissivity
    180,                     !- Minimum Stomatal Resistance {s/m}
    Green Roof Soil,         !- Soil Layer Name
    MediumRough,             !- Roughness
    0.1,                     !- Thickness {m}
    0.35,                    !- Conductivity of Dry Soil {W/m-K}
    1100,                    !- Density of Dry Soil {kg/m3}
    1200,                    !- Specific Heat of Dry Soil {J/kg-K}
    0.9,                     !- Thermal Absorptance
    0.7,                     !- Solar Absorptance
    0.75,                    !- Visible Absorptance
    0.3,                     !- Saturation Volumetric Moisture Content of the Soil Layer
    0.01,                    !- Residual Volumetric Moisture Content of the Soil Layer
    0.1,                     !- Initial Volumetric Moisture Content of the Soil Layer
    Advanced;                !- Moisture Diffusion Calculation Method""")
callfromepconstrlibrary_3 = Honeybee_CallFromEPConstructionLibrary(keywords="concrete")  # -> ThermMaterials, EPMaterials, EPWindowMaterials, EPConstructions; plug-in component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
panel_4 = Panel("GREEN_ROOF")
item_4 = ListItem(List=callfromepconstrlibrary_3.EPMaterials, Index=0, Wrap=True)
epconstruction = Honeybee_EnergyPlusConstruction(name=panel_4, layer_1=panel_3, layer_2=item_4)  # -> EPConstruction; plug-in component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
toggle = BooleanToggle(True)
addtoeplibrary = Honeybee_AddToEnergyPlusLibrary(EPObject=epconstruction, addToProjectLib=toggle, overwrite=toggle)  # -> readMe; plug-in component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

# ---- group: copia per ogni edificio
# EXT.WALLS
panel_5 = Panel("wall")
callfromepconstrlibrary_4 = Honeybee_CallFromEPConstructionLibrary(keywords=panel_5)  # -> ThermMaterials, EPMaterials, EPWindowMaterials, EPConstructions; plug-in component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
list_4 = ItemSelector(
    callfromepconstrlibrary_4.EPConstructions,
    {"AIR WALL", "ASHRAE 189.1-2009 EXTWALL MASS CLIMATEZONE 1", "ASHRAE 189.1-2009 EXTWALL MASS CLIMATEZONE 2", "ASHRAE 189.1-2009 EXTWALL MASS CLIMATEZONE 3", "ASHRAE 189.1-2009 EXTWALL MASS CLIMATEZONE 4", "ASHRAE 189.1-2009 EXTWALL MASS CLIMATEZONE 5"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}, selected="ASHRAE 90.1-2004 EXTWALL MASS CLIMATEZONE 1-2")
decomposeepconstruction_2 = Honeybee_DecomposeEPConstruction(cnstrName=list_4)  # -> materials, comments, UValue_SI, UValue_IP, RValue_SI, RValue_IP; plug-in component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
item_5 = ListItem(List=decomposeepconstruction_2.materials, Index=0, Wrap=True)
decomposeepmaterial_3 = Honeybee_DecomposeEPMaterial(materialName=simplify(item_5))  # -> names, values, comments, UValue_SI, UValue_IP, RValue_SI, RValue_IP; plug-in component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
item_6 = ListItem(List=decomposeepmaterial_3.values, Index="6", Wrap=True)  # -> Item, Item1
u_involucro = Panel(decomposeepconstruction_2.UValue_SI)
area_involucro = Number(ma.Result)
solar_abs_3 = Number(item_6.Item1)
thermal_abs_2 = Number(item_6.Item)

# GREEN ROOF
decomposeepconstruction_3 = Honeybee_DecomposeEPConstruction(cnstrName=panel_4)  # -> materials, comments, UValue_SI, UValue_IP, RValue_SI, RValue_IP; plug-in component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
item_7 = ListItem(List=decomposeepconstruction_3.materials, Index=0, Wrap=True)
decomposeepmaterial_4 = Honeybee_DecomposeEPMaterial(materialName=simplify(item_7))  # -> names, values, comments, UValue_SI, UValue_IP, RValue_SI, RValue_IP; plug-in component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
u_involucro_2 = Panel(decomposeepconstruction_3.UValue_SI)
item_8 = ListItem(List=decomposeepmaterial_4.values, Index="12", Wrap=True)  # -> Item, Item1
gate_4 = StreamGate(Stream=item_8.Item, Gate=list_2)  # -> Target0, Target1
gate_5 = StreamGate(Stream=item_8.Item1, Gate=list_2)  # -> Target0, Target1
area_5 = Area(Geometry=gate.Target0)  # -> Area, Centroid
thermal_abs_3 = Number(gate_4.Target0)
solar_abs_4 = Number(gate_5.Target0)

# ----
ladybug = Ladybug_Ladybug()  # -> Vviiiiiiiiiizzz; plug-in component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
honeybee = Honeybee_Honeybee()  # -> Vviiiiiiiiiizzz; plug-in component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

# ----
# ROOFS
merge = Merge(Data1=solar_abs_2)
merge_2 = Merge(Data1=thermal_abs)
merge_3 = Merge(Data1=area_4.Area)
thermal_abs_4 = THERMEMISS(merge_2)
solar_abs_5 = SOLARABS(merge)
area_cop = SOLARABS(merge_3)

# ----
# EXT PAVINGS
merge_4 = Merge(Data1=solar_abs)  # -> flatten(Result)
merge_5 = Merge(Data1=area_2.Area)
area_vap = SOLARABS(merge_5)
solar_abs_6 = SOLARABS(merge_4)

# ----
# ENVELOPE
merge_6 = Merge(Data1=solar_abs_3)
merge_7 = Merge(Data1=area_involucro)
envelope_area = SOLARABS(merge_7)
solar_abs_7 = SOLARABS(merge_6)

# ----
# GREEN ROOFS
merge_8 = Merge(Data1=area_5.Area)
green_roofs_area = SOLARABS(merge_8)

# ----
# LEED params
list_5 = ValueList({"SRI pendenza < 15%": 82, "SRI pendenza > 15%": 39}, selected="SRI pendenza < 15%")
sri_pendenza_15 = Panel("82")
sri_pendenza_15_2 = Panel("39")

sr_leed = Panel("0.3")

# ---- group: PAVIM
# SR (non roof)
panel_6 = Panel("1")
subtraction = Subtraction(A=panel_6, B=solar_abs_6)
num = Number(subtraction)

# ---- group: INVOLUCRO
# SR (non roof)
panel_7 = Panel("1")
subtraction_2 = Subtraction(A=panel_7, B=solar_abs_7)
num_2 = Number(subtraction_2)

# ----
# SRI (roof)
sri_calculator = SRICALCULATOR(solar_abs=solar_abs_5, thermal_emis=thermal_abs_4)  # -> srf_temp_2, sri_2

panel_8 = Panel(sri_calculator.sri_2)
panel_9 = Panel(sri_calculator.srf_temp_2)

# ----
# test
envelope_area_2 = Number(envelope_area)
larger = LargerThan(FirstNumber=num_2, SecondNumber=sr_leed)  # -> LargerThan, OrEqualTo
expression = Expression(x=larger.OrEqualTo, y=envelope_area_2, Expression="If(x=True,y,0)")

# ----
# LEED test SRI for roofs
area_copertura = Number(area_cop)
larger_2 = LargerThan(FirstNumber=sri_calculator.sri_2, SecondNumber=list_5)  # -> LargerThan, OrEqualTo
expression_2 = Expression(x=larger_2.LargerThan, y=area_copertura, Expression="If(x=True,y,0)")

# ----
# test
area_pav = Number(area_vap)
larger_3 = LargerThan(FirstNumber=num, SecondNumber=sr_leed)  # -> LargerThan, OrEqualTo
expression_3 = Expression(x=larger_3.OrEqualTo, y=area_pav, Expression="If(x=True,y,0)")

# ----
# NON ROOF
ma_2 = MassAddition(Input=flatten(expression))  # -> Result, PartialResults
ma_3 = MassAddition(Input=flatten(expression_3))  # -> Result, PartialResults
area_pavim_est = Number(ma_3.Result)
area_involucro_2 = Number(ma_2.Result)
addition = Addition(A=area_involucro_2, B=area_pavim_est)
division = Division(A=addition, B="0.5")

high_sri_roof_srf = SOLARABS(expression_2)
green_roof_srf = SOLARABS(merge_8)
shading_area = DataDescription(area.Area)

# ----
# High SRI Roofs
ma_4 = MassAddition(Input=high_sri_roof_srf)  # -> Result, PartialResults
division_2 = Division(A=ma_4.Result, B="0.75")

# ----
# GREEN ROOFS
ma_5 = MassAddition(Input=green_roof_srf)  # -> Result, PartialResults
division_3 = Division(A=ma_5.Result, B="0.75")

# ----
# shading area
# (min SR=0.3)
ma_6 = MassAddition(Input=flatten(shading_area))  # -> Result, PartialResults

ma_7 = MassAddition(Input=flatten([division, division_2, division_3, ma_6.Result]))  # -> Result, PartialResults

# ----
# calcolo sup totali
data_1 = DataDescription(geo)
data_2 = DataDescription()
data_3 = DataDescription()
data_1_2 = DataDescription(pavimentazione_1)
data_2_2 = DataDescription()

# ---- group: EDIFICI
merge_9 = Merge(Data1=data_1, Data2=data_2, Data3=data_3)

# ---- group: PAVIMNTAZIONI
merge_10 = Merge(Data1=data_1_2, Data2=data_2_2)

# ----
join = BrepJoin(Breps=merge_10)  # -> Breps, Closed
fmerge = MergeFaces(Brep=join.Breps)  # -> Breps, Before, After
fbd_2 = BrepFacesByDirection(Brep=merge_9, Tolerance=0.9)  # -> Top, Bottom, Sides
splitmul = SplitBrepMultiple(Brep=fmerge.Breps, Cutters=merge_9)
srf_2 = Surface(fbd_2.Top)
area_6 = Area(Geometry=splitmul)  # -> Area, Centroid
area_7 = Area(Geometry=flatten(srf_2))  # -> Area, Centroid
sort = SortList(Keys=area_6.Area, ValuesA=splitmul)  # -> reverse(Keys), reverse(ValuesA)
ma_8 = MassAddition(Input=flatten(area_7.Area))  # -> Result, PartialResults
item_9 = ListItem(List=sort.ValuesA, Index=0, Wrap=True)

# ---- group: AREA TOTALE PAVIMENTAZIONE
num_3 = Number(item_9)

# ---- group: AREA TOT COPERTURE
num_4 = Number(ma_8.Result)

# ---- group: area sup pavimentate esterne del sito
num_5 = Number(num_3)

# ---- group: area tot coopertura
num_6 = Number(num_4)

# ----
addition_2 = Addition(A=num_5, B=num_6)

total_srf = Number(addition_2)
larger_4 = LargerThan(FirstNumber=ma_7.Result, SecondNumber=total_srf)  # -> LargerThan, OrEqualTo
bool = Boolean(larger_4.LargerThan)
filter = StreamFilter(Gate=bool, Stream0="you've NOT PASSED LEED v4", Stream1="you've PASSED LEED v4")
panel_10 = Panel(filter)

# ==== cluster SRICALCULATOR: Calcola Sri e temp superficiale a partire da solar absorption. e therm absorption secondo lo standard ASTM E 1980
solar_abs = ClusterInput()
thermal_emis = ClusterInput()
srf_temp_calc = SRFTEMP(solar_abs=solar_abs, thermal_emis=thermal_emis)
temp_srf_black_k = Panel("355.608311803837")
temp_srf_white_k = Panel("317.757866088005")
expression = Expression(x=temp_srf_black_k, y=srf_temp_calc, z=temp_srf_white_k, Expression="100*(x-y)/(x-z)")
subtraction = Subtraction(A=srf_temp_calc, B="273.15")
srf_temp = Number(subtraction)
sri = Number(expression)
srf_temp_2 = ClusterOutput(srf_temp)
sri_2 = ClusterOutput(sri)

# ==== cluster SRFTEMP: Calcola la temperatura superficiale a partire dalla solar abpsorptance e la thermal emissivity secondo lo standard ASTM E 1980
solar_abs = ClusterInput()
thermal_emis = ClusterInput()
solar_abs_2 = Number(solar_abs)
subtraction = Subtraction(A="1", B=solar_abs_2)
thermal_emis_2 = Number(thermal_emis)

# ---- group: solar reflect
solar_abs_3 = Number(subtraction)

# ----
# 12 è il coefficiente convettivo in condizioni di vento medie
expression = Expression(x=solar_abs_3, y=thermal_emis_2, Expression="((890.94*x^2)+(2153.86*x*y))/(6.78*y+12)^2")
expression_2 = Expression(x=solar_abs_3, y=thermal_emis_2, Expression="((1066.07*x)-(31.98*y))/(6.78*y+12)")
subtraction_2 = Subtraction(A=expression_2, B=expression)
addition = Addition(A="309.07", B=subtraction_2)
srf_temp = Number(addition)
srf_temp_2 = ClusterOutput(srf_temp)
