# Grasshopper definition LEED SS OPEN SPACEi.gh (Grasshopper 1.0.7)
# plug-ins: EleFront, Pufferfish, HFTidyCanvas

# ----
# NON - GREEN AREAS
list = ValueList({"BUILDINGS", "Green Areas", "pavemented area", "ROADS", "trees"}, selected=["pavemented area", "ROADS"])
reflay = ReferenceByLayer(LayerName=list)  # -> flatten(Geometry)
list_2 = ValueList({"Point": 0, "Curve": 1, "Arc": 2, "Circle": 3, "Ellipse": 4, "Line": 5, "Polyline": 6, "Surface": 7, "Brep": 8, "Mesh": 9, "Polysurface": 10, "Block": 11, "Text": 12, "TextDot": 13, "Dimension": 14, "LinearDimension": 15, "AngularDimension": 16, "Hatch": 17, "Leader": 18}, selected="Surface")
txt = Text(graft(list))
filtertype = FilterByType(Geometry=reflay, ObjectType=list_2)
item = ListItem(List=txt, Index=-1, Wrap=True)
clean = CleanTree(RemoveNulls=True, RemoveInvalid=True, RemoveEmpty=False, Tree=filtertype)
srf = Surface(clean)
split = TextSplit(Text=item, Separators=":")
area = Area(Geometry=srf)  # -> Area, Centroid
item_2 = ListItem(List=split, Index=-1, Wrap=True)  # -> flatten(Item)
ma = MassAddition(Input=flatten(area.Area))  # -> Result, PartialResults

# ---- group: Buildings Layer
list_3 = ValueList({"BUILDINGS", "Green Areas", "Livello 05", "pavemented area", "Predefinito", "trees"}, selected="BUILDINGS")

# ----
# BUILDINGS
list_4 = ValueList({"BUILDINGS", "Green Areas", "GREEN ROOF BUILDINGS", "pavemented area", "ROADS", "trees"}, selected="GREEN ROOF BUILDINGS")
list_5 = ValueList({"Point": 0, "Curve": 1, "Arc": 2, "Circle": 3, "Ellipse": 4, "Line": 5, "Polyline": 6, "Surface": 7, "Brep": 8, "Mesh": 9, "Polysurface": 10, "Block": 11, "Text": 12, "TextDot": 13, "Dimension": 14, "LinearDimension": 15, "AngularDimension": 16, "Hatch": 17, "Leader": 18}, selected="Brep")
reflay_2 = ReferenceByLayer(LayerName=list_4)
txt_2 = Text(list_4)
list_6 = ValueList({"Point": 0, "Curve": 1, "Arc": 2, "Circle": 3, "Ellipse": 4, "Line": 5, "Polyline": 6, "Surface": 7, "Brep": 8, "Mesh": 9, "Polysurface": 10, "Block": 11, "Text": 12, "TextDot": 13, "Dimension": 14, "LinearDimension": 15, "AngularDimension": 16, "Hatch": 17, "Leader": 18}, selected="Brep")
split_2 = TextSplit(Text=txt_2, Separators=":")
reflay_3 = ReferenceByLayer(LayerName=list_3)
txt_3 = Text(list_3)
item_3 = ListItem(List=split_2, Index=-1, Wrap=True)
filtertype_2 = FilterByType(Geometry=reflay_2, ObjectType=list_5)
split_3 = TextSplit(Text=txt_3, Separators=":")
filtertype_3 = FilterByType(Geometry=reflay_3, ObjectType=list_6)
tag = Data(item_3)
clean_2 = CleanTree(RemoveNulls=True, RemoveInvalid=True, RemoveEmpty=False, Tree=filtertype_2)
item_4 = ListItem(List=split_3, Index=-1, Wrap=True)
clean_3 = CleanTree(RemoveNulls=True, RemoveInvalid=True, RemoveEmpty=False, Tree=filtertype_3)
top_roof_extraction = GreenRoofFinder(green_roof_building=clean_2)  # -> green_roofs_total_area_2, green_roofs_2, tag_3
cluster = BuildingFootprintArea(B=clean_3, tag=item_4)  # -> total_buildings_area_2, building_footprint_2, tag_3
srf_2 = Surface(top_roof_extraction.green_roofs_2)
srf_3 = Surface(cluster.building_footprint_2)

# ----
# GREEN AREAS
list_7 = ValueList({"BUILDINGS", "Green Areas", "GREEN ROOF BUILDINGS", "pavemented area", "ROADS", "trees"}, selected="Green Areas")
reflay_4 = ReferenceByLayer(LayerName=list_7)
txt_4 = Text(list_7)
split_4 = TextSplit(Text=txt_4, Separators=":")
srf_4 = Surface(reflay_4)
item_5 = ListItem(List=split_4, Index=-1, Wrap=True)
area_2 = Area(Geometry=srf_4)  # -> Area, Centroid
tag_2 = Data(item_5)
ma_2 = MassAddition(Input=flatten(area_2.Area))  # -> Result, PartialResults

# ----
# LEED BD+C OPEN SPACE
# Fornire spazi esterni per almeno il 30% dell'area complessiva di progetto, inclusa l'impronta dell'edificio. Almeno il 25%
# di tali spazi deve essere vegetato (i tappeti erbosi non sono conteggiabili come vegetati) o presentare elementi pensili
# vegetati.
far = Slider(2, range=0..10)
smaller = SmallerThan(FirstNumber=far, SecondNumber=1.5)  # -> SmallerThan, OrEqualTo
list_8 = ValueList({"BUILDINGS", "Green Areas", "GREEN ROOF BUILDINGS", "pavemented area", "ROADS", "trees"}, selected="trees")
bool = Boolean(smaller.OrEqualTo)

# ---- group: green areas
num = Number(ma_2.Result)

# ----
reflay_5 = ReferenceByLayer(LayerName=list_8)  # -> flatten(Trees)

# ---- group: Building area
num_2 = Number(cluster.total_buildings_area_2)

# ---- group: Green roofs' area
num_3 = Number(top_roof_extraction.green_roofs_total_area_2)

# ----
topsrfarea = TopSrfArea(B=srf_4)  # -> area_2, srf, tag_3

# ---- group: NON GREEN AREAS
num_4 = Number(ma.Result)

# ----
dispatch = Dispatch(List=num_3, DispatchPattern=bool)  # -> ListA, ListB

# ---- group: green roof
num_5 = Number(dispatch.ListB)

# ----
addition = Addition(A=num, B=num_5)
area_3 = Area(Geometry=reflay_5)  # -> Area, Centroid

# ----
# TREES IN OPEN SPACES
number_slider = Slider(81, range=0..100)
Z = UnitZ(Factor=1)
line = LineSDL(Start=area_3.Centroid, Direction=expr("-x", Z), Length=number_slider)
slx = SurfaceLine(Surface=topsrfarea.srf, Line=graft(line), LimitToFirst=False)  # -> Curves, Points, UVPoints, Normal
pt = Point(flatten(slx.Points))
cp = ClosestPoint(Point=pt, Cloud=area_3.Centroid)  # -> ClosestPoint, CPIndex, Distance
item_6 = ListItem(List=reflay_5, Index=cp.CPIndex, Wrap=True)

panel = Panel(num_2)

# ---- group: Building footprint
num_6 = Number(num_2)

# ---- group: non green areas
num_7 = Number(num_4)

# ---- group: green areas
num_8 = Number(addition)

# ----
addition_2 = Addition(A=num_6, B=num_7, C=num_8)
addition_3 = Addition(B=num_7, C=num_8)

# ---- group: open spaces
num_9 = Number(addition_3)

# ---- group: total area
num_10 = Number(addition_2)

# ----
# VEGETATED %
item_7 = DataDescription(item_6)
topsrfarea_2 = TopSrfArea(B=item_7)  # -> area_2, srf, tag_3
green_areas = DataDescription(num_9)
srf_5 = Surface(topsrfarea_2.srf)
eval = Evaluate(F="(x*100)/y", x=topsrfarea_2.area_2, y=green_areas)

open_spaces = Number(addition_3)
total_area = Number(num_10)

# ----
# OPEN SPACE TEST
panel_2 = Panel("(x*100)/y")
leed_limit = Panel("30")
eval_2 = Evaluate(F=panel_2, x=open_spaces, y=total_area)
subtraction = Subtraction(A=leed_limit, B=eval_2)
smaller_2 = SmallerThan(FirstNumber=eval_2, SecondNumber=leed_limit)  # -> SmallerThan, OrEqualTo
eval_3 = Evaluate(F="(x/100)*y", x=subtraction, y=total_area)
panel_3 = Panel("Mancano ")
roundd = RoundToDecimalPlace(NumberX=eval_3, DecimalPlace=Slider(2, range=0..10), RoundType=0)  # -> Rounded, Difference
concat = Concatenate(FragmentB=roundd.Rounded, FragmentC=" m2 of open spaces are required to pass LEED")
filter = StreamFilter(Gate=smaller_2.SmallerThan, Stream0="LEED v4 NOT passed", Stream1="LEED v4 passed!")
filter_2 = StreamFilter(Gate=smaller_2.SmallerThan, Stream0="check vegetated areas", Stream1=concat)

# ----
# VEGETATED AREA TEST
leed_limit_2 = Panel("25")
subtraction_2 = Subtraction(A=leed_limit_2, B=eval)
smaller_3 = SmallerThan(FirstNumber=eval, SecondNumber=leed_limit_2)  # -> SmallerThan, OrEqualTo
eval_4 = Evaluate(F="(x/100)*y", x=subtraction_2, y=green_areas)
panel_4 = Panel("implement")
roundd_2 = RoundToDecimalPlace(NumberX=eval_4, DecimalPlace=Slider(2, range=0..10), RoundType=0)  # -> Rounded, Difference
filter_3 = StreamFilter(Gate=smaller_3.SmallerThan, Stream0="LEED v4 passed!", Stream1="LEED v4 NOT passed")
concat_2 = Concatenate(FragmentB=roundd_2.Rounded, FragmentC=" m2 of vegetated areas are required to pass LEED")
filter_4 = StreamFilter(Gate=smaller_3.SmallerThan, Stream0="check veget", Stream1=concat_2)

panel_5 = Panel(filter)
panel_6 = Panel(filter_2)
panel_7 = Panel(filter_3)
panel_8 = Panel(filter_4)
and = GateAnd(A=smaller_2.SmallerThan, B=smaller_3.SmallerThan)
filter_5 = StreamFilter(Gate=and, Stream0="LEED v4 NOT passed", Stream1="LEED v4 passed!")
panel_9 = Panel(filter_5)
panel_10 = Panel(panel_8)
panel_11 = Panel(panel_6)

# ==== cluster BuildingFootprintArea
B = ClusterInput()
tag = ClusterInput()
debrep = DeconstructBrep(Brep=B)  # -> Faces, Edges, Vertices
tag_2 = Data(tag)
area = Area(Geometry=debrep.Faces)  # -> Area, Centroid
tag_3 = ClusterOutput(tag_2)
pdecon = Deconstruct(Point=area.Centroid)  # -> XComponent, YComponent, ZComponent
sort = SortList(Keys=pdecon.ZComponent, ValuesA=area.Area, ValuesB=debrep.Faces)  # -> Keys, ValuesA, ValuesB
item = ListItem(List=sort.ValuesB, Index=0, Wrap=True)  # -> flatten(Item)
item_2 = ListItem(List=sort.ValuesA, Index=0, Wrap=True)  # -> flatten(Item)
ma = MassAddition(Input=item_2)  # -> BuildArea, PartialResults
building_footprint = Surface(item)
total_buildings_area = Number(ma.BuildArea)
building_footprint_2 = ClusterOutput(building_footprint)
total_buildings_area_2 = ClusterOutput(total_buildings_area)

# ==== cluster TopSrfArea: calcola l'area della superficie superiore di un solido
B = ClusterInput()
tag = ClusterInput()
debrep = DeconstructBrep(Brep=B)  # -> Faces, Edges, Vertices
tag_2 = Data(tag)
area = Area(Geometry=debrep.Faces)  # -> Area, Centroid
tag_3 = ClusterOutput(tag_2)
sort = SortList(Keys=area.Area, ValuesA=debrep.Faces)  # -> Keys, ValuesA
item = ListItem(List=sort.Keys, Index="-1", Wrap=True)  # -> flatten(Item)
item_2 = ListItem(List=sort.ValuesA, Index="-1", Wrap=True)  # -> flatten(Item)
ma = MassAddition(Input=item)  # -> BuildArea, PartialResults
srf = ClusterOutput(item_2)
area_2 = ClusterOutput(ma.BuildArea)

# ==== cluster GreenRoofFinder: Extracts the top roof of a building solid
tag = ClusterInput()
green_roof_building = ClusterInput()
tag_2 = Text(tag)
green_roof_building_2 = Brep(green_roof_building)
tag_3 = ClusterOutput(tag_2)
debrep = DeconstructBrep(Brep=green_roof_building_2)  # -> Faces, Edges, Vertices
evalsrf = EvaluateSurface(Surface=reparameterize(debrep.Faces), Point="{0.5, 0.5, 0}")  # -> Point, Normal, UDirection, VDirection, Frame
devec = DeconstructVector(Vector=evalsrf.Normal)  # -> XComponent, YComponent, ZComponent
abs = Absolute(Value=devec.ZComponent)
equals = Equality(FirstNumber=abs, SecondNumber=1)  # -> Equality, Inequality
cull = CullPattern(List=debrep.Faces, CullPattern=equals.Equality)
area = Area(Geometry=cull)  # -> Area, Centroid
pdecon = Deconstruct(Point=area.Centroid)  # -> XComponent, YComponent, ZComponent
sort = SortList(Keys=pdecon.ZComponent, ValuesA=cull)  # -> Keys, ValuesA
cull_i = CullIndex(List=sort.ValuesA, Indices="0", Wrap=True)
area_2 = Area(Geometry=cull_i)  # -> Area, Centroid
ma = MassAddition(Input=flatten(area_2.Area))  # -> GreenRoofTotArea, PartialResults
green_roofs = Surface(cull_i)
green_roofs_total_area = Number(ma.GreenRoofTotArea)
green_roofs_total_area_2 = ClusterOutput(green_roofs_total_area)
green_roofs_2 = ClusterOutput(green_roofs)
