# Grasshopper definition OUTDOOR SIMULATIONS+ELEFRONT.gh (Grasshopper 1.0.7)
# plug-ins: Ironbug.LBHB_Legacy, ExcelReadWrite, MeshEdit Components, Human, EleFront

toggle = BooleanToggle(True)
updateladybug = Ladybug_UpdateLadybug(updateAllUObjects=toggle)  # -> readMe; plug-in component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
updatehoneybee = Honeybee_UpdateHoneybee(updateAllUObjects=toggle)  # -> readMe; plug-in component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
ladybug = Ladybug_Ladybug()  # -> Vviiiiiiiiiizzz; plug-in component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
honeybee = Honeybee_Honeybee()  # -> Vviiiiiiiiiizzz; plug-in component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
updateghfile = Ladybug_UpdateFile(update=toggle)  # -> readMe; plug-in component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

toggle_2 = BooleanToggle(False)
toggle_3 = BooleanToggle(True)

list = ValueList({"3D", "3D::BUILDINGS", "3D::BUILT-OPEN-SPACE", "3D::ROADS", "3D::VEGETATED_AREAS", "Alberi_Pensiline", "BUILT_OPEN_SPACE", "old_BUILDINGS", "old_BUILT OPEN SPACE", "old_ROADS", "old_TREES", "old_VEGETATED AREAS", "PERIMETRO", "ROADS", "TREES", "VEGETATED_AREAS"}, selected="3D::BUILDINGS")
reflay = ReferenceByLayer(LayerName=list)
cluster = Cluster_4(T=list, G=reflay, isconditioned=toggle_2, createhbzones=toggle_3)  # -> txt_2, geometries, hbzones, open_breps
ob_tester = GhPythonScript(x=cluster.open_breps)  # inputs x: list of Brep
# ---------- ob_tester: Python ----------
import rhinoscriptsyntax as rs

import Grasshopper.Kernel as gh


e = gh.GH_RuntimeMessageLevel.Error
w = gh.GH_RuntimeMessageLevel.Warning

if len(x)>0:
    ghenv.Component.AddRuntimeMessage(w, 'Open Breps here!')

#ghenv.Component.AddRuntimeMessage(e, 'this is an error!')
# ---------- end ob_tester ----------
createepground = Honeybee_CreateEPGround(HBZones=cluster.hbzones, soilTypeOrMat="2")  # -> HBGrndZones; plug-in component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

list_2 = ValueList({"3D", "3D::BUILDINGS", "3D::BUILT-OPEN-SPACE", "3D::ROADS", "3D::VEGETATED_AREAS", "Alberi_Pensiline", "BUILT_OPEN_SPACE", "old_BUILDINGS", "old_BUILT OPEN SPACE", "old_ROADS", "old_TREES", "old_VEGETATED AREAS", "PERIMETRO", "ROADS", "TREES", "VEGETATED_AREAS"}, selected="3D::BUILT-OPEN-SPACE")
reflay_2 = ReferenceByLayer(LayerName=list_2)
cluster_2 = Cluster_4(T=list_2, G=reflay_2, isconditioned=toggle_2, createhbzones=toggle_3)  # -> txt_2, geometries, hbzones, open_breps
ob_tester_2 = GhPythonScript(x=cluster_2.open_breps)  # inputs x: list of Brep; same code as ob_tester
createepground_2 = Honeybee_CreateEPGround(HBZones=cluster_2.hbzones, soilTypeOrMat="2")  # -> HBGrndZones; plug-in component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

list_3 = ValueList({"3D", "3D::BUILDINGS", "3D::BUILT-OPEN-SPACE", "3D::ROADS", "3D::VEGETATED_AREAS", "Alberi_Pensiline", "BUILT_OPEN_SPACE", "old_BUILDINGS", "old_BUILT OPEN SPACE", "old_ROADS", "old_TREES", "old_VEGETATED AREAS", "PERIMETRO", "ROADS", "TREES", "VEGETATED_AREAS"}, selected="3D::ROADS")
reflay_3 = ReferenceByLayer(LayerName=list_3)
cluster_3 = Cluster_4(T=list_3, G=reflay_3, isconditioned=toggle_2, createhbzones=toggle_3)  # -> txt_2, geometries, hbzones, open_breps
ob_tester_3 = GhPythonScript(x=cluster_3.open_breps)  # inputs x: list of Brep
# ---------- ob_tester_3: Python ----------
import rhinoscriptsyntax as rs

import Grasshopper.Kernel as gh


e = gh.GH_RuntimeMessageLevel.Error
w = gh.GH_RuntimeMessageLevel.Warning

if len(x)>0:
    ghenv.Component.AddRuntimeMessage(w, 'Open Breps here!')
# ---------- end ob_tester_3 ----------
createepground_3 = Honeybee_CreateEPGround(HBZones=cluster_3.hbzones, soilTypeOrMat="2")  # -> HBGrndZones; plug-in component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

list_4 = ValueList({"3D", "3D::BUILDINGS", "3D::BUILT-OPEN-SPACE", "3D::ROADS", "3D::VEGETATED_AREAS", "Alberi_Pensiline", "BUILT_OPEN_SPACE", "old_BUILDINGS", "old_BUILT OPEN SPACE", "old_ROADS", "old_TREES", "old_VEGETATED AREAS", "PERIMETRO", "ROADS", "TREES", "VEGETATED_AREAS"}, selected="3D::VEGETATED_AREAS")
reflay_4 = ReferenceByLayer(LayerName=list_4)
cluster_4 = Cluster_4(T=list_4, G=reflay_4, isconditioned=toggle_2, createhbzones=toggle_3)  # -> txt_2, geometries, hbzones, open_breps
ob_tester_4 = GhPythonScript(x=cluster_4.open_breps)  # inputs x: list of Brep; same code as ob_tester
createepground_4 = Honeybee_CreateEPGround(HBZones=cluster_4.hbzones, soilTypeOrMat="2")  # -> HBGrndZones; plug-in component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

list_5 = ValueList({"Alberi_Pensiline", "BIOSWALE", "BUILDINGS", "COOL_FLOORING", "GRASSY_JOINT", "LAWNS", "PERIMETRO", "PERMEABLE", "URBAN_AGRI"}, selected="URBAN_AGRI")  # disabled
reflay_5 = ReferenceByLayer(LayerName=list_5)  # disabled
cluster_5 = Cluster_4(T=list_5, G=reflay_5, isconditioned=toggle_2, createhbzones=toggle_3)  # -> txt_2, geometries, hbzones, open_breps; disabled
ob_tester_5 = GhPythonScript(x=cluster_5.open_breps)  # inputs x: list of Brep; disabled; same code as ob_tester
panel = Panel("2")  # disabled
createepground_5 = Honeybee_CreateEPGround(HBZones=cluster_5.hbzones, soilTypeOrMat=panel)  # -> HBGrndZones; disabled; plug-in component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

list_6 = ValueList({"Alberi_Pensiline", "BIOSWALE", "BUILDINGS", "COOL FLOORING", "Default", "GRASSY JOINT", "LAWNS", "PERMEABLE", "URBAN AGRI"}, selected="LAWNS")  # disabled
reflay_6 = ReferenceByLayer(LayerName=list_6)  # disabled
cluster_6 = Cluster_4(T=list_6, G=reflay_6, isconditioned=toggle_2, createhbzones=toggle_3)  # -> txt_2, geometries, hbzones, open_breps; disabled
ob_tester_6 = GhPythonScript(x=cluster_6.open_breps)  # inputs x: list of Brep; disabled; same code as ob_tester
panel_2 = Panel("2")  # disabled
createepground_6 = Honeybee_CreateEPGround(HBZones=cluster_6.hbzones, soilTypeOrMat=panel_2)  # -> HBGrndZones; disabled; plug-in component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

list_7 = ValueList({"Alberi_Pensiline", "BIOSWALE", "BUILDINGS", "COOL FLOORING", "Default", "GRASSY JOINT", "LAWNS", "PERMEABLE", "URBAN AGRI"}, selected="PERMEABLE")  # disabled
reflay_7 = ReferenceByLayer(LayerName=list_7)  # disabled
cluster_7 = Cluster_4(T=list_7, G=reflay_7, isconditioned=toggle_2, createhbzones=toggle_3)  # -> txt_2, geometries, hbzones, open_breps; disabled
ob_tester_7 = GhPythonScript(x=cluster_7.open_breps)  # inputs x: list of Brep; disabled; same code as ob_tester
panel_3 = Panel("2")  # disabled
createepground_7 = Honeybee_CreateEPGround(HBZones=cluster_7.hbzones, soilTypeOrMat=panel_3)  # -> HBGrndZones; disabled; plug-in component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

list_8 = ValueList({"Paris rcp4.5 2020-2040_occasional": 0, "Paris rcp4.5 2041-2070_occasional": 1, "Paris rcp4.5 2071-2100_occasional": 2, "Paris rcp8.5 2020-2040_occasional": 3, "Paris rcp8.5 2041-2070_occasional": 4, "Paris rcp8.5 2071-2100_occasional": 5}, selected="Paris rcp4.5 2020-2040_occasional")

# ---- group: RUN-OFF ADAP
data = Data(["green surface a      0,15", "green surface b      0,18", "green surface c      0,22", "trees a      0,75", "trees b      0,75", "trees c      0,75", "permeable flooring a      0,35", "permeable flooring b      0,45", "perbeable flooring c      0,6", "relective surface a      0,75", "reflective surface b      0,75", "reflective surface c      0,75", "green roofs a      0,2", "green roofs b      0,35", "cool roofs a      0,75", "cool roofs b      0,75", "cool roofs c      0,75", "canopy a      0,75", "canopy b      0,75", "canopy c      0,75", "water bodies a      0,1", "water bodies b      0,85", "water squares      0,15", "gutter      0,15"])

# ---- group: RUNOFF SDF
data_2 = Data(["agricultural areas    0,1", "Bare soil    0,1", "buildings    0,9", "Built open spaces    0,75", "Railways    0,2", "roads    0,1", "roads    0,9", "sports facilities    0,18", "trees    0,05", "vegetated areas    0,18", "water    0,1"])

# ----
panel_4 = Panel(data)
panel_5 = Panel(data_2)
data_3 = Data([reflay_6, reflay_5])

# ---- group: da alberare
brep = Brep(data_3)  # disabled

# ----
# permeable concrete 0.6
# grassy joint 0.45
# cool flooring high sri 0.75
# cool flooring low sri 0.75
# lawns 0.22
# urban agriculture 0.18
# bioswale 0.15
# 
# 
# 
# agricultural areas    0,1
# Bare soil    0,1
# buildings    0,9
# Built open spaces    0,75
# Railways    0,2
# roads    0,1
# roads    0,9
# sports facilities    0,18
# trees    0,05
# vegetated areas    0,18
# water    0,1
panel_6 = Panel("0.15")
panel_7 = Panel("0.2")
panel_8 = Panel("0.22")
panel_9 = Panel("0.1")

merge = Merge(
    Data1=createepground_2,
    Data2=createepground_3,
    Data3=createepground_4,
    Data4=createepground_6,
    Data5=createepground_7,
    Data6=createepground_5)

# ---- group: lawns top srfs
debrep = DeconstructBrep(Lawns=brep)  # -> Faces, Edges, Vertices; disabled
area = Area(Geometry=flatten(debrep.Faces))  # -> Area, Centroid; disabled
tstat = TreeStatistics(Tree=debrep.Faces)  # -> Paths, Length, Count; disabled
pdecon = Deconstruct(Point=area.Centroid)  # -> XComponent, YComponent, ZComponent; disabled
sort = SortList(Keys=pdecon.ZComponent, ValuesA=flatten(debrep.Faces))  # -> Keys, reverse(ValuesA); disabled
split = SplitList(List=sort.ValuesA, Index=tstat.Count)  # -> ListA, ListB; disabled
srf = Surface(simplify(split.ListA))  # disabled

# ----
solveadjc = Honeybee_SolveAdjacencies(HBZones=flatten(merge), removeCurrentAdjc=False, findAdjc=Toggle(True))  # -> readMe, HBZonesWADJ; plug-in component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
panel_11 = Panel(merge)
entwine = Entwine(FlattenInputs=True)  # disabled
number_slider = Slider(704, range=0..1000)  # disabled

# ---- group: RUNOFF LEGEND / legend base pt
pt = Point(Point(297.3668633, 40.73639569, 0))  # disabled

# ----
panel_12 = Panel(solveadjc.HBZonesWADJ)
panel_13 = Panel("1.0")  # disabled
panel_14 = Panel("0.1")  # disabled

# ---- group: RUNOFF
merge_2 = Merge(Data1="0.45", Data2="0.75", Data3="0.22", Data4="0.15", Data5="0.6")  # -> graft(Result); disabled
lng = ListLength(List=entwine)  # disabled
repeat = RepeatData(Data=merge_2, Length=lng)  # disabled
sort_2 = SortList(Keys=flatten(merge_2))  # -> reverse(Keys), ValuesA; disabled
gradient = Gradient(
    LowerLimit=panel_14,
    UpperLimit=panel_13,
    Parameter=repeat,
    stops=[0: RGB(75, 107, 169), 0.25: RGB(173, 203, 249), 0.5: RGB(254, 244, 84), 0.75: RGB(234, 126, 0), 1: RGB(234, 38, 0)])  # disabled
preview = CustomPreview(Geometry=entwine, Material=gradient)  # disabled

# ---- group: RUNOFF LEGEND
number_slider_2 = Slider(24, range=0..100)  # disabled
pdecon_2 = Deconstruct(Point=pt)  # -> XComponent, YComponent, ZComponent; disabled
addition = Addition(A=pdecon_2.XComponent, B=number_slider)  # disabled
n_legenda = Slider(10, range=0..10)  # disabled
pt_2 = ConstructPoint(XCoordinate=addition, YCoordinate=pdecon_2.YComponent, ZCoordinate=0)  # disabled
dom = ConstructDomain(DomainStart=0, DomainEnd=number_slider_2)  # disabled
rectangle = Rectangle(Plane=pt_2, XSize=dom, YSize=dom, Radius=0)  # -> Rectangle, Length; disabled
arrrec = RectangularArray(Geometry=rectangle.Rectangle, Cell=rectangle.Rectangle, XCount=1, YCount=n_legenda)  # -> Geometry, Transform; disabled
division = Division(A=panel_13, B=n_legenda)  # disabled
boundary = BoundarySurfaces(Edges=arrrec.Geometry)  # -> graft(Surfaces); disabled
panel_15 = Panel("round(x,2)")  # disabled
series = Series(Start=panel_14, Step=division, Count=n_legenda)  # disabled
panel_16 = Panel("0.9")  # disabled
panel_17 = Panel("0.1")  # disabled
gradient_2 = Gradient(
    LowerLimit=panel_17,
    UpperLimit=panel_16,
    Parameter=series,
    stops=[0: RGB(75, 107, 169), 0.25: RGB(173, 203, 249), 0.5: RGB(254, 244, 84), 0.75: RGB(234, 126, 0), 1: RGB(234, 38, 0)])  # disabled
debrep_2 = DeconstructBrep(Brep=boundary)  # -> Faces, Edges, Vertices; disabled
eval = Evaluate(F=panel_15, x=series)  # disabled
item = ListItem(List=debrep_2.Vertices, Index=1, Wrap=True)  # disabled
tag = TextTag3D(Location=item, Text=graft(eval), Size=14, Justification=7)  # disabled
preview_2 = CustomPreview(Geometry=boundary, Material=graft(gradient_2))  # disabled

# ----
area_2 = Area(Geometry=srf)  # -> Area, Centroid; disabled
small_trees = Slider(20, range=0..100)  # disabled
big_trees = Slider(10, range=0..100)  # disabled
division_2 = Division(A=area_2.Area, B=100)  # disabled
division_3 = Division(A=area_2.Area, B=100)  # disabled
raggio_chioma = Panel("3")  # disabled
raggio_chioma_2 = Panel("1.5")  # disabled
multiplication = Multiplication(A=big_trees, B=division_2)  # disabled
multiplication_2 = Multiplication(A=small_trees, B=division_3)  # disabled
addition_2 = Addition(A=big_trees, B=small_trees)  # disabled
expression = Expression(x=raggio_chioma, Expression="x²*π")  # disabled
expression_2 = Expression(x=raggio_chioma_2, Expression="x²*π")  # disabled
tot_alberi = Panel(addition_2)  # disabled
division_4 = Division(A=multiplication, B=expression)  # disabled
division_5 = Division(A=multiplication_2, B=expression_2)  # disabled
number_slider_3 = Slider(1, range=0..10)  # disabled
round = Round(Number=division_4)  # -> Nearest, Floor, Ceiling; disabled
round_2 = Round(Number=division_5)  # -> Nearest, Floor, Ceiling; disabled
popgeo = PopulateGeometry(Geometry=srf, Count=round_2.Nearest, Seed=expr("x+1", number_slider_3))  # disabled
popgeo_2 = PopulateGeometry(Geometry=srf, Count=round.Nearest, Seed=number_slider_3)  # disabled
merge_3 = Merge(Data1=popgeo)  # disabled
pdecon_3 = Deconstruct(Point=merge_3)  # -> XComponent, YComponent, ZComponent; disabled
h_bi_trees = Panel("18")  # disabled
pdecon_4 = Deconstruct(Point=popgeo_2)  # -> XComponent, YComponent, ZComponent; disabled
h_small_trees = Panel("12")  # disabled

# ---- group: zone termiche WADJ
data_4 = Data(solveadjc.HBZonesWADJ)

# ----
pt_3 = ConstructPoint(XCoordinate=pdecon_4.XComponent, YCoordinate=pdecon_4.YComponent, ZCoordinate=h_bi_trees)  # disabled
pt_4 = ConstructPoint(XCoordinate=pdecon_3.XComponent, YCoordinate=pdecon_3.YComponent, ZCoordinate=h_small_trees)  # disabled
panel_18 = Panel("4")  # disabled

# ---- group: filari alberi big
crv = Curve(graft([<curve referenced from the Rhino model> x13]))  # disabled

# ---- group: filari alberi small
crv_2 = Curve(graft([<curve referenced from the Rhino model> x10]))  # disabled

# ----
panel_19 = Panel("4")  # disabled

# ---- group: SRF tot / perimetro area
list_9 = ValueList({"3D", "3D::BUILDINGS", "3D::BUILT-OPEN-SPACE", "3D::ROADS", "3D::VEGETATED_AREAS", "Alberi_Pensiline", "BUILT_OPEN_SPACE", "old_BUILDINGS", "old_BUILT OPEN SPACE", "old_ROADS", "old_TREES", "old_VEGETATED AREAS", "PERIMETRO", "ROADS", "TREES", "VEGETATED_AREAS"}, selected="PERIMETRO")

# ----
polygon = Polygon(Plane=pt_3, Radius=raggio_chioma, Segments=panel_18, FilletRadius=0)  # -> Polygon, Length; disabled
polygon_2 = Polygon(Plane=pt_4, Radius=raggio_chioma_2, Segments=panel_19, FilletRadius=0)  # -> Polygon, Length; disabled
list_10 = ValueList({"3D", "3D::BUILDINGS", "3D::BUILT-OPEN-SPACE", "3D::ROADS", "3D::TREES", "3D::VEGETATED_AREAS", "Alberi_Pensiline", "BUILT_OPEN_SPACE", "old_BUILDINGS", "old_BUILT OPEN SPACE", "old_ROADS", "old_TREES", "old_VEGETATED AREAS", "PERIMETRO", "ROADS", "TREES", "VEGETATED_AREAS"}, selected="3D::TREES")
boundary_2 = BoundarySurfaces(Edges=polygon.Polygon)  # disabled
boundary_3 = BoundarySurfaces(Edges=polygon_2.Polygon)  # disabled
Z = UnitZ(Factor=raggio_chioma)  # disabled
Z_2 = UnitZ(Factor=raggio_chioma_2)  # disabled

# ---- group: SRF tot
list_11 = ValueList({"Point": 0, "Curve": 1, "Arc": 2, "Circle": 3, "Ellipse": 4, "Line": 5, "Polyline": 6, "Surface": 7, "Brep": 8, "Mesh": 9, "Polysurface": 10, "Block": 11, "Text": 12, "TextDot": 13, "Dimension": 14, "LinearDimension": 15, "AngularDimension": 16, "Hatch": 17, "Leader": 18}, selected="Curve")
reflay_8 = ReferenceByLayer(LayerName=list_9)
filtertype = FilterByType(Geometry=reflay_8, ObjectType=list_11)

# ----
cluster_8 = Cluster_3(R=crv_2, L=polygon_2.Polygon, Z=h_small_trees)  # disabled
cluster_9 = Cluster_3(R=crv, L=polygon.Polygon, Z=h_bi_trees)  # disabled
extr = Extrude(Base=boundary_3, Direction=Z_2)  # disabled
extr_2 = Extrude(Base=boundary_2, Direction=Z)  # disabled

# ---- group: canopy
srf_2 = Surface([<surface referenced from the Rhino model> x12])  # disabled

# ----
move = Move(Geometry=srf_2, Motion=Vector(0, 0, 10))  # -> Geometry, Transform; disabled

# ---- group: Alberi_Pensiline
reflay_9 = ReferenceByLayer(LayerName=list_10)

# ----
merge_4 = Merge(Data1=cluster_9, Data2=extr_2, Data3=extr, Data4=cluster_8, Data5=move.Geometry)  # -> flatten(Result); disabled

# ---- group: buildings
brep_2 = Brep(cluster.geometries)

# ----
swatch = ColourSwatch(SwatchColor=RGB(1, 112, 9))  # disabled
swatch_2 = ColourSwatch(SwatchColor=RGB(255, 255, 255))  # disabled

# ---- group: SRF tot / srf tot area
boundary_4 = BoundarySurfaces(Edges=filtertype)

# ----
merge_5 = Merge(Data1=brep_2, Data2=reflay_9)

# ---- group: LAND USE %
cluster_10 = Cluster()  # -> build_area, tag_3; disabled
volume = Volume()  # -> Volume, Centroid; disabled
cluster_11 = Cluster()  # -> build_area, tag_3; disabled
cluster_12 = Cluster()  # -> build_area, tag_3; disabled
volumi = Panel(volume.Volume)  # disabled
subtraction = Subtraction(A=cluster_11.build_area, B=cluster_10.build_area)  # disabled
ma = MassAddition(Input=volumi)  # -> Result, PartialResults; disabled
area_3 = Area(Geometry=boundary_4)  # -> Area, Centroid; disabled
merge_6 = Merge(Data1=cluster_12.tag_3, Data2=cluster_11.tag_3, Data3=cluster_10.tag_3)  # disabled
merge_7 = Merge(Data1=cluster_12.build_area, Data2=subtraction, Data3=cluster_10.build_area)  # disabled
panel_20 = Panel(ma.Result)  # disabled
area_tot = Panel(area_3.Area)  # disabled
panel_21 = Panel("(x*100)/y")  # disabled
panel_22 = Panel("round(x,2)")  # disabled
eval_2 = Evaluate(F=panel_21, x=merge_7, y=area_3.Area)  # disabled
panel_23 = Panel(":")  # disabled
panel_24 = Panel("%")  # disabled
eval_3 = Evaluate(F=panel_22, x=eval_2)  # disabled
concat = Concatenate(FragmentA=merge_6, FragmentB=panel_23, FragmentC=eval_3, FragmentD=panel_24)  # disabled
panel_25 = Panel(eval_3)  # disabled
panel_26 = Panel(concat)  # disabled
ma_2 = MassAddition(Input=panel_25)  # -> Result, PartialResults; disabled
panel_27 = Panel(ma_2.Result)  # disabled

# ----
preview_3 = CustomPreview(Geometry=merge_4, Material=swatch_2)  # disabled

# ---- group: bake alberi
button = Button()

# ----
layers = CreateModifyLayers(
    LayerName="Alberi_Pensiline",
    LayerColor=ColourSwatch(SwatchColor=RGB(48, 156, 57)),
    DeleteLayer=False,
    enableFullPath=False)  # -> LayerNames, LayerFullPath
createatts = CreateAttributes(LayerName=layers.LayerNames, enableFullPath=False)
bake = BakeGeometry(Bake=button, Geometry=merge_4, Attributes=createatts, DeleteOldBakes=False, PreserveTrees=False)
panel_28 = Panel(" C:\Users\MATTIAFEDERICOLEONE\Desktop\Grasshopper\Paris\EPW_FutureHeatWave")
working_dir_calculations = Panel("C:\Users\MATTIAFEDERICOLEONE\Desktop\Grasshopper\Paris\Simulations")
working_dir_local = Panel("C:\Users\simpi\OneDrive\Desktop")
dir = DirectoryContents(FolderPath=panel_28, Filter="*", IncludeSubfolders=False)  # -> FilePaths, FileNames
item_2 = ListItem(List=dir.FilePaths, Index=list_8, Wrap=True)
item_3 = ListItem(List=dir.FileNames, Index=list_8, Wrap=True)
selected_epw = Panel(item_3)

# ---- group: OPEN STUDIO settings
concat_2 = Concatenate(FragmentA="District1")
concat_3 = Concatenate(FragmentA=concat_2, FragmentB="_Map")
txt = Text(selected_epw)
split_2 = TextSplit(Text=txt, Separators="_")
lng_2 = ListLength(List=split_2)
subtraction_2 = Subtraction(A=lng_2, B="7")
constantschedule = Honeybee_ConstantSchedule(value="0.7", scheduleName="treescanopy")  # -> readMe, schedule, weekSched, schedIDFText; plug-in component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
series_2 = Series(Start="7", Step=1, Count=expr("x-1", subtraction_2))
item_4 = ListItem(List=split_2, Index=series_2, Wrap=True)
toggle_4 = BooleanToggle(True)
join = TextJoin(Text=flatten([item_4, "SIMULATION"]), Join="_")
epoutput = Honeybee_GenerateEPOutput(zoneGainsAndLosses="False", zoneComfortMetrics=toggle_4, comfortMapVariables=toggle_4, surfaceTempAnalysis=toggle_4)  # -> report, flatten(simulationOutputs); plug-in component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
simulation_name = Panel(join)
map_name = Panel("ParisSim_2050_Map")
hb_epcontextsrf = HoneybeeEPContextSurfaces(shdSurfaces=flatten(merge_5), EPTransSchedule=constantschedule.schedule, justBoundingBox=Toggle(False))  # -> HBContext; inputs shdSurfaces: list of Brep, justBoundingBox: Boolean
# ---------- hb_epcontextsrf: Python ----------
"""
prepare shading/context geometries

    Args:
        northVectorOrRotation: A vector that shows North or a number that shows
                               the rotation of the North from the Y axis
        bldgMasses: List of closed Breps as thermal zones.
    Returns:
        report: ...
        thermalZones: Thermal zone's geometries for visualiza
"""

ghenv.Component.Name = 'Honeybee EP context Surfaces'
ghenv.Component.NickName = 'HB_EPContextSrf'
ghenv.Component.Message = 'VER 0.0.64\nNOV_20_2018'
ghenv.Component.IconDisplayMode = ghenv.Component.IconDisplayMode.application
ghenv.Component.Category = "Honeybee"
ghenv.Component.SubCategory = "10 | Energy | Energy"
#compatibleHBVersion = VER 0.0.57\nNOV_04_2016
#compatibleLBVersion = VER 0.0.59\nFEB_01_2015
ghenv.Component.AdditionalHelpFromDocStrings = "2"

import rhinoscriptsyntax as rs
import Rhino as rc
import scriptcontext as sc
import os
import System
import Grasshopper.Kernel as gh
import uuid

tolerance = sc.doc.ModelAbsoluteTolerance
import math


def main(shdSurfaces, EPTransSchedule, meshingSettings, justBoundingBox):
    
    # import the classes
    if sc.sticky.has_key('honeybee_release'):

        try:
            if not sc.sticky['honeybee_release'].isCompatible(ghenv.Component): return -1
            if sc.sticky['honeybee_release'].isInputMissing(ghenv.Component): return -1
        except:
            warning = "You need a newer version of Honeybee to use this compoent." + \
            " Use updateHoneybee component to update userObjects.\n" + \
            "If you have already updated userObjects drag Honeybee_Honeybee component " + \
            "into canvas and try again."
            w = gh.GH_RuntimeMessageLevel.Warning
            ghenv.Component.AddRuntimeMessage(w, warning)
            return -1
        
        # don't customize this part
        hb_EPSrf = sc.sticky["honeybee_EPSurface"]
        hb_EPSHDSurface = sc.sticky["honeybee_EPShdSurface"]
        hb_RADMaterialAUX = sc.sticky["honeybee_RADMaterialAUX"]
        hb_EPObjectsAux = sc.sticky["honeybee_EPObjectsAUX"]()
        HBScheduleList = sc.sticky["honeybee_ScheduleLib"].keys()

        ########################################################################
        #----------------------------------------------------------------------#
        shdBreps = []
        # create bounding box of shading geometries
        if justBoundingBox:
            for brep in shdSurfaces:
                if brep.Faces.Count>1 or not brep.Faces[0].IsPlanar(sc.doc.ModelAbsoluteTolerance):
                    shdBreps.append(brep.GetBoundingBox(True).ToBrep())
                else:
                    shdBreps.append(brep)
        else:
            shdBreps = shdSurfaces
        
        shadingClasses = []
        shadingMeshPreview = []
        
        if meshingSettings == None:
            mp = rc.Geometry.MeshingParameters.Minimal
            mp.SimplePlanes = True
        else:
            mp = meshingSettings
        
        def getRadMaterialName(radMaterial):
            nameStr = radMaterial.split(" ")[2]
            name =  nameStr.split("\n")[0]
            return name
        
        for brepCount, brep in enumerate(shdBreps):
            if brep != None:
                isPlanar = True
                # check planarity
                for face in brep.Faces:
                    if not face.IsPlanar(tolerance):
                        isPlanar = False
                        break
                
                shadingBreps = []
                if not isPlanar:
                    meshArray = rc.Geometry.Mesh.CreateFromBrep(brep, mp)
                    for mesh in meshArray:
                        for meshFace in range(mesh.Faces.Count):
                            vertices = list(mesh.Faces.GetFaceVertices(meshFace))[1:]
                            vertices = vertices + [sc.doc.ModelAbsoluteTolerance]
                            # create the brep from mesh
                            shdBrep = rc.Geometry.Brep.CreateFromCornerPoints(*vertices)
                            shadingBreps.append(shdBrep)
                else:
                    for face in brep.Faces:
                        shadingBreps.append(face.DuplicateFace(False))
                
                for faceCount, shdBrep in enumerate(shadingBreps):
                        thisShading = hb_EPSHDSurface(shdBrep, 1000*brepCount + faceCount, 'shdSrf_' + `brepCount` + '_' + `faceCount` + "_" + str(uuid.uuid4()))
                        
                        # add transmittance schedule if any
                        if EPTransSchedule!=None:
                            schedule= EPTransSchedule.upper()
                            if schedule!=None and not schedule.lower().endswith(".csv") and schedule not in HBScheduleList:
                                msg = "Cannot find " + schedule + " in Honeybee schedule library."
                                print msg
                                ghenv.Component.AddRuntimeMessage(gh.GH_RuntimeMessageLevel.Warning, msg)
                                return -1
                            elif schedule!=None and schedule.lower().endswith(".csv"):
                                # check if csv file is existed
                                if not os.path.isfile(schedule):
                                    msg = "Cannot find the shchedule file: " + schedule
                                    print msg
                                    ghenv.Component.AddRuntimeMessage(gh.GH_RuntimeMessageLevel.Warning, msg)
                                    return -1
                            
                            thisShading.TransmittanceSCH = schedule
                        
                        # add the Rad Material if any
                        if RADMaterial!=None:
                            # if it is just the name of the material make sure it is already defined
                            if len(RADMaterial.split(" ")) == 1:
                                # if the material is not in the library add it to the library
                                if not hb_RADMaterialAUX.isMatrialExistInLibrary(RADMaterial):
                                    warningMsg = "Can't find " + RADMaterial + " in RAD Material Library.\n" + \
                                                "Add the material to the library and try again."
                                    ghenv.Component.AddRuntimeMessage(gh.GH_RuntimeMessageLevel.Warning, warningMsg)
                                    return
                                
                                try:
                                    thisShading.setRADMaterial(RADMaterial)
                                except Exception, e:
                                    print e
                                    warningMsg = "You are using an old version of Honeybee_Honeybee! Update your files and try again."
                                    print warningMsg
                                    ghenv.Component.AddRuntimeMessage(gh.GH_RuntimeMessageLevel.Warning, warningMsg)
                                    return
                                
                                addedToLib = True
                            else:
                                
                                # try to add the material to the library
                                addedToLib, thisShading.RadMaterial = hb_RADMaterialAUX.analyseRadMaterials(RADMaterial, True)
                                
                            if addedToLib==False:
                                warningMsg = "Failed to add " + RADMaterial + " to the Library."
                                ghenv.Component.AddRuntimeMessage(gh.GH_RuntimeMessageLevel.Warning, warningMsg)
                                return
                        
                        # add shading to the list
                        shadingClasses.append(thisShading)
                
        # add to the hive
        hb_hive = sc.sticky["honeybee_Hive"]()
        HBContext  = hb_hive.addToHoneybeeHive(shadingClasses, ghenv.Component)
        return HBContext
        ################################################################################################
    else:
        print "You should first let Honeybee to fly..."
        w = gh.GH_RuntimeMessageLevel.Warning
        ghenv.Component.AddRuntimeMessage(w, "You should first let Honeybee to fly...")
        return -1
        

if _shdSurfaces and _shdSurfaces[0]!=None:
    # add cleaning function
    result= main(_shdSurfaces, EPTransSchedule_, meshingSettings_, justBoundingBox_)
    
    if result != -1: HBContext = result
# ---------- end hb_epcontextsrf ----------

# ----
analysisperiod = Ladybug_AnalysisPeriod(fromMonth="8", fromDay="10", toMonth="8", toDay="10")  # -> readMe, analysisPeriod; plug-in component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

# ---- group: EPW
path = FilePath(item_2)

# ---- group: VF mesh
mesh = Mesh(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)

# ----
toggle_5 = FalseStartToggle(False)
concat_4 = Concatenate(
    FragmentA=working_dir_calculations,
    FragmentC="\",
    FragmentB=simulation_name,
    FragmentD="\OpenStudio\",
    FragmentE=simulation_name,
    FragmentF="\ModelToIdf\in.csv")
panel_29 = Panel(concat_4)
exporttoopenstudio = Honeybee_ExportToOpenStudio(
    epwWeatherFile=path,
    analysisPeriod=analysisperiod.analysisPeriod,
    HBZones=flatten(data_4),
    HBContext=flatten(hb_epcontextsrf),
    simulationOutputs=flatten(epoutput.simulationOutputs),
    writeOSM=toggle_5,
    runSimulation=toggle_5,
    fileName=simulation_name,
    workingDir=working_dir_calculations)  # -> readMe, osmFileAddress, idfFileAddress, resultFileAddress, eioFileAddress, rddFileAddress, htmlReport, studyFolder, model; plug-in component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
path_2 = FilePath("C:\Users\MATTIAFEDERICOLEONE\Desktop\Grasshopper\PUA_Stadera\Simulazioni\Stadera_srfInt_ADAP_2018_31July_24h\OpenStudio\Stadera_srfInt_ADAP_2018_31July_24h\ModelToIdf\in.csv")

# ---- group: Paris 2050
path_3 = FilePath("C:\Users\MATTIAFEDERICOLEONE\Desktop\Grasshopper\Paris\Simulations\ParisSim_2050\OpenStudio\ParisSim_2050\ModelToIdf\in.csv")

# ---- group: Paris 2080
path_4 = FilePath("C:\Users\MATTIAFEDERICOLEONE\Desktop\Grasshopper\Paris\Simulations\ParisSim_2080\OpenStudio\ParisSim_2080\ModelToIdf\in.csv")

# ---- group: rcp 85
path_5 = FilePath("C:\Users\MATTIAFEDERICOLEONE\Desktop\Grasshopper\PAESC\Simulazioni\brt_ADAP_zoom_rcp85\OpenStudio\brt_ADAP_zoom_rcp85\ModelToIdf\in.csv")

# ----
path_6 = FilePath(exporttoopenstudio.resultFileAddress)
panel_30 = Panel(path_5)
panel_31 = Panel(exporttoopenstudio.readMe)
readepsrfresult = Honeybee_ReadEPSurfaceResult(resultFileAddress=path_3)  # -> surfaceIndoorTemp, surfaceOutdoorTemp, port, port_2, port_3, port_4, port_5, port_6, port_7; plug-in component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

# ---- group: ADAPTATION
canopy_b = Panel("AN3:AN26")
canopy_c = Panel("AP3:AP26")
cool_roofs_c = Panel("AJ3:AJ26")
water_square = Panel("AV3:AV26")
perm_floor_a = Panel("P3:P26")
trees_a = Panel("J3:J26")
trees_b = Panel("L3:L26")
trees_c = Panel("N3:N26")
cool_roofs_b = Panel("AH3:AH26")
reflective_srf_b = Panel("X3:X26")
cool_roofs_a = Panel("AF3:AF26")
green_roofs_a = Panel("AB3:AB26")
gutter = Panel("AX3:AX26")
large_basins = Panel("AR3:AR26")
canopy_a = Panel("AL3:AL26")
cool_floor_low_sri = Panel("Z3:Z26")
sport_facilities = Panel("R34:R57")
green_roofs_b = Panel("AD3:AD26")
railways_adap = Panel("U34:U57")
buildings_adap = Panel("I34:I57")
roads_adap = Panel("L34:L57")
bioswale = Panel("D3:D26")
built_open_spaces_adap = Panel("O34:O57")
cool_floor_high_sri = Panel("V3:V26")
perm_concrete = Panel("T3:T26")
small_basins = Panel("AT3:AT26")
lawns = Panel("H3:H26")
grassy_joint = Panel("R3:R26")
urban_agri = Panel("F3:F26")

# ---- group: CARICAMENTO T SRF
importepw = Ladybug_ImportEpw(epwFile=path)  # -> readMe, latitude, location, dryBulbTemperature, dewPointTemperature, relativeHumidity, windSpeed, windDirection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; plug-in component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
series_3 = Series(Start=1, Step=1, Count=24)
landusemodifierpcplinivs = FilePath("C:\Users\MATTIAFEDERICOLEONE\Desktop\Grasshopper\Land_use_modifier.xlsx")
strnum = Ladybug_SeparateData(inputList=flatten(importepw.dryBulbTemperature))  # -> numbers, strings; plug-in component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
doy_hoy = Ladybug_DOY_HOY(days="10", months="8", hours=series_3)  # -> HOY, DOY, date; plug-in component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
toggle_6 = BooleanToggle(True)

# ----
data_5 = Data(importepw.dryBulbTemperature)

# ----
# Hottest days
number_slider_4 = Slider(0, range=0..100)
hot_temp_date = HotTempDate(drybulb_temp=data_5, num=number_slider_4)  # -> selected_temp_2, date
hottest_day = Panel(hot_temp_date.date)
hottest_temp = Panel(hot_temp_date.selected_temp_2)

strnum_2 = Ladybug_SeparateData(inputList=flatten(importepw.dryBulbTemperature))  # -> numbers, strings; plug-in component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

# ---- group: T max del giorno
doy_hoy_2 = Ladybug_DOY_HOY(days="8", months="10", hours=Slider(1, range=1..24))  # -> HOY, DOY, date; plug-in component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
addition_3 = Addition(A=doy_hoy_2.HOY, B="24")
dom_2 = ConstructDomain(DomainStart=doy_hoy_2.HOY, DomainEnd=addition_3)
subset = SubList(List=strnum_2.numbers, Domain=dom_2, Wrap=True)  # -> List, Index
sort_3 = SortList(Keys=subset.List)  # -> reverse(Keys), ValuesA
item_5 = ListItem(List=sort_3.Keys, Index=0, Wrap=True)
panel_32 = Panel(item_5)

# ----
landusemodifierlocal = FilePath("C:\Work\Clarity\Simulazioni_Subambiti\Land_use_modifier.xlsx")
panel_33 = Panel(landusemodifierpcplinivs)

# ---- group: CARICAMENTO T SRF / T air 24h
item_6 = ListItem(List=strnum.numbers, Index=doy_hoy.HOY, Wrap=True)

# ---- group: SDF
vegetated_areas = Panel("T3:T26")
built_open_space = Panel("J3:J26")
roads = Panel("N3:N26")

# ----
list_12 = ValueList({"SDF": 1, "PROG": 2}, selected="SDF")
merge_8 = Merge(Data1=built_open_space, Data2=roads, Data3=vegetated_areas)

# ---- group: CARICAMENTO T SRF / % di incremento
exsread = ExcelStaticRead(ExcelFile=landusemodifierpcplinivs, Connect=toggle_6, SheetNum=list_12, DataRange=merge_8)  # -> DataOutput, Message

# ---- group: CARICAMENTO T SRF / calcolo incremento %
expression_3 = Expression(T_air=item_6, x=exsread.DataOutput, Expression="T_air*x")

# ---- group: CARICAMENTO T SRF / T srf da inserire
num = Number(simplify(expression_3))

# ---- group: T SRF RECOMBINATION
item_7 = ListItem(List=readepsrfresult.surfaceOutdoorTemp, Index="2", Wrap=True)  # -> flatten(Item)
python = GhPythonScript(
    x=item_7,
    z=cluster.txt_2,
    u=cluster_2.txt_2,
    y=cluster_3.txt_2,
    v=cluster_4.txt_2,
    w=cluster_6.txt_2,
    s=cluster_7.txt_2,
    t=cluster_5.txt_2)  # -> simplify(flatten(out)), a
# ---------- python: Python ----------
__author__ = "Pegas_000"
__version__ = "2020.05.20"

import rhinoscriptsyntax as rs


if z in x:
    print(z)

if u in x:
    print(u)

if y in x:
    print(y)

if v in x:
    print(v)

#if w in x:
#    print(w)

#if s in x:
#    print(s)

#if t in x:
 #   print(t)

#if xx in x:
#    print(xx)

#if xy in x:
#    print(xy)

#if xz in x:
#    print(xz)

#if xu in x:
#    print(xu)
# ---------- end python ----------
panel_34 = Panel("""0
0
0
0
0
0
0
1
1
1
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""")
cset = CreateSet(List=python.out)  # -> Set, Map
dispatch = Dispatch(List=readepsrfresult.surfaceOutdoorTemp, DispatchPattern=panel_34)  # -> Numbers, Strings
mindex = MemberIndex(Set=python.out, Member=cset.Set)  # -> Index, graft(Count)
data_6 = Data(num)
dup = DuplicateData(Data=data_6, Number=mindex.Count, Order=True)
lng_3 = ListLength(List=data_6)
partition = PartitionList(List=dup, Size=lng_3)  # -> simplify(Chunks)
match = MatchTree(Tree=dispatch.Strings, Guide=partition)

# ----
land_use_order = Panel(cset.Set)

# ---- group: T SRF RECOMBINATION / T srf modificate
t_srf_recombined = Merge(Data1=match, Data2=partition)

# ----
analysisperiod_2 = Ladybug_AnalysisPeriod(fromMonth="8", fromDay="10", fromHour=Slider(1, range=1..24), toMonth="8", toDay="10", toHour=Slider(24, range=1..24))  # -> readMe, analysisPeriod; plug-in component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

# ---- group: SRF_COLOR
col = Colour([ColourSwatch(SwatchColor=RGB(255, 234, 0)), ColourSwatch(SwatchColor=RGB(255, 144, 0)), ColourSwatch(SwatchColor=RGB(255, 0, 0))])
legendpar = Ladybug_LegendParameters(lowBound="31", highBound="50", numSegments=Slider(10, range=0..10))  # -> legendPar; plug-in component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
toggle_7 = FalseStartToggle(False)
colorsurfaces = Honeybee_ColorSurfacesByEPResult(srfData=t_srf_recombined, HBZones=flatten(data_4), analysisPeriod=analysisperiod_2.analysisPeriod, runIt=toggle_7)  # -> readMe, srfColoredMesh, zoneWireFrame, legend, legendBasePt, analysisTitle, srfBreps, srfColors, srfValues, relevantSrfData; plug-in component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

# ----
list_13 = ValueList({"AirTemp.csv": 0, "DegFromTarget.csv": 1, "OutdoorComf.csv": 2, "RadiantTemp.csv": 3, "UTCI.csv": 4}, selected="UTCI.csv")
colour_swatch = ColourSwatch(SwatchColor=RGB(165, 217, 106))  # "26-32"
colour_swatch_2 = ColourSwatch(SwatchColor=RGB(255, 255, 191))  # "32-38"
colour_swatch_3 = ColourSwatch(SwatchColor=RGB(252, 174, 96))  # "38-46"
colour_swatch_4 = ColourSwatch(SwatchColor=RGB(26, 150, 65))
colour_swatch_5 = ColourSwatch(SwatchColor=RGB(214, 26, 29))

# ---- group: TMRT
panel_35 = Panel("35")
panel_36 = Panel("55")

# ---- group: MESH_COLOR / UTCI
panel_37 = Panel("46")
panel_38 = Panel("26")

# ----
merge_9 = Merge(Data2=colour_swatch_4, Data3=colour_swatch_2, Data5=colour_swatch_5)
cluster_13 = Cluster_2(A=working_dir_calculations, B=map_name, i=list_13)
gradientlibrary = Ladybug_GradientLibrary(gradIndex=Slider(4, range=0..100))  # -> customColors; plug-in component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
mesh_2 = Mesh(colorsurfaces.srfColoredMesh)
mesh_3 = Mesh(colorsurfaces.legend)

# ---- group: 2050-TMRT
path_7 = FilePath("C:\Users\MATTIAFEDERICOLEONE\Desktop\Grasshopper\Paris\Simulations\ParisSim_2050_Map\ComfortAnalysis\ParisSim_2050_MapRadiantTemp.csv")

# ---- group: 2050-UTCI
path_8 = FilePath("C:\Users\MATTIAFEDERICOLEONE\Desktop\Grasshopper\Paris\Simulations\ParisSim_2050_Map\ComfortAnalysis\ParisSim_2050_MapUTCI.csv")

# ---- group: proiezioni edifici
debrep_3 = DeconstructBrep()  # -> Faces, Edges, Vertices
area_4 = Area(Geometry=debrep_3.Faces)  # -> Area, Centroid
pdecon_5 = Deconstruct(Point=area_4.Centroid)  # -> XComponent, YComponent, ZComponent
sort_4 = SortList(Keys=pdecon_5.ZComponent, ValuesA=debrep_3.Faces)  # -> Keys, ValuesA
item_8 = ListItem(List=sort_4.ValuesA, Index=0, Wrap=True)
debrep_4 = DeconstructBrep(Brep=item_8)  # -> Faces, Edges, Vertices
join_2 = JoinCurves(Curves=debrep_4.Edges, Preserve=False)
Z_3 = UnitZ(Factor=1)
move_2 = Move(Geometry=join_2, Motion=Z_3)  # -> Geometry, Transform

# ---- group: 2080-TMRT
path_9 = FilePath("C:\Users\MATTIAFEDERICOLEONE\Desktop\Grasshopper\Paris\Simulations\ParisSim_2080_Map\ComfortAnalysis\ParisSim_2080_MapRadiantTemp.csv")

# ---- group: 2080-UTCI
path_10 = FilePath("C:\Users\MATTIAFEDERICOLEONE\Desktop\Grasshopper\Paris\Simulations\ParisSim_2080_Map\ComfortAnalysis\ParisSim_2080_MapUTCI.csv")

# ----
readmicroclimatemtx = Honeybee_ReadMicroclimateMatrix(comfResultFileAddress=path_10)  # -> comfResultsMtx; plug-in component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
panel_39 = Panel("1000*P.y+(100-P.x)")  # disabled
number_slider_5 = Slider(0, range=0..1000)  # disabled
panel_40 = Panel("49")  # disabled
list_14 = ValueList({"0", "1", "2", "3", "4", "5", "6", "7", "8", "9", "10", "11", "12", "13", "14", "15", "16", "17", "18", "19", "20", "21", "22", "23"}, selected="23")  # disabled

# ---- group: MOD ASC
panel_41 = Panel("D:\Clarity\Campione_Ponticelli\asc\asc_388468tmrt_16luglio_")  # disabled
panel_42 = Panel("n.asc")  # disabled
toggle_8 = BooleanToggle(True)  # disabled
panel_43 = Panel("A7:A255")  # disabled
concat_5 = Concatenate(FragmentC=panel_41, FragmentB=list_14, FragmentD=panel_42)  # disabled
exsread_2 = ExcelStaticRead(ExcelFile=concat_5, Connect=toggle_8, SheetNum=1, DataRange=panel_43)  # -> DataOutput, Message; disabled
panel_44 = Panel(" ")  # disabled
split_3 = TextSplit(Text=exsread_2.DataOutput, Separators=panel_44)  # disabled
cull_i = CullIndex(List=split_3, Indices=0, Wrap=True)  # -> simplify(List); disabled
panel_45 = Panel("5")  # disabled
partition_2 = PartitionList(List=cull_i, Size=panel_45)  # disabled
num_2 = Number(partition_2)  # disabled
avr = Average(Input=num_2)  # disabled
trim = TrimTree(Tree=avr, Depth=1)  # disabled
flip = FlipMatrix(Data=trim)  # disabled
panel_46 = Panel("5")  # disabled
partition_3 = PartitionList(List=flip, Size=panel_46)  # disabled
num_3 = Number(partition_3)  # disabled

# ----
panel_47 = Panel(partition_2)  # disabled
swatch_3 = ColourSwatch(SwatchColor=RGB(255, 255, 255))  # disabled

# ---- group: MOD ASC / per colonna
avr_2 = Average(Input=num_3)  # disabled

# ----
panel_48 = Panel("D:\Clarity\Campione_Ponticelli\tmrt_out\tmrt_16luglio_")  # disabled

# ---- group: MOD ASC / per riga
path_mapper = PathMapper(avr_2, source="{A;B}", target="{B;A}")  # disabled

# ----
panel_49 = Panel(".xlsx")  # disabled
panel_50 = Panel("""{*;49}
{49;*}""")  # disabled
num_4 = Number(expr("round(x,3)", path_mapper))  # disabled
concat_6 = Concatenate(FragmentC=panel_48, FragmentB=list_14, FragmentD=panel_49)  # disabled

# ---- group: cull 50th
split_4 = SplitTree(Data=num_4, Masks=flatten(panel_50))  # -> Positive, Negative; disabled

# ---- group: rami per riga
trim_2 = TrimTree(Tree=split_4.Negative, Depth=1)  # disabled

# ----
button_2 = Button()  # disabled
button_3 = Button()  # disabled
button_4 = Button()  # disabled
flip_2 = FlipMatrix(Data=trim_2)  # disabled
panel_51 = Panel("2")  # disabled
panel_52 = Panel("3")  # disabled
panel_53 = Panel("1")  # disabled
exwrite = ExcelWrite(ExcelFile=concat_6, DataTree=flip_2, SheetNum=panel_53, Connect=button_2, DataRange="all")  # disabled

# ---- group: VIEW FACTOR
Z_4 = UnitZ(Factor=1)
move_3 = Move(Geometry=boundary_4, Motion=Z_4)  # -> Geometry, Transform
splitmul = SplitBrepMultiple(Brep=move_3.Geometry, Cutters=brep_2)
area_5 = Area(Geometry=splitmul)  # -> Area, Centroid
sort_5 = SortList(Keys=area_5.Area, ValuesA=splitmul)  # -> Keys, reverse(ValuesA)
list_15 = ValueList({"tagliata": "0", "intera": "1"}, selected="intera")
item_9 = ListItem(List=sort_5.ValuesA, Index=0, Wrap=True)
filter = StreamFilter(Gate=list_15, Stream0=item_9, Stream1=move_3.Geometry)
lng_4 = ListLength(List=merge_5)
repeat_2 = RepeatData(Data="0.7", Length=lng_4)
toggle_9 = FalseStartToggle(False)
panel_54 = Panel("5")
indoorviewfactor = Honeybee_IndoorViewFactorCalculator(
    HBZones=flatten(data_4),
    gridSize=panel_54,
    distFromFloorOrSrf=flatten(filter),
    additionalShading=flatten(merge_5),
    addShdTransmiss=flatten(repeat_2),
    includeOutdoor=Toggle(True),
    parallel=Toggle(True),
    buildMesh=toggle_9,
    runIt=toggle_9)  # -> readMe, port, viewFactorMesh, viewFactorInfo, port_2, testPts, viewMeshFaces, zoneWireFrame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; plug-in component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
toggle_10 = FalseStartToggle(False)
toggle_11 = FalseStartToggle(False)

# ----
geo = Geometry(indoorviewfactor.closedAirVolumes)
concat_7 = Concatenate(FragmentA="District1", FragmentB="_VFinfo_", FragmentC=panel_54, FragmentD="x", FragmentE=panel_54)
txt_2 = Text(concat_7)
panel_55 = Panel(concat_7)

# ---- group: VIEW FACTOR (continued)
dumphbobjects = Honeybee_DumpHoneybeeObjects(HBObjects=flatten(indoorviewfactor.viewFactorInfo), fileName=txt_2, workingDir=working_dir_calculations, dump=toggle_10)  # -> readMe, filePath; plug-in component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
concat_8 = Concatenate(FragmentA=working_dir_calculations, FragmentB="\", FragmentC=txt_2, FragmentD=".HB")

# ---- group: VIEW FACTOR / view factor info
path_11 = FilePath(concat_8)

# ---- group: VIEW FACTOR (continued)
loadhbobjects = Honeybee_LoadHoneybeeObjects(filePath=path_11, load=toggle_11)  # -> readMe, HBObjects; plug-in component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
panel_56 = Panel(path_11)

# ----
outdoorcomfrecipe = Honeybee_OutdoorComfortAnalysisRecipe(
    viewFactorMesh=mesh,
    viewFactorInfo=loadhbobjects.HBObjects,
    epwFile=path,
    srfIndoorTemp=readepsrfresult.surfaceIndoorTemp,
    srfOutdoorTemp=t_srf_recombined)  # -> comfRecipe; plug-in component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

# ---- group: MESH_COLOR
toggle_12 = FalseStartToggle(False)
microclimatemap = Honeybee_MicroclimateMapAnalysis(
    comfAnalysisRecipe=outdoorcomfrecipe,
    fileName=map_name,
    workingDir=working_dir_calculations,
    analysisPeriodOrHOY=analysisperiod.analysisPeriod,
    parallel=toggle_12,
    runIt=toggle_12)  # -> readMe, port, radTempMtx, airTempMtx, operativeTempMtx, adaptComfMtx, degFromTargetMtx, port_2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; plug-in component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
legendpar_2 = Ladybug_LegendParameters(
    lowBound=panel_38,
    highBound=panel_37,
    numSegments=Slider(5, range=0..10),
    customColors=flatten(merge_9),
    decimalPlaces=Slider(0, range=0..100))  # -> legendPar; plug-in component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
toggle_13 = FalseStartToggle(False)
visualizemicroclimate = Honeybee_VisualizeMicroclimateMap(comfResultsMtx=readmicroclimatemtx, viewFactorMesh=flatten(mesh), runIt=toggle_13)  # -> readMe, port, resultMesh, legend, legendBasePt, port_2, resultValues, resultColors; plug-in component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
mesh_4 = Mesh(visualizemicroclimate.resultMesh)
mesh_5 = Mesh(visualizemicroclimate.legend)

# ----
num_5 = Number(visualizemicroclimate.resultValues)
explode = MeshExplode(Mesh=mesh_4, Interpolate=False)  # -> flatten(Faces); disabled
area_6 = Area(Geometry=explode)  # -> Area, Centroid; disabled
eval_4 = Evaluate(F=panel_39, P=area_6.Centroid)  # disabled
sort_6 = SortList(Keys=eval_4, ValuesCelle=explode, ValuesValori=visualizemicroclimate.resultValues, ValuesCentri=area_6.Centroid)  # -> Keys, reverse(ValuesCelle), reverse(ValuesValori), reverse(ValuesCentri); disabled

md_slider = MDSlider(
    SliderMode=0,
    slider_value=Point(0.006830238863, 0.9916538836, 0.5),
    x_domain=Domain(300, 550),
    y_domain=Domain(16, 265),
    z_domain=Domain(0, 1))  # disabled
pt_5 = Point(Point(0, 0, 0))  # disabled
move_4 = Move(Geometry=pt_5, Motion=md_slider)  # -> Geometry, Transform; disabled
dist = Distance(PointA=sort_6.ValuesCentri, PointB=move_4.Geometry)  # disabled
swatch_4 = ColourSwatch(SwatchColor=RGB(0, 17, 255))  # disabled
sort_7 = SortList(Keys=dist, ValuesAnResults=sort_6.ValuesValori)  # -> Keys, ValuesAnResults; disabled
panel_57 = Panel("2")  # disabled
dots = DotDisplay(Point=move_4.Geometry, Colour=swatch_4, Size=panel_57)  # disabled
item_10 = ListItem(List=sort_7.ValuesAnResults, Index=0, Wrap=True)  # disabled
panel_58 = Panel("600,30")  # disabled
texttoscreen = RenderTextToScreen(Text=item_10, Location=panel_58, Size=16, Color=RGB(0, 0, 0), m_scWithvp=False)  # disabled

explode_2 = MeshExplode(Mesh=mesh_4, Interpolate=False)
area_7 = Area(Geometry=explode_2)  # -> Area, Centroid
explode_3 = MeshExplode(Mesh=mesh_4, Interpolate=False)
area_8 = Area(Geometry=explode_3)  # -> Area, Centroid
incurve = PointInCurve(Point=area_7.Centroid)  # -> Relationship, Point
incurve_2 = PointInCurve(Point=area_8.Centroid, Curve=move_2.Geometry)  # -> Relationship, Point
eval_5 = Evaluate(F="if (x=2,1,0)", x=incurve.Relationship)
item_11 = ListItem(List=sort_6.ValuesCelle, Index=number_slider_5, Wrap=True)  # disabled

# ---- group: rami per riga
partition_4 = PartitionList(List=sort_6.ValuesValori, Size=panel_40)  # disabled

# ----
eval_6 = Evaluate(F="if (x=2,1,0)", x=incurve_2.Relationship)
cull = CullPattern(List=num_5, CullPattern=eval_5)
preview_4 = CustomPreview(Geometry=item_11, Material=swatch_3)  # disabled

# ---- group: valori sotto edifici
cull_2 = CullPattern(List=num_5, CullPattern=eval_6)

# ----
mindex_2 = MemberIndex(Set=cull, Member=cull_2)  # -> flatten(Index), Count
cull_i_2 = CullIndex(List=cull, Indices=mindex_2.Index, Wrap=True)
avr_3 = Average(Input=cull_i_2)
media_area_di_intervento = Panel(avr_3)
expression_4 = Expression(HB=partition_4, ASC=trim_2, Expression="(HB/ASC)-1")  # disabled
flip_3 = FlipMatrix(Data=expression_4)  # disabled
flip_4 = FlipMatrix(Data=partition_4)  # disabled
exwrite_2 = ExcelWrite(ExcelFile=concat_6, DataTree=flip_3, SheetNum=panel_52, Connect=button_3, DataRange="all")  # disabled
exwrite_3 = ExcelWrite(ExcelFile=concat_6, DataTree=flip_4, SheetNum=panel_51, Connect=button_4, DataRange="all")  # disabled

# ==== cluster Cluster
B = ClusterInput()
tag = ClusterInput()
debrep = DeconstructBrep(Brep=B)  # -> Faces, Edges, Vertices
tag_2 = Data(tag)
area = Area(Geometry=debrep.Faces)  # -> Area, Centroid
tag_3 = ClusterOutput(tag_2)
sort = SortList(Keys=area.Area)  # -> reverse(Keys), ValuesA
item = ListItem(List=sort.Keys, Index=0, Wrap=True)  # -> flatten(Item)
ma = MassAddition(Input=item)  # -> BuildArea, PartialResults
build_area = ClusterOutput(ma.BuildArea)

# ==== cluster Cluster_2
panel = Panel("""AirTemp.csv
DegFromTarget.csv
OutdoorComf.csv
RadiantTemp.csv
Utci.csv""")
i = ClusterInput()
item = ListItem(List=panel, Index=i, Wrap=True)
A = ClusterInput()
B = ClusterInput()
concat = Concatenate(FragmentA=A, FragmentC="\", FragmentB=B, FragmentD="\ComfortAnalysis\", FragmentE=B, FragmentF=item)
panel_2 = Panel(concat)
R = ClusterOutput(concat)

# ==== cluster Cluster_3
R = ClusterInput()
L = ClusterInput()
item = ListItem(List=flatten(L), Index=0, Wrap=True)
pframe = PerpFrame(Curve=R, Parameter=0)
orient = Orient(Geometry=item, Source=item, Target=pframe)  # -> Geometry, Transform
debrep = DeconstructBrep(Brep=orient.Geometry)  # -> Faces, Edges, Vertices
curvepoint = PointOnCurve(debrep.Edges, parameter=0.5)
pdecon = Deconstruct(Point=curvepoint)  # -> XComponent, YComponent, ZComponent
sort = SortList(Keys=pdecon.ZComponent, ValuesA=curvepoint)  # -> Keys, ValuesA
item_2 = ListItem(List=sort.ValuesA, Index=0, Wrap=True)
crv_cp = CurveClosestPoint(Point=item_2, Curve=R)  # -> Point, Parameter, Distance
pdecon_2 = Deconstruct(Point=crv_cp.Point)  # -> XComponent, YComponent, ZComponent
Z = ClusterInput()
pt = ConstructPoint(XCoordinate=pdecon_2.XComponent, YCoordinate=pdecon_2.YComponent, ZCoordinate=Z)
vec2pt = Vector2Pt(PointA=item_2, PointB=pt, Unitize=False)  # -> Vector, Length
move = Move(Geometry=orient.Geometry, Motion=vec2pt.Vector)  # -> Geometry, Transform
swp1 = Sweep1(Rail=R, Sections=move.Geometry, Miter=1)
S = ClusterOutput(swp1)

# ==== cluster Cluster_4
T = ClusterInput()
list = ValueList({"Point": 0, "Curve": 1, "Arc": 2, "Circle": 3, "Ellipse": 4, "Line": 5, "Polyline": 6, "Surface": 7, "Brep": 8, "Mesh": 9, "Polysurface": 10, "Block": 11, "Text": 12, "TextDot": 13, "Dimension": 14, "LinearDimension": 15, "AngularDimension": 16, "Hatch": 17, "Leader": 18}, selected="Brep")
split = TextSplit(Text=T, Separators=":")
G = ClusterInput()
item = ListItem(List=split, Index=0, Wrap=True)  # -> Item1, Item
filtertype = FilterByType(Geometry=G, ObjectType=list)
psrfclsd = IsPolysurfaceClosed(Polysurface=filtertype)
panel = Panel(item.Item1)
txt = Text(item.Item1)
dispatch = Dispatch(List=filtertype, DispatchPattern=psrfclsd)  # -> ListA, ListB
txt_2 = ClusterOutput(txt)
clean = CleanTree(RemoveNulls=True, RemoveInvalid=True, RemoveEmpty=invert(False), Tree=dispatch.ListB)
brep = Brep(clean)
open_breps = ClusterOutput(brep)
panel_2 = Panel(brep)
geometries = ClusterOutput(filtertype)
isconditioned = ClusterInput()
createhbzones = ClusterInput()
mass2zone = Honeybee_Masses2Zones(
    zoneMasses=flatten(dispatch.ListA),
    zoneNames=panel,
    isConditioned=isconditioned,
    maxRoofAngle=30,
    createHBZones=createhbzones)  # -> readMe, HBZones; plug-in component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
hbzones = ClusterOutput(mass2zone.HBZones)

# ==== cluster HotTempDate: Ordina le temperature dalla più calda alla meno calda e individua i giorni dell'anno corrispondenti
drybulb_temp = ClusterInput()
drybulb_temp_2 = Data(drybulb_temp)
strnum = Ladybug_SeparateData(inputList=flatten(drybulb_temp_2))  # -> numbers, strings; plug-in component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
sort = SortList(Keys=strnum.numbers)  # -> reverse(Keys), ValuesA
num = ClusterInput()
num_2 = Number(num)
cset = CreateSet(List=sort.Keys)  # -> Set, Map
item = ListItem(List=cset.Set, Index=num_2, Wrap=True)
selected_temp = Data(item)
selected_temp_2 = ClusterOutput(selected_temp)
mindex = MemberIndex(Set=strnum.numbers, Member=selected_temp)  # -> Index, Count
day_month_hour_calculator = Ladybug_Day_Month_Hour(HOY=mindex.Index)  # -> day, month, hour, date; plug-in component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
date = ClusterOutput(day_month_hour_calculator.date)
